# Dynamo custom node ExportFBX.dyf (Dynamo 0.9.1.4062)
# category: Core.File
# 将3D View内的模型导出为FBX格式文件

filePath = Input(filePath : string)  # Output File Path(Without File Name)
fileName = Input(fileName : string)  # Output File Name(Without File Path)
python_script = Python(IN[0]=filePath, IN[1]=fileName)
# ---------- python_script.python (48 lines) ----------
import clr
clr.AddReference('ProtoGeometry')
from Autodesk.DesignScript.Geometry import *

clr.AddReference('RevitAPIUI')
from Autodesk.Revit.UI import *

clr.AddReference('RevitAPI')
import Autodesk
from Autodesk.Revit.DB import *

#调用DocumentManager（import RevitServices）实现对Revit的Document的调用，不能用Dynamo中的CurrentDocument节点获取当前Document，不识别（不知道为什么）
clr.AddReference('RevitServices')
import RevitServices
from RevitServices.Persistence import DocumentManager
from RevitServices.Transactions import TransactionManager
from Autodesk.Revit.ApplicationServices import *
#该节点的输入内容将存储为 IN 变量中的一个列表。

dataEnteringNode = IN


#获取当前文档
document = DocumentManager.Instance.CurrentDBDocument;

#输出路径
exFolder = IN[0];
#输出文件名
fileName = IN[1];
#创建视图元素过滤收集器过滤3d视图
viewCollector = Autodesk.Revit.DB.FilteredElementCollector(document);
#过滤3d视图
viewCollector.OfCategory(BuiltInCategory.OST_Views).OfClass(View3D);
#获取第一个3d视图
view3D = viewCollector.FirstElement();


fbxop = FBXExportOptions();
fbxop.LevelsOfDetailValue = -1;
fbxop.StopOnError = False;
fbxop.UseLevelsOfDetail = False;
fbxop.WithoutBoundaryEdges = False;
viewset = ViewSet();
viewset.Insert(view3D);


#将输出内容指定给 OUT 变量。
OUT = document.Export(exFolder, fileName, viewset, fbxop);
# ----------------------------------------
