# Dynamo custom node createCubiod.dyf (Dynamo 0.9.1.4062)
# category: Geometry.PolyCurve
# 创建单卷杀长方体栱部分，
# cur->边界曲线
# width->长方体长度
# direction->延伸方向

code_block = CodeBlock()
# ---------- code_block.designscript (68 lines) ----------
//创建单卷杀长方体栱部分，
//cur->边界曲线
//width->长方体长度
//direction->延伸方向
def createCubiod(cur, width, direction)
{
 x1 = 0;
 y1 = 0;
 z1 = 0;
 x2 = 0;
 y2 = 0;
 z2 = 0;

 geometry = [Imperative]
 {
  if(direction == "x+")
  {
   x1 = cur.StartPoint.X + width;
   y1 = cur.StartPoint.Y;
   z1 = cur.StartPoint.Z;

   x2 = cur.EndPoint.X + width;
   y2 = cur.EndPoint.Y;
   z2 = cur.EndPoint.Z;
  }

  if(direction == "x-")
  {
   x1 = cur.StartPoint.X - width;
   y1 = cur.StartPoint.Y;
   z1 = cur.StartPoint.Z;

   x2 = cur.EndPoint.X - width;
   y2 = cur.EndPoint.Y;
   z2 = cur.EndPoint.Z;
  }

  if(direction == "y+")
  {
   x1 = cur.StartPoint.X;
   y1 = cur.StartPoint.Y + width;
   z1 = cur.StartPoint.Z;

   x2 = cur.EndPoint.X;
   y2 = cur.EndPoint.Y + width;
   z2 = cur.EndPoint.Z;
  }

  if(direction == "y-")
  {
   x1 = cur.StartPoint.X;
   y1 = cur.StartPoint.Y - width;
   z1 = cur.StartPoint.Z;

   x2 = cur.EndPoint.X;
   y2 = cur.EndPoint.Y - width;
   z2 = cur.EndPoint.Z;
  }
 }

 p1 = Point.ByCoordinates(x1, y1, z1);
 p2 = Point.ByCoordinates(x2, y2, z2);

 curve = PolyCurve.ByPoints({p1, p2}, false);

 return = curve;

};
# ----------------------------------------
cur = Input(cur:Curve)  # Boundary curve
width = Input(width:double)  # Width of cubiod
direction = Input(direction:string)  # direction
code_block_2 = CodeBlock(cur=cur, width=width, direction=direction) { createCubiod(cur, width, direction); }
PolyCurve = Output(code_block_2)
