# Dynamo custom node createDouGong.dyf (Dynamo 0.9.1.4062)
# category: Geometry.Solid
# 创建整体斗栱

# group: Inputs
CenterPoint = Input(CenterPoint : Point = Point.ByCoordinates(0, 0, 0))
b1_01 = Input(b1_01 : double = 100.0)
b_01 = Input(b_01 : double = 120.0)
h1_01 = Input(h1_01 : double = 30.0)
h2_01 = Input(h2_01 : double = 36.0)
b2_01 = Input(b2_01 : double = 40.0)
h_01 = Input(h_01 : double = 80.0)
m = Input(m : int = 4)
b_02 = Input(b_02 : double = 280.0)
h1_02 = Input(h1_02 : double = 32.0)
h_02 = Input(h_02 : double = 60.0)
b1_04 = Input(b1_04 : double = 45.0)
h1_04 = Input(h1_04 : double = 17.0)
b_04 = Input(b_04 : double = 70.0)
b2_04 = Input(b2_04 : double = 40.0)
h_04 = Input(h_04 : double = 45.0)
h2_04 = Input(h2_04 : double = 18.0)
h2_05 = Input(h2_05 : double = 0.0)
b_07 = Input(b_07 : double = 220.0)
b_06 = Input(b_06 : double = 466.0)
h1_06 = Input(h1_06 : double = 32.0)
h_06 = Input(h_06 : double = 60.0)
b2_08 = Input(b2_08 : double = 90.0)
b_08 = Input(b_08 : double = 396.0)
b_10 = Input(b_10 : double = 413.0)
h_09 = Input(h_09 : double = 60.0)
h1_10 = Input(h1_10 : double = 32.0)
b2_12 = Input(b2_12 : double = 90.0)
b_11 = Input(b_11 : double = 256.0)
b_12 = Input(b_12 : double = 632.0)
b_09 = Input(b_09 : double = 568.0)
h_13 = Input(h_13 : double = 60.0)
l_13 = Input(l_13 : double = 568.0)
l_14 = Input(l_14 : double = 466.0)
b1_15 = Input(b1_15 : double = 90.0)
b_15 = Input(b_15 : double = 722.0)
h_16 = Input(h_16 : double = 377.0)
r_16 = Input(r_16 : double = 70.0)

code_block = CodeBlock(b1_02=b2_01) { b1_02; }
createFirstTiao = Custom[createFirstTiao](p=CenterPoint, b1_01=b1_01, b_01=b_01, h1_01=h1_01, h2_01=h2_01, b2_01=b2_01, h_01=h_01, m=m, b_02=b_02, b1_02=code_block, h1_02=h1_02, h_02=h_02)  # 创建第一跳（栌斗+泥道栱+华栱
n1_BottomQuad = Output(createFirstTiao.Bottom_Quad)  # "_1_BottomQuad"
n1_T1 = Output(createFirstTiao.out1)  # "_1_T1"
n1_T4 = Output(createFirstTiao.out4)  # "_1_T4"
n1_T3 = Output(createFirstTiao.out3)  # "_1_T3"
n1_T2 = Output(createFirstTiao.out2)  # "_1_T2"
n1_U1 = Output(createFirstTiao.out5)  # "_1_U1"
n1_U2 = Output(createFirstTiao.out6)  # "_1_U2"
n1_U3 = Output(createFirstTiao.out7)  # "_1_U3"
n1_U4 = Output(createFirstTiao.out8)  # "_1_U4"
n1_JS1_C1 = Output(createFirstTiao.Juansha1_Curve_1)  # "_1_JS1_C1"
n1_JS1_S = Output(createFirstTiao.Juansha1_Surface)  # "_1_JS1_S"
n1_JS1_C2 = Output(createFirstTiao.Juansha1_Curve_2)  # "_1_JS1_C2"
n1_JS2_C2 = Output(createFirstTiao.Juansha2_Curve_2)  # "_1_JS2_C2"
n1_JS2_S = Output(createFirstTiao.Juansha2_Surface)  # "_1_JS2_S"
n1_JS2_C1 = Output(createFirstTiao.Juansha2_Curve_1)  # "_1_JS2_C1"
n1_JS3_C2 = Output(createFirstTiao.Juansha3_Curve_2)  # "_1_JS3_C2"
n1_JS3_S = Output(createFirstTiao.Juansha3_Surface)  # "_1_JS3_S"
n1_JS3_C1 = Output(createFirstTiao.Juansha3_Curve_1)  # "_1_JS3_C1"
n1_JS4_C2 = Output(createFirstTiao.Juansha4_Curve_2)  # "_1_JS4_C2"
n1_JS4_S = Output(createFirstTiao.Juansha4_Surface)  # "_1_JS4_S"
n1_JS4_C1 = Output(createFirstTiao.Juansha4_Curve_1)  # "_1_JS4_C1"
code_block_2 = CodeBlock(b1_06=b2_04) { b1_06; }
createSecondTiao = Custom[createSecondTiao](b2_01=b2_01, b1_04=b1_04, JSC_D1_1=createFirstTiao.Juansha1_Curve_1, JSC_D2_1=createFirstTiao.Juansha2_Curve_1, JSC_D3_1=createFirstTiao.Juansha3_Curve_1, h1_04=h1_04, b_04=b_04, b2_04=b2_04, h_04=h_04, h2_04=h2_04, h2_05=h2_05, b_07=b_07, b_06=b_06, b1_06=code_block_2, h1_06=h1_06, h_06=h_06, m=m, b2_08=b2_08, b_02=b_02, b_08=b_08)  # 创建第二跳
n2_SD1_Q = Output(createSecondTiao.SD1_Q)  # "_2_SD1_Q"
n2_SD2_Q = Output(createSecondTiao.Quad_of_SanDou_2)  # "_2_SD2_Q"
n2_JHD_Q = Output(createSecondTiao.Quad_of_JiaohuDou_1)  # "_2_JHD_Q"
n2_SD1_T1 = Output(createSecondTiao.SD1_T1)  # "_2_SD1_T1"
n2_SD1_T4 = Output(createSecondTiao.SD1_T4)  # "_2_SD1_T4"
n2_SD1_T3 = Output(createSecondTiao.SD1_T3)  # "_2_SD1_T3"
n2_SD1_T2 = Output(createSecondTiao.SD1_T2)  # "_2_SD1_T2"
n2_SD2_T1 = Output(createSecondTiao.SD2_T1)  # "_2_SD2_T1"
n2_SD2_T2 = Output(createSecondTiao.SD2_T2)  # "_2_SD2_T2"
n2_SD2_T3 = Output(createSecondTiao.SD2_T3)  # "_2_SD2_T3"
n2_SD2_T4 = Output(createSecondTiao.SD2_t4)  # "_2_SD2_T4"
n2_JHD_T1 = Output(createSecondTiao.JHD1_T1)  # "_2_JHD_T1"
n2_JHD_T2 = Output(createSecondTiao.JHD1_T2)  # "_2_JHD_T2"
n2_JHD_T3 = Output(createSecondTiao.JHD1_T3)  # "_2_JHD_T3"
n2_JHD_T4 = Output(createSecondTiao.JHD1_T4)  # "_2_JHD_T4"
n2_JHD_U4 = Output(createSecondTiao.JHD1_U31)  # "_2_JHD_U4"
n2_JHD_U3 = Output(createSecondTiao.JHD1_U30)  # "_2_JHD_U3"
n2_JHD_U2 = Output(createSecondTiao.JHD1_U2)  # "_2_JHD_U2"
n2_SD2_U2 = Output(createSecondTiao.SD2_U2)  # "_2_SD2_U2"
n2_SD2_U3 = Output(createSecondTiao.SD2_U3)  # "_2_SD2_U3"
n2_SD2_U4 = Output(createSecondTiao.SD2_U4)  # "_2_SD2_U4"
n2_SD2_U1 = Output(createSecondTiao.SD2_U1)  # "_2_SD2_U1"
n2_JHD_U1 = Output(createSecondTiao.JHD1_U1)  # "_2_JHD_U1"
n2_SD1_U4 = Output(createSecondTiao.SD1_U4)  # "_2_SD1_U4"
n2_SD1_U3 = Output(createSecondTiao.SD1_U3)  # "_2_SD1_U3"
n2_SD1_U2 = Output(createSecondTiao.SD1_U2)  # "_2_SD1_U2"
n2_SD1_U1 = Output(createSecondTiao.SD1_U1)  # "_2_SD1_U1"
n2_JS4_C2 = Output(createSecondTiao.JS4_C2)  # "_2_JS4_C2"
n2_JS3_C2 = Output(createSecondTiao.JS3_C2)  # "_2_JS3_C2"
n2_JS4_S = Output(createSecondTiao.JS4_S)  # "_2_JS4_S"
n2_JS3_S = Output(createSecondTiao.JS3_S)  # "_2_JS3_S"
n2_JS2_C2 = Output(createSecondTiao.JS1_C21)  # "_2_JS2_C2"
n2_JS2_S = Output(createSecondTiao.JS2_S)  # "_2_JS2_S"
n2_JS4_C1 = Output(createSecondTiao.JS4_C1)  # "_2_JS4_C1"
n2_JS1_S = Output(createSecondTiao.JS1_S)  # "_2_JS1_S"
n2_JS1_C2 = Output(createSecondTiao.JS1_C20)  # "_2_JS1_C2"
n2_JS2_C1 = Output(createSecondTiao.JS2_C1)  # "_2_JS2_C1"
n2_JS3_C1 = Output(createSecondTiao.JS3_C1)  # "_2_JS3_C1"
n2_JS1_C1 = Output(createSecondTiao.JS1_C1)  # "_2_JS1_C1"
n2_JS5_C2 = Output(createSecondTiao.JS5_C2)  # "_2_JS5_C2"
n2_JS5_S = Output(createSecondTiao.JS5_S)  # "_2_JS5_S"
n2_JS5_C1 = Output(createSecondTiao.JS5_C1)  # "_2_JS5_C1"
n2_Cuboid_Of_HG = Output(createSecondTiao.CuboidOfHG)  # "_2_Cuboid Of HG"
n2_MidCuboid = Output(createSecondTiao.MidCuboid)  # "_2_MidCuboid"
code_block_3 = CodeBlock(t_08=b2_04) { t_08; }
code_block_4 = CodeBlock(h_10=h_09) { h_10; }
code_block_5 = CodeBlock(b1_10=b2_04) { b1_10; }
code_block_6 = CodeBlock(h_12=h_09) { h_12; }
code_block_7 = CodeBlock(t_09=b2_04) { t_09; }
createThirdTiao = Custom[createThirdTiao](b2_01=b2_01, b1_04=b1_04, JSC_D1_S=createSecondTiao.JS1_S, JSC_D2_S=createSecondTiao.JS2_S, JSC_D3_S=createSecondTiao.JS3_S, h1_04=h1_04, b_04=b_04, b2_04=b2_04, h_04=h_04, h2_04=h2_04, h2_05=h2_05, b_07=b_07, m=m, t_08=code_block_3, JSC_D4_S=createSecondTiao.JS4_S, JSC_D5_S=createSecondTiao.JS5_S, b_10=b_10, h_10=code_block_4, b1_10=code_block_5, h1_10=h1_10, b2_12=b2_12, b_11=b_11, b_12=b_12, h_12=code_block_6, h_09=h_09, t_09=code_block_7, b_09=b_09)  # 创建第三跳
MG_Cuboid = Output(createThirdTiao.MG_Cuboid)
LG_Cuboid = Output(createThirdTiao.LG_Cuboid)
ST_Cuboid = Output(createThirdTiao.ST_Cuboid)
n3_JS5_C2 = Output(createThirdTiao.JS5_C2)  # "_3_JS5_C2"
n3_JS4_C2 = Output(createThirdTiao.JS4_C2)  # "_3_JS4_C2"
n3_JS4_S = Output(createThirdTiao.JS4_S)  # "_3_JS4_S"
n3_JS5_S = Output(createThirdTiao.JS5_S)  # "_3_JS5_S"
n3_JS3_C2 = Output(createThirdTiao.JS3_C2)  # "_3_JS3_C2"
n3_JS3_S = Output(createThirdTiao.JS3_S)  # "_3_JS3_S"
n3_JS2_C2 = Output(createThirdTiao.JS2_C2)  # "_3_JS2_C2"
n3_JS4_C1 = Output(createThirdTiao.JS4_C1)  # "_3_JS4_C1"
n3_JS2_S = Output(createThirdTiao.JS2_S)  # "_3_JS2_S"
n3_JS2_C1 = Output(createThirdTiao.JS2_C1)  # "_3_JS2_C1"
n3_JS3_C1 = Output(createThirdTiao.JS3_C1)  # "_3_JS3_C1"
n3_JS5_C1 = Output(createThirdTiao.JS5_C1)  # "_3_JS5_C1"
n3_JS1_C2 = Output(createThirdTiao.JS1_C2)  # "_3_JS1_C2"
n3_JS1_S = Output(createThirdTiao.JS1_S)  # "_3_JS1_S"
n3_JS1_C1 = Output(createThirdTiao.JS1_C1)  # "_3_JS1_C1"
n3_JHD_U4 = Output(createThirdTiao.JHD_U4)  # "_3_JHD_U4"
n3_JHD_U3 = Output(createThirdTiao.JHD_U3)  # "_3_JHD_U3"
n3_JHD_U2 = Output(createThirdTiao.JHD_U2)  # "_3_JHD_U2"
n3_SD2_U3 = Output(createThirdTiao.SD2_U3)  # "_3_SD2_U3"
n3_SD2_U4 = Output(createThirdTiao.SD2_U4)  # "_3_SD2_U4"
n3_SD2_U2 = Output(createThirdTiao.SD2_U2)  # "_3_SD2_U2"
n3_SD2_U1 = Output(createThirdTiao.SD2_U1)  # "_3_SD2_U1"
n3_JHD_U1 = Output(createThirdTiao.JHD_U1)  # "_3_JHD_U1"
n3_JHD_T4 = Output(createThirdTiao.JHD_T4)  # "_3_JHD_T4"
n3_SD2_T4 = Output(createThirdTiao.SD2_T4)  # "_3_SD2_T4"
n3_SD1_U4 = Output(createThirdTiao.SD1_U4)  # "_3_SD1_U4"
n3_SD1_U3 = Output(createThirdTiao.SD1_U3)  # "_3_SD1_U3"
n3_SD2_T3 = Output(createThirdTiao.SD2_T3)  # "_3_SD2_T3"
n3_JHD_T3 = Output(createThirdTiao.JHD_T3)  # "_3_JHD_T3"
n3_SD1_U2 = Output(createThirdTiao.SD1_U2)  # "_3_SD1_U2"
n3_SD1_U1 = Output(createThirdTiao.SD1_U1)  # "_3_SD1_U1"
n3_SD1_T4 = Output(createThirdTiao.SD1_T4)  # "_3_SD1_T4"
n3_SD1_T3 = Output(createThirdTiao.SD1_T3)  # "_3_SD1_T3"
n3_SD1_T2 = Output(createThirdTiao.SD1_T2)  # "_3_SD1_T2"
n3_JHD_T2 = Output(createThirdTiao.JHD_T2)  # "_3_JHD_T2"
n3_SD2_T2 = Output(createThirdTiao.SD2_T2)  # "_3_SD2_T2"
n3_SD1_T1 = Output(createThirdTiao.SD1_T1)  # "_3_SD1_T1"
n3_JHD_T1 = Output(createThirdTiao.JHD_T1)  # "_3_JHD_T1"
n3_SD2_T1 = Output(createThirdTiao.SD2_T1)  # "_3_SD2_T1"
n3_SD4_U3 = Output(createThirdTiao.SD4_U3)  # "_3_SD4_U3"
n3_SD4_U4 = Output(createThirdTiao.SD4_U4)  # "_3_SD4_U4"
n3_SD4_U2 = Output(createThirdTiao.SD4_U2)  # "_3_SD4_U2"
n3_SD4_U1 = Output(createThirdTiao.SD4_U1)  # "_3_SD4_U1"
n3_SD4_T4 = Output(createThirdTiao.SD4_T4)  # "_3_SD4_T4"
n3_SD3_U4 = Output(createThirdTiao.SD3_U4)  # "_3_SD3_U4"
n3_SD3_U3 = Output(createThirdTiao.SD3_U3)  # "_3_SD3_U3"
n3_SD3_U2 = Output(createThirdTiao.SD3_U2)  # "_3_SD3_U2"
n3_SD3_U1 = Output(createThirdTiao.SD3_U1)  # "_3_SD3_U1"
n3_SD3_T4 = Output(createThirdTiao.SD3_T4)  # "_3_SD3_T4"
n3_SD4_T3 = Output(createThirdTiao.SD4_T3)  # "_3_SD4_T3"
n3_SD3_T3 = Output(createThirdTiao.SD3_T3)  # "_3_SD3_T3"
n3_SD3_T2 = Output(createThirdTiao.SD3_T2)  # "_3_SD3_T2"
n3_SD4_T2 = Output(createThirdTiao.SD4_T2)  # "_3_SD4_T2"
n3_SD3_T1 = Output(createThirdTiao.SD3_T1)  # "_3_SD3_T1"
n3_SD4_T1 = Output(createThirdTiao.SD4_T1)  # "_3_SD4_T1"
n3_SD2_Q = Output(createThirdTiao.SD2_Q)  # "_3_SD2_Q"
n3_JHD_Q = Output(createThirdTiao.JHD_Q)  # "_3_JHD_Q"
n3_SD4_Q = Output(createThirdTiao.SD4_Q)  # "_3_SD4_Q"
n3_SD1_Q = Output(createThirdTiao.SD1_Q)  # "_3_SD1_Q"
n3_SD3_Q = Output(createThirdTiao.SD3_Q)  # "_3_SD3_Q"
n3_ZTF_Cuboid = Output(createThirdTiao.ZTF_Cuboid)  # "_3_ZTF_Cuboid"
code_block_8 = CodeBlock(w_13=b2_04)
# ---------- code_block_8.designscript (2 lines) ----------
//t_13
w_13;
# ----------------------------------------
code_block_9 = CodeBlock(w_14=b2_04)
# ---------- code_block_9.designscript (2 lines) ----------
//t_14
w_14;
# ----------------------------------------
code_block_10 = CodeBlock(t_15=b2_04) { t_15; }
code_block_11 = CodeBlock(h_15=h_13) { h_15; }
createFourTiao = Custom[createFourTiao](b2_01=b2_01, b1_04=b1_04, JSC_D1_1=createThirdTiao.SD1_Q, JSC_D2_1=createThirdTiao.SD2_Q, JSC_D3_1=createThirdTiao.JS1_S, h1_04=h1_04, b_04=b_04, b2_04=b2_04, h_04=h_04, h2_04=h2_04, h2_05=h2_05, JSC_D4_1=createThirdTiao.JS2_S, JSC_D5_1=createThirdTiao.JS3_S, JSC_D6_1=createThirdTiao.JS4_S, JSC_D7_1=createThirdTiao.JS5_S, h_13=h_13, w_13=code_block_8, l_13=l_13, w_14=code_block_9, l_14=l_14, b1_15=b1_15, t_15=code_block_10, b_15=b_15, h_15=code_block_11, center=CenterPoint, h_01=h_01, h_16=h_16, r_16=r_16, h_09=h_09)  # 创建第四跳
n4_JHD_U4 = Output(createFourTiao.JHD_U4)  # "_4_JHD_U4"
n4_JHD_U3 = Output(createFourTiao.JHD_U3)  # "_4_JHD_U3"
n4_SD4_U3 = Output(createFourTiao.SD4_U3)  # "_4_SD4_U3"
n4_SD4_U4 = Output(createFourTiao.SD4_U4)  # "_4_SD4_U4"
n4_JHD_U2 = Output(createFourTiao.JHD_U2)  # "_4_JHD_U2"
n4_SD4_U2 = Output(createFourTiao.SD4_U2)  # "_4_SD4_U2"
n4_SD3_U4 = Output(createFourTiao.SD3_U4)  # "_4_SD3_U4"
n4_SD3_U3 = Output(createFourTiao.SD3_U3)  # "_4_SD3_U3"
n4_JHD_U1 = Output(createFourTiao.JHD_U1)  # "_4_JHD_U1"
n4_SD3_U2 = Output(createFourTiao.SD3_U2)  # "_4_SD3_U2"
n4_SD4_U1 = Output(createFourTiao.SD4_U1)  # "_4_SD4_U1"
n4_SD3_U1 = Output(createFourTiao.SD3_U1)  # "_4_SD3_U1"
n4_JHD_T4 = Output(createFourTiao.JHD_T4)  # "_4_JHD_T4"
n4_SD4_T4 = Output(createFourTiao.SD4_T4)  # "_4_SD4_T4"
n4_SD3_T4 = Output(createFourTiao.SD3_T4)  # "_4_SD3_T4"
n4_SD2_U3 = Output(createFourTiao.SD2_U3)  # "_4_SD2_U3"
n4_SD2_U4 = Output(createFourTiao.SD2_U4)  # "_4_SD2_U4"
n4_SD2_U2 = Output(createFourTiao.SD2_U2)  # "_4_SD2_U2"
n4_SD2_U1 = Output(createFourTiao.SD2_U1)  # "_4_SD2_U1"
n4_SD2_T4 = Output(createFourTiao.SD2_T4)  # "_4_SD2_T4"
n4_JHD_T3 = Output(createFourTiao.JHD_T3)  # "_4_JHD_T3"
n4_SD2_T3 = Output(createFourTiao.SD2_T3)  # "_4_SD2_T3"
n4_SD4_T3 = Output(createFourTiao.SD4_T3)  # "_4_SD4_T3"
n4_SD3_T3 = Output(createFourTiao.SD3_T3)  # "_4_SD3_T3"
n6_JHD_T2 = Output(createFourTiao.JHD_T2)  # "_6_JHD_T2"
n4_SD2_T2 = Output(createFourTiao.SD2_T2)  # "_4_SD2_T2"
n4_SD3_T2 = Output(createFourTiao.SD3_T2)  # "_4_SD3_T2"
n4_SD4_T2 = Output(createFourTiao.SD4_T2)  # "_4_SD4_T2"
n4_SD1_U4 = Output(createFourTiao.SD1_U4)  # "_4_SD1_U4"
n4_SD1_U3 = Output(createFourTiao.SD1_U3)  # "_4_SD1_U3"
n4_SD1_U2 = Output(createFourTiao.SD1_U2)  # "_4_SD1_U2"
n4_SD1_U1 = Output(createFourTiao.SD1_U1)  # "_4_SD1_U1"
n6_JHD_T1 = Output(createFourTiao.JHD_T1)  # "_6_JHD_T1"
n4_SD1_T4 = Output(createFourTiao.SD1_T4)  # "_4_SD1_T4"
n4_SD1_T3 = Output(createFourTiao.SD1_T3)  # "_4_SD1_T3"
n4_SD1_T2 = Output(createFourTiao.SD1_T2)  # "_4_SD1_T2"
n4_SD2_T1 = Output(createFourTiao.SD2_T1)  # "_4_SD2_T1"
n4_SD3_T1 = Output(createFourTiao.SD3_T1)  # "_4_SD3_T1"
n4_SD4_T1 = Output(createFourTiao.SD4_T1)  # "_4_SD4_T1"
n4_SD1_T1 = Output(createFourTiao.SD1_T1)  # "_4_SD1_T1"
n4_JHD_Q = Output(createFourTiao.JHD_Q)  # "_4_JHD_Q"
n4_SD4_Q = Output(createFourTiao.SD4_Q)  # "_4_SD4_Q"
n4_SD2_Q = Output(createFourTiao.SD2_Q)  # "_4_SD2_Q"
n4_SD1_Q = Output(createFourTiao.SD1_Q)  # "_4_SD1_Q"
n4_SD3_Q = Output(createFourTiao.SD3_Q)  # "_4_SD3_Q"
n4_SD6_U3 = Output(createFourTiao.SD6_U3)  # "_4_SD6_U3"
n4_SD6_U4 = Output(createFourTiao.SD6_U4)  # "_4_SD6_U4"
n4_SD6_U2 = Output(createFourTiao.SD6_U2)  # "_4_SD6_U2"
n4_SD6_U1 = Output(createFourTiao.SD6_U1)  # "_4_SD6_U1"
n4_SD5_U4 = Output(createFourTiao.SD5_U4)  # "_4_SD5_U4"
n4_SD5_U3 = Output(createFourTiao.SD5_U3)  # "_4_SD5_U3"
n4_SD5_U2 = Output(createFourTiao.SD5_U2)  # "_4_SD5_U2"
n4_SD5_U1 = Output(createFourTiao.SD5_U1)  # "_4_SD5_U1"
n4_SD6_T4 = Output(createFourTiao.SD6_T4)  # "_4_SD6_T4"
n4_SD5_T4 = Output(createFourTiao.SD5_T4)  # "_4_SD5_T4"
n4_SD5_T3 = Output(createFourTiao.SD5_T3)  # "_4_SD5_T3"
n4_SD6_T3 = Output(createFourTiao.SD6_T3)  # "_4_SD6_T3"
n4_SD5_T2 = Output(createFourTiao.SD5_T2)  # "_4_SD5_T2"
n4_SD6_T2 = Output(createFourTiao.SD6_T2)  # "_4_SD6_T2"
n4_SD5_T1 = Output(createFourTiao.SD5_T1)  # "_4_SD5_T1"
n4_SD6_T1 = Output(createFourTiao.SD6_T1)  # "_4_SD6_T1"
n4_SD6_Q = Output(createFourTiao.SD6_Q)  # "_4_SD6_Q"
n4_SD5_Q = Output(createFourTiao.SD5_Q)  # "_4_SD5_Q"
n4_13_Fang = Output(createFourTiao.13_Fang)  # "_4_13_Fang"
n4_14_Fang2 = Output(createFourTiao.14_Fang2)  # "_4_14_Fang2"
n4_14_Fang3 = Output(createFourTiao.14_Fang3)  # "_4_14_Fang3"
n4_14_Fang1 = Output(createFourTiao.14_Fang1)  # "_4_14_Fang1"
n4_15_Fang = Output(createFourTiao.15_Fang)  # "_4_15_Fang"
n4_16_ChaZhu = Output(createFourTiao.16_ChaZhu)  # "_4_16_ChaZhu"
