# Dynamo custom node createFirstTiao.dyf (Dynamo 0.9.1.4062)
# category: Geometry.Solid
# 创建第一跳（栌斗+泥道栱+华栱

p = Input(p:Point = Point.ByCoordinates(0, 0, 0))  # center of LuDou
b1_01 = Input(b1_01:double = 100.0)  # b1 of LuDou
code_block = CodeBlock(b1=b1_01) { b1 /  2; }
createQuad = Custom[createQuad](p=p, radius=code_block)  # 创建四边形面 p->面的中心点 r->面的边长 z->面的位置z值
byPatch = Surface.ByPatch(createQuad)
Bottom_Quad = Output(byPatch)
b_01 = Input(b_01:double = 120)  # b of LuDou
code_block_2 = CodeBlock(b=b_01, b1=b1_01) { (b - b1) / 2; }
number = DoubleInput(0.5)
number_2 = DoubleInput(0)
pointAtParameter = Surface.PointAtParameter(surface=byPatch, u=number, v=number_2)
h1_01 = Input(h1_01:double = 30.0)  # h1 of LuDou
string = StringInput("y-")
createTrape = Custom[createTrape](d=code_block_2, d1=b1_01, p=pointAtParameter, h=h1_01, d2=b_01, direction=string)  # 创建梯形平面 p->短边中心点 d1->短边边长 d2->长边边长 h->高 d->倾斜进深 direc->倾斜方向
byPatch_2 = Surface.ByPatch(createTrape)
Trape_y = Output(byPatch_2)  # "Trape y-"
number_3 = DoubleInput(0.5)
number_4 = DoubleInput(1)
pointAtParameter_2 = Surface.PointAtParameter(surface=byPatch, u=number_3, v=number_4)
string_2 = StringInput("y+")
createTrape_2 = Custom[createTrape](d=code_block_2, d1=b1_01, p=pointAtParameter_2, h=h1_01, d2=b_01, direction=string_2)
byPatch_3 = Surface.ByPatch(createTrape_2)
Trape_y_2 = Output(byPatch_3)  # "Trape y+"
number_5 = DoubleInput(1)
number_6 = DoubleInput(0.5)
pointAtParameter_3 = Surface.PointAtParameter(surface=byPatch, u=number_5, v=number_6)
string_3 = StringInput("x+")
createTrape_3 = Custom[createTrape](d=code_block_2, d1=b1_01, p=pointAtParameter_3, h=h1_01, d2=b_01, direction=string_3)
byPatch_4 = Surface.ByPatch(createTrape_3)
Trape_x = Output(byPatch_4)  # "Trape x+"
number_7 = DoubleInput(0)
number_8 = DoubleInput(0.5)
pointAtParameter_4 = Surface.PointAtParameter(surface=byPatch, u=number_7, v=number_8)
string_4 = StringInput("x-")
createTrape_4 = Custom[createTrape](d=code_block_2, d1=b1_01, p=pointAtParameter_4, h=h1_01, d2=b_01, direction=string_4)
byPatch_5 = Surface.ByPatch(createTrape_4)
Trape_x_2 = Output(byPatch_5)  # "Trape x-"
h_01 = Input(h_01:double = 80.0)  # h of LuDou
code_block_3 = CodeBlock(h=h_01, h1=h1_01) { h - h1; }
h2_01 = Input(h2_01:double = 36.0)  # h2 of LuDou
string_5 = StringInput("x")
number_9 = DoubleInput(0)
number_10 = DoubleInput(0.5)
pointAtParameter_5 = Surface.PointAtParameter(surface=byPatch_2, u=number_9, v=number_10)
b2_01 = Input(b2_01:double = 40.0)  # b2 of LuDou
createUPlane = Custom[createUPlane](w=b_01, h1=code_block_3, h2=h2_01, direction=string_5, p=pointAtParameter_5, w1=b2_01)  # 创建枓U型侧面 p->底边中心定位点 w->长边长 w1->顶部短边长 h1->高（h - h1) h2->中间U型部分高 direc->绘制方向
byPatch_6 = Surface.ByPatch(createUPlane)
U_Plane_y = Output(byPatch_6)  # "U Plane  y-"
pointAtParameter_6 = Surface.PointAtParameter(surface=byPatch_3, u=number_9, v=number_10)
createUPlane_2 = Custom[createUPlane](w=b_01, h1=code_block_3, h2=h2_01, direction=string_5, p=pointAtParameter_6, w1=b2_01)
byPatch_7 = Surface.ByPatch(createUPlane_2)
U_Plane_y_2 = Output(byPatch_7)  # "U Plane y+"
string_6 = StringInput("y")
pointAtParameter_7 = Surface.PointAtParameter(surface=byPatch_4, u=number_9, v=number_10)
createUPlane_3 = Custom[createUPlane](w=b_01, h1=code_block_3, h2=h2_01, direction=string_6, p=pointAtParameter_7, w1=b2_01)
byPatch_8 = Surface.ByPatch(createUPlane_3)
U_Plane_x = Output(byPatch_8)  # "U Plane x+"
pointAtParameter_8 = Surface.PointAtParameter(surface=byPatch_5, u=number_9, v=number_10)
createUPlane_4 = Custom[createUPlane](w=b_01, h1=code_block_3, h2=h2_01, direction=string_6, p=pointAtParameter_8, w1=b2_01)
byPatch_9 = Surface.ByPatch(createUPlane_4)
U_Plane_x_2 = Output(byPatch_9)  # "U Plane x-"
h = Input(h : double = 60.0)  # h of NiDaoGong
code_block_4 = CodeBlock(h2=h2_01, h1=code_block_3) { h2 / h1; }
code_block_5 = CodeBlock(w1=b2_01, w=b_01) { w1 / w; }
pointAtParameter_9 = Surface.PointAtParameter(surface=byPatch_6, u=code_block_4, v=code_block_5)
b1 = Input(b1 : double = 60.0)  # b1 of NiDaoGong
b = Input(b : double = 280.0)  # b of NiDaoGong
code_block_6 = CodeBlock(b=b, b1=b1, b_01=b_01) { ((b - 2 * b1) - b_01) / 2; }
m = Input(m : int = 4)  # Number of Juansha
h1 = Input(h1 : double = 32.0)  # h1 of NiDaoGong
string_7 = StringInput("y-")
createJuanshaCurve = Custom[createJuanshaCurve](h=h, p=pointAtParameter_9, b1=b1, b2=code_block_6, m=m, h1=h1, direction=string_7)  # 创建卷杀曲线 p->定位点 b1->卷杀部分长 b2->其余部分长 m->卷杀段数 h1->卷杀部分高 h->整体高 direc->方向
code_block_7 = CodeBlock(w1=b2_01, w=b_01) { 1 - w1 / w; }
pointAtParameter_10 = Surface.PointAtParameter(surface=byPatch_6, u=code_block_4, v=code_block_7)
createJuanshaCurve_2 = Custom[createJuanshaCurve](h=h, p=pointAtParameter_10, b1=b1, b2=code_block_6, m=m, h1=h1, direction=string_7)
join = List.Join(createJuanshaCurve, createJuanshaCurve_2)
byLoft = Surface.ByLoft(join)
Juansha_Surface_y = Output(byLoft)  # "Juansha Surface y-"
pointAtParameter_11 = Surface.PointAtParameter(surface=byPatch_7, u=code_block_4, v=code_block_5)
string_8 = StringInput("y+")
createJuanshaCurve_3 = Custom[createJuanshaCurve](h=h, p=pointAtParameter_11, b1=b1, b2=code_block_6, m=m, h1=h1, direction=string_8)
pointAtParameter_12 = Surface.PointAtParameter(surface=byPatch_7, u=code_block_4, v=code_block_7)
createJuanshaCurve_4 = Custom[createJuanshaCurve](h=h, p=pointAtParameter_12, b1=b1, b2=code_block_6, m=m, h1=h1, direction=string_8)
join_2 = List.Join(createJuanshaCurve_3, createJuanshaCurve_4)
byLoft_2 = Surface.ByLoft(join_2)
Juansha_Surface_y_2 = Output(byLoft_2)  # "Juansha Surface y+"
pointAtParameter_13 = Surface.PointAtParameter(surface=byPatch_8, u=code_block_4, v=code_block_7)
string_9 = StringInput("x+")
createJuanshaCurve_5 = Custom[createJuanshaCurve](h=h, p=pointAtParameter_13, b1=b1, b2=code_block_6, m=m, h1=h1, direction=string_9)
byPatch_10 = Surface.ByPatch(createJuanshaCurve_5)
Juansha_Curve_x_2 = Output(byPatch_10)  # "Juansha Curve x+ 2"
pointAtParameter_14 = Surface.PointAtParameter(surface=byPatch_9, u=code_block_4, v=code_block_5)
string_10 = StringInput("x-")
createJuanshaCurve_6 = Custom[createJuanshaCurve](h=h, p=pointAtParameter_14, b1=b1, b2=code_block_6, m=m, h1=h1, direction=string_10)
byPatch_11 = Surface.ByPatch(createJuanshaCurve_6)
Juansha_Curve_x_1 = Output(byPatch_11)  # "Juansha Curve x- 1"
pointAtParameter_15 = Surface.PointAtParameter(surface=byPatch_9, u=code_block_4, v=code_block_7)
createJuanshaCurve_7 = Custom[createJuanshaCurve](h=h, p=pointAtParameter_15, b1=b1, b2=code_block_6, m=m, h1=h1, direction=string_10)
join_3 = List.Join(createJuanshaCurve_6, createJuanshaCurve_7)
byLoft_3 = Surface.ByLoft(join_3)
Juansha_Surface_x = Output(byLoft_3)  # "Juansha Surface x-"
byPatch_12 = Surface.ByPatch(createJuanshaCurve_2)
Juansha_Curve_y_2 = Output(byPatch_12)  # "Juansha Curve y- 2"
byPatch_13 = Surface.ByPatch(createJuanshaCurve_4)
Juansha_CUrve_y_2 = Output(byPatch_13)  # "Juansha CUrve y+ 2"
pointAtParameter_16 = Surface.PointAtParameter(surface=byPatch_8, u=code_block_4, v=code_block_5)
createJuanshaCurve_8 = Custom[createJuanshaCurve](h=h, p=pointAtParameter_16, b1=b1, b2=code_block_6, m=m, h1=h1, direction=string_9)
byPatch_14 = Surface.ByPatch(createJuanshaCurve_8)
Juansha_Curve_x_1_2 = Output(byPatch_14)  # "Juansha Curve x+ 1"
join_4 = List.Join(createJuanshaCurve_8, createJuanshaCurve_5)
byLoft_4 = Surface.ByLoft(join_4)
Juansha_Surface_x_2 = Output(byLoft_4)  # "Juansha Surface x+"
byPatch_15 = Surface.ByPatch(createJuanshaCurve_7)
Juansha_Curve_x_2_2 = Output(byPatch_15)  # "Juansha Curve x- 2"
byPatch_16 = Surface.ByPatch(createJuanshaCurve)
Juansha_Curve_y_1 = Output(byPatch_16)  # "Juansha Curve y- 1"
byPatch_17 = Surface.ByPatch(createJuanshaCurve_3)
Juansha_CUrve_y_1 = Output(byPatch_17)  # "Juansha CUrve y+ 1"
