# Dynamo custom node createFourTiao.dyf (Dynamo 0.9.1.4062)
# category: Geometry.Solid
# 创建第四跳

# group: Inputs
JSC_D1_1 = Input(JSC_D1_1 : Surface)  # Juansha Curve direction 1
h_04 = Input(h_04 : double = 45.0)  # h of SanDou/JiaohuDou
h2_04 = Input(h2_04 : double = 18.0)  # h2 of SanDou
b1_04 = Input(b1_04 : double = 46.0)  # b1 of SanDou
JSC_D2_1 = Input(JSC_D2_1 : Surface)  # Juansha Curve direction 2
JSC_D3_1 = Input(JSC_D3_1 : PolySurface)  # Juansha Curve direction 3
b2_01 = Input(b2_01 : double = 40.0)  # b2 of LuDou
JSC_D4_1 = Input(JSC_D4_1 : PolySurface)  # Juansha Curve direction 4
JSC_D5_1 = Input(JSC_D5_1 : PolySurface)  # Juansha Curve direction 5
JSC_D6_1 = Input(JSC_D6_1 : PolySurface)  # Juansha Curve direction 6
JSC_D7_1 = Input(JSC_D7_1 : PolySurface)  # Juansha Curve direction 7
b_04 = Input(b_04 : double = 70.0)  # b of SanDou/JiaohuDou
h1_04 = Input(h1_04 : double = 17.0)  # h1 of SanDou/JiaohuDou
b2_04 = Input(b2_04 : double = 40.0)  # b2 of SanDou/JiaohuDou
h2_05 = Input(h2_05 :double = 0.0)  # h2 of JiaohuDou
b1_15 = Input(b1_15 : double = 90.0)  # b1 of ShengTouMu
t_15 = Input(t_15 : double = 40.0)  # t of ShengTouMu
b_15 = Input(b_15 : double = 722.0)  # b of ShengTouMu
h_15 = Input(h_15 : double = 60.0)  # h of ShengTouMu
h_13 = Input(h_13 : double = 60.0)  # h of ZhuTouFang2
w_14 = Input(w_14 : double = 40.0)  # w of PuBanFang
l_14 = Input(l_14 : double = 466.0)  # l of PuBanFang
h_16 = Input(h_16 : double = 377.0)  # h of ChaZhu
center = Input(center : Point = Point.ByCoordinates(0, 0, 0))  # center of all
h_01 = Input(h_01 :double = 80.0)  # h of LuDou
r_16 = Input(r_16 : double = 70.0)  # r of ChaZhu
w_13 = Input(w_13 : double = 40.0)  # w of ZhuTouFang2
l_13 = Input(l_13 : double = 568.0)  # l of ZhuTouFang2

number = DoubleInput(0.5)
number_2 = DoubleInput(0.5)
pointAtParameter = Surface.PointAtParameter(surface=JSC_D1_1, u=number, v=number_2)
h_09 = Input(h_09 : double = 60.0)  # h of ZhuTouFang
code_block = CodeBlock(h_04=h_04, h2_04=h2_04, h_09=h_09) { (h_04 - h2_04) + h_09; }
translate = Geometry.Translate(geometry=pointAtParameter, zTranslation=code_block)
code_block_2 = CodeBlock(b1=b1_04) { b1 / 2; }
code_block_3 = CodeBlock(p=translate, r=code_block_2) { createQuadCenter(p, r); }
byPatch = Surface.ByPatch(code_block_3)
number_3 = DoubleInput(0.5)
number_4 = DoubleInput(0.5)
pointAtParameter_2 = Surface.PointAtParameter(surface=JSC_D2_1, u=number_3, v=number_4)
code_block_4 = CodeBlock(h_04=h_04, h2_04=h2_04, h_09=h_09) { (h_04 - h2_04) + h_09; }
translate_2 = Geometry.Translate(geometry=pointAtParameter_2, zTranslation=code_block_4)
code_block_5 = CodeBlock(b1=b1_04) { b1 / 2; }
code_block_6 = CodeBlock(p=translate_2, r=code_block_5) { createQuadCenter(p, r); }
byPatch_2 = Surface.ByPatch(code_block_6)
surfaces = PolySurface.Surfaces(JSC_D3_1)
number_5 = DoubleInput(6)
getItemAtIndex = List.GetItemAtIndex(list=surfaces, index=number_5)
number_6 = DoubleInput(0)
number_7 = DoubleInput(1)
pointAtParameter_3 = Surface.PointAtParameter(surface=getItemAtIndex, u=number_6, v=number_7)
x_draft = CodeBlock(b=b1_04) { b / 2; }
y_draft = CodeBlock(b=b2_01) { b / 2; }
translate_3 = Geometry.Translate(geometry=pointAtParameter_3, xTranslation=x_draft, yTranslation=y_draft)
code_block_7 = CodeBlock(b1=b1_04) { b1 / 2; }
createQuad = Custom[createQuad](p=translate_3, radius=code_block_7)  # 创建四边形面 p->面的中心点 r->面的边长 z->面的位置z值
byPatch_3 = Surface.ByPatch(createQuad)
surfaces_2 = PolySurface.Surfaces(JSC_D4_1)
number_8 = DoubleInput(6)
getItemAtIndex_2 = List.GetItemAtIndex(list=surfaces_2, index=number_8)
number_9 = DoubleInput(0)
number_10 = DoubleInput(1)
pointAtParameter_4 = Surface.PointAtParameter(surface=getItemAtIndex_2, u=number_9, v=number_10)
x_draft_2 = CodeBlock(b=b1_04) { b / 2; }
y_draft_2 = CodeBlock(b=b2_01) { b / 2; }
code_block_8 = CodeBlock(y=y_draft_2) { -y; }
translate_4 = Geometry.Translate(geometry=pointAtParameter_4, xTranslation=x_draft_2, yTranslation=code_block_8)
code_block_9 = CodeBlock(b1=b1_04) { b1 / 2; }
createQuad_2 = Custom[createQuad](p=translate_4, radius=code_block_9)
byPatch_4 = Surface.ByPatch(createQuad_2)
surfaces_3 = PolySurface.Surfaces(JSC_D5_1)
number_11 = DoubleInput(6)
getItemAtIndex_3 = List.GetItemAtIndex(list=surfaces_3, index=number_11)
number_12 = DoubleInput(0)
number_13 = DoubleInput(1)
pointAtParameter_5 = Surface.PointAtParameter(surface=getItemAtIndex_3, u=number_12, v=number_13)
x_draft_3 = CodeBlock(b=b1_04) { b / 2; }
y_draft_3 = CodeBlock(b=b2_01) { b / 2; }
translate_5 = Geometry.Translate(geometry=pointAtParameter_5, xTranslation=x_draft_3, yTranslation=y_draft_3)
code_block_10 = CodeBlock(b1=b1_04) { b1 / 2; }
createQuad_3 = Custom[createQuad](p=translate_5, radius=code_block_10)
byPatch_5 = Surface.ByPatch(createQuad_3)
surfaces_4 = PolySurface.Surfaces(JSC_D6_1)
number_14 = DoubleInput(6)
getItemAtIndex_4 = List.GetItemAtIndex(list=surfaces_4, index=number_14)
number_15 = DoubleInput(0)
number_16 = DoubleInput(1)
pointAtParameter_6 = Surface.PointAtParameter(surface=getItemAtIndex_4, u=number_15, v=number_16)
x_draft_4 = CodeBlock(b=b1_04) { b / 2; }
y_draft_4 = CodeBlock(b=b2_01) { b / 2; }
code_block_11 = CodeBlock(y=y_draft_4) { -y; }
translate_6 = Geometry.Translate(geometry=pointAtParameter_6, xTranslation=x_draft_4, yTranslation=code_block_11)
code_block_12 = CodeBlock(b1=b1_04) { b1 / 2; }
createQuad_4 = Custom[createQuad](p=translate_6, radius=code_block_12)
byPatch_6 = Surface.ByPatch(createQuad_4)
surfaces_5 = PolySurface.Surfaces(JSC_D7_1)
number_17 = DoubleInput(6)
getItemAtIndex_5 = List.GetItemAtIndex(list=surfaces_5, index=number_17)
number_18 = DoubleInput(0)
number_19 = DoubleInput(1)
pointAtParameter_7 = Surface.PointAtParameter(surface=getItemAtIndex_5, u=number_18, v=number_19)
x_draft_5 = CodeBlock(b=b1_04) { b / 2; }
code_block_13 = CodeBlock(x=x_draft_5) { -x; }
y_draft_5 = CodeBlock(b=b2_01) { b / 2; }
translate_7 = Geometry.Translate(geometry=pointAtParameter_7, xTranslation=code_block_13, yTranslation=y_draft_5)
code_block_14 = CodeBlock(b1=b1_04) { b1 / 2; }
createQuad_5 = Custom[createQuad](p=translate_7, radius=code_block_14)
byPatch_7 = Surface.ByPatch(createQuad_5)
code_block_15 = CodeBlock(b=b_04, b1=b1_04) { (b - b1) / 2; }
number_20 = DoubleInput(0)
number_21 = DoubleInput(0.5)
pointAtParameter_8 = Surface.PointAtParameter(surface=byPatch_7, u=number_20, v=number_21)
string = StringInput("x-")
createTrape = Custom[createTrape](d=code_block_15, d1=b1_04, p=pointAtParameter_8, h=h1_04, d2=b_04, direction=string)  # 创建梯形平面 p->短边中心点 d1->短边边长 d2->长边边长 h->高 d->倾斜进深 direc->倾斜方向
byPatch_8 = Surface.ByPatch(createTrape)
number_22 = DoubleInput(1)
number_23 = DoubleInput(0.5)
pointAtParameter_9 = Surface.PointAtParameter(surface=byPatch_7, u=number_22, v=number_23)
string_2 = StringInput("x+")
createTrape_2 = Custom[createTrape](d=code_block_15, d1=b1_04, p=pointAtParameter_9, h=h1_04, d2=b_04, direction=string_2)
byPatch_9 = Surface.ByPatch(createTrape_2)
number_24 = DoubleInput(0.5)
number_25 = DoubleInput(1)
pointAtParameter_10 = Surface.PointAtParameter(surface=byPatch_7, u=number_24, v=number_25)
string_3 = StringInput("y+")
createTrape_3 = Custom[createTrape](d=code_block_15, d1=b1_04, p=pointAtParameter_10, h=h1_04, d2=b_04, direction=string_3)
byPatch_10 = Surface.ByPatch(createTrape_3)
number_26 = DoubleInput(0.5)
number_27 = DoubleInput(0)
pointAtParameter_11 = Surface.PointAtParameter(surface=byPatch_7, u=number_26, v=number_27)
string_4 = StringInput("y-")
createTrape_4 = Custom[createTrape](d=code_block_15, d1=b1_04, p=pointAtParameter_11, h=h1_04, d2=b_04, direction=string_4)
byPatch_11 = Surface.ByPatch(createTrape_4)
code_block_16 = CodeBlock(b=b_04, b1=b1_04) { (b - b1) / 2; }
number_28 = DoubleInput(1)
number_29 = DoubleInput(0.5)
pointAtParameter_12 = Surface.PointAtParameter(surface=byPatch_6, u=number_28, v=number_29)
string_5 = StringInput("x+")
createTrape_5 = Custom[createTrape](d=code_block_16, d1=b1_04, p=pointAtParameter_12, h=h1_04, d2=b_04, direction=string_5)
byPatch_12 = Surface.ByPatch(createTrape_5)
number_30 = DoubleInput(0)
number_31 = DoubleInput(0.5)
pointAtParameter_13 = Surface.PointAtParameter(surface=byPatch_6, u=number_30, v=number_31)
string_6 = StringInput("x-")
createTrape_6 = Custom[createTrape](d=code_block_16, d1=b1_04, p=pointAtParameter_13, h=h1_04, d2=b_04, direction=string_6)
byPatch_13 = Surface.ByPatch(createTrape_6)
number_32 = DoubleInput(0.5)
number_33 = DoubleInput(0)
pointAtParameter_14 = Surface.PointAtParameter(surface=byPatch_6, u=number_32, v=number_33)
string_7 = StringInput("y-")
createTrape_7 = Custom[createTrape](d=code_block_16, d1=b1_04, p=pointAtParameter_14, h=h1_04, d2=b_04, direction=string_7)
byPatch_14 = Surface.ByPatch(createTrape_7)
number_34 = DoubleInput(0.5)
number_35 = DoubleInput(1)
pointAtParameter_15 = Surface.PointAtParameter(surface=byPatch_6, u=number_34, v=number_35)
string_8 = StringInput("y+")
createTrape_8 = Custom[createTrape](d=code_block_16, d1=b1_04, p=pointAtParameter_15, h=h1_04, d2=b_04, direction=string_8)
byPatch_15 = Surface.ByPatch(createTrape_8)
code_block_17 = CodeBlock(b=b_04, b1=b1_04) { (b - b1) / 2; }
number_36 = DoubleInput(1)
number_37 = DoubleInput(0.5)
pointAtParameter_16 = Surface.PointAtParameter(surface=byPatch_5, u=number_36, v=number_37)
string_9 = StringInput("x+")
createTrape_9 = Custom[createTrape](d=code_block_17, d1=b1_04, p=pointAtParameter_16, h=h1_04, d2=b_04, direction=string_9)
byPatch_16 = Surface.ByPatch(createTrape_9)
number_38 = DoubleInput(0)
number_39 = DoubleInput(0.5)
pointAtParameter_17 = Surface.PointAtParameter(surface=byPatch_5, u=number_38, v=number_39)
string_10 = StringInput("x-")
createTrape_10 = Custom[createTrape](d=code_block_17, d1=b1_04, p=pointAtParameter_17, h=h1_04, d2=b_04, direction=string_10)
byPatch_17 = Surface.ByPatch(createTrape_10)
number_40 = DoubleInput(0.5)
number_41 = DoubleInput(0)
pointAtParameter_18 = Surface.PointAtParameter(surface=byPatch_5, u=number_40, v=number_41)
string_11 = StringInput("y-")
createTrape_11 = Custom[createTrape](d=code_block_17, d1=b1_04, p=pointAtParameter_18, h=h1_04, d2=b_04, direction=string_11)
byPatch_18 = Surface.ByPatch(createTrape_11)
number_42 = DoubleInput(0.5)
number_43 = DoubleInput(1)
pointAtParameter_19 = Surface.PointAtParameter(surface=byPatch_5, u=number_42, v=number_43)
string_12 = StringInput("y+")
createTrape_12 = Custom[createTrape](d=code_block_17, d1=b1_04, p=pointAtParameter_19, h=h1_04, d2=b_04, direction=string_12)
byPatch_19 = Surface.ByPatch(createTrape_12)
code_block_18 = CodeBlock(b=b_04, b1=b1_04) { (b - b1) / 2; }
number_44 = DoubleInput(0)
number_45 = DoubleInput(0.5)
pointAtParameter_20 = Surface.PointAtParameter(surface=byPatch_4, u=number_44, v=number_45)
string_13 = StringInput("x-")
createTrape_13 = Custom[createTrape](d=code_block_18, d1=b1_04, p=pointAtParameter_20, h=h1_04, d2=b_04, direction=string_13)
byPatch_20 = Surface.ByPatch(createTrape_13)
number_46 = DoubleInput(1)
number_47 = DoubleInput(0.5)
pointAtParameter_21 = Surface.PointAtParameter(surface=byPatch_4, u=number_46, v=number_47)
string_14 = StringInput("x+")
createTrape_14 = Custom[createTrape](d=code_block_18, d1=b1_04, p=pointAtParameter_21, h=h1_04, d2=b_04, direction=string_14)
byPatch_21 = Surface.ByPatch(createTrape_14)
number_48 = DoubleInput(0.5)
number_49 = DoubleInput(0)
pointAtParameter_22 = Surface.PointAtParameter(surface=byPatch_4, u=number_48, v=number_49)
string_15 = StringInput("y-")
createTrape_15 = Custom[createTrape](d=code_block_18, d1=b1_04, p=pointAtParameter_22, h=h1_04, d2=b_04, direction=string_15)
byPatch_22 = Surface.ByPatch(createTrape_15)
number_50 = DoubleInput(0.5)
number_51 = DoubleInput(1)
pointAtParameter_23 = Surface.PointAtParameter(surface=byPatch_4, u=number_50, v=number_51)
string_16 = StringInput("y+")
createTrape_16 = Custom[createTrape](d=code_block_18, d1=b1_04, p=pointAtParameter_23, h=h1_04, d2=b_04, direction=string_16)
byPatch_23 = Surface.ByPatch(createTrape_16)
code_block_19 = CodeBlock(b=b_04, b1=b1_04) { (b - b1) / 2; }
number_52 = DoubleInput(1)
number_53 = DoubleInput(0.5)
pointAtParameter_24 = Surface.PointAtParameter(surface=byPatch_3, u=number_52, v=number_53)
string_17 = StringInput("x+")
createTrape_17 = Custom[createTrape](d=code_block_19, d1=b1_04, p=pointAtParameter_24, h=h1_04, d2=b_04, direction=string_17)
byPatch_24 = Surface.ByPatch(createTrape_17)
number_54 = DoubleInput(0)
number_55 = DoubleInput(0.5)
pointAtParameter_25 = Surface.PointAtParameter(surface=byPatch_3, u=number_54, v=number_55)
string_18 = StringInput("x-")
createTrape_18 = Custom[createTrape](d=code_block_19, d1=b1_04, p=pointAtParameter_25, h=h1_04, d2=b_04, direction=string_18)
byPatch_25 = Surface.ByPatch(createTrape_18)
number_56 = DoubleInput(0.5)
number_57 = DoubleInput(0)
pointAtParameter_26 = Surface.PointAtParameter(surface=byPatch_3, u=number_56, v=number_57)
string_19 = StringInput("y-")
createTrape_19 = Custom[createTrape](d=code_block_19, d1=b1_04, p=pointAtParameter_26, h=h1_04, d2=b_04, direction=string_19)
byPatch_26 = Surface.ByPatch(createTrape_19)
number_58 = DoubleInput(0.5)
number_59 = DoubleInput(1)
pointAtParameter_27 = Surface.PointAtParameter(surface=byPatch_3, u=number_58, v=number_59)
string_20 = StringInput("y+")
createTrape_20 = Custom[createTrape](d=code_block_19, d1=b1_04, p=pointAtParameter_27, h=h1_04, d2=b_04, direction=string_20)
byPatch_27 = Surface.ByPatch(createTrape_20)
code_block_20 = CodeBlock(b=b_04, b1=b1_04) { (b - b1) / 2; }
number_60 = DoubleInput(1)
number_61 = DoubleInput(0.5)
pointAtParameter_28 = Surface.PointAtParameter(surface=byPatch_2, u=number_60, v=number_61)
string_21 = StringInput("x+")
createTrape_21 = Custom[createTrape](d=code_block_20, d1=b1_04, p=pointAtParameter_28, h=h1_04, d2=b_04, direction=string_21)
byPatch_28 = Surface.ByPatch(createTrape_21)
number_62 = DoubleInput(0)
number_63 = DoubleInput(0.5)
pointAtParameter_29 = Surface.PointAtParameter(surface=byPatch_2, u=number_62, v=number_63)
string_22 = StringInput("x-")
createTrape_22 = Custom[createTrape](d=code_block_20, d1=b1_04, p=pointAtParameter_29, h=h1_04, d2=b_04, direction=string_22)
byPatch_29 = Surface.ByPatch(createTrape_22)
number_64 = DoubleInput(0.5)
number_65 = DoubleInput(1)
pointAtParameter_30 = Surface.PointAtParameter(surface=byPatch_2, u=number_64, v=number_65)
string_23 = StringInput("y+")
createTrape_23 = Custom[createTrape](d=code_block_20, d1=b1_04, p=pointAtParameter_30, h=h1_04, d2=b_04, direction=string_23)
byPatch_30 = Surface.ByPatch(createTrape_23)
number_66 = DoubleInput(0.5)
number_67 = DoubleInput(0)
pointAtParameter_31 = Surface.PointAtParameter(surface=byPatch_2, u=number_66, v=number_67)
string_24 = StringInput("y-")
createTrape_24 = Custom[createTrape](d=code_block_20, d1=b1_04, p=pointAtParameter_31, h=h1_04, d2=b_04, direction=string_24)
byPatch_31 = Surface.ByPatch(createTrape_24)
code_block_21 = CodeBlock(b=b_04, b1=b1_04) { (b - b1) / 2; }
number_68 = DoubleInput(1)
number_69 = DoubleInput(0.5)
pointAtParameter_32 = Surface.PointAtParameter(surface=byPatch, u=number_68, v=number_69)
string_25 = StringInput("x+")
createTrape_25 = Custom[createTrape](d=code_block_21, d1=b1_04, p=pointAtParameter_32, h=h1_04, d2=b_04, direction=string_25)
byPatch_32 = Surface.ByPatch(createTrape_25)
number_70 = DoubleInput(0)
number_71 = DoubleInput(0.5)
pointAtParameter_33 = Surface.PointAtParameter(surface=byPatch, u=number_70, v=number_71)
string_26 = StringInput("x-")
createTrape_26 = Custom[createTrape](d=code_block_21, d1=b1_04, p=pointAtParameter_33, h=h1_04, d2=b_04, direction=string_26)
byPatch_33 = Surface.ByPatch(createTrape_26)
number_72 = DoubleInput(0.5)
number_73 = DoubleInput(0)
pointAtParameter_34 = Surface.PointAtParameter(surface=byPatch, u=number_72, v=number_73)
string_27 = StringInput("y-")
createTrape_27 = Custom[createTrape](d=code_block_21, d1=b1_04, p=pointAtParameter_34, h=h1_04, d2=b_04, direction=string_27)
byPatch_34 = Surface.ByPatch(createTrape_27)
number_74 = DoubleInput(0.5)
number_75 = DoubleInput(1)
pointAtParameter_35 = Surface.PointAtParameter(surface=byPatch, u=number_74, v=number_75)
string_28 = StringInput("y+")
createTrape_28 = Custom[createTrape](d=code_block_21, d1=b1_04, p=pointAtParameter_35, h=h1_04, d2=b_04, direction=string_28)
byPatch_35 = Surface.ByPatch(createTrape_28)
code_block_22 = CodeBlock(h=h_04, h1=h1_04) { h - h1; }
string_29 = StringInput("x")
number_76 = DoubleInput(0.5)
number_77 = DoubleInput(0)
pointAtParameter_36 = Surface.PointAtParameter(surface=byPatch_34, u=number_76, v=number_77)
createUPlane = Custom[createUPlane](w=b_04, h1=code_block_22, h2=h2_04, direction=string_29, p=pointAtParameter_36, w1=b2_04)  # 创建枓U型侧面 p->底边中心定位点 w->长边长 w1->顶部短边长 h1->高（h - h1) h2->中间U型部分高 direc->绘制方向
byPatch_36 = Surface.ByPatch(createUPlane)
number_78 = DoubleInput(0.5)
number_79 = DoubleInput(1)
pointAtParameter_37 = Surface.PointAtParameter(surface=byPatch_35, u=number_78, v=number_79)
createUPlane_2 = Custom[createUPlane](w=b_04, h1=code_block_22, h2=h2_04, direction=string_29, p=pointAtParameter_37, w1=b2_04)
byPatch_37 = Surface.ByPatch(createUPlane_2)
string_30 = StringInput("y")
number_80 = DoubleInput(0)
number_81 = DoubleInput(0.5)
pointAtParameter_38 = Surface.PointAtParameter(surface=byPatch_32, u=number_80, v=number_81)
createUPlane_3 = Custom[createUPlane](w=b_04, h1=code_block_22, h2=h2_05, direction=string_30, p=pointAtParameter_38, w1=b2_04)
byPatch_38 = Surface.ByPatch(createUPlane_3)
number_82 = DoubleInput(0)
number_83 = DoubleInput(0.5)
pointAtParameter_39 = Surface.PointAtParameter(surface=byPatch_33, u=number_82, v=number_83)
createUPlane_4 = Custom[createUPlane](w=b_04, h1=code_block_22, h2=h2_05, direction=string_30, p=pointAtParameter_39, w1=b2_04)
byPatch_39 = Surface.ByPatch(createUPlane_4)
code_block_23 = CodeBlock(h=h_04, h1=h1_04) { h - h1; }
string_31 = StringInput("x")
number_84 = DoubleInput(0.5)
number_85 = DoubleInput(0)
pointAtParameter_40 = Surface.PointAtParameter(surface=byPatch_31, u=number_84, v=number_85)
createUPlane_5 = Custom[createUPlane](w=b_04, h1=code_block_23, h2=h2_04, direction=string_31, p=pointAtParameter_40, w1=b2_04)
byPatch_40 = Surface.ByPatch(createUPlane_5)
number_86 = DoubleInput(0.5)
number_87 = DoubleInput(1)
pointAtParameter_41 = Surface.PointAtParameter(surface=byPatch_30, u=number_86, v=number_87)
createUPlane_6 = Custom[createUPlane](w=b_04, h1=code_block_23, h2=h2_04, direction=string_31, p=pointAtParameter_41, w1=b2_04)
byPatch_41 = Surface.ByPatch(createUPlane_6)
string_32 = StringInput("y")
number_88 = DoubleInput(0)
number_89 = DoubleInput(0.5)
pointAtParameter_42 = Surface.PointAtParameter(surface=byPatch_28, u=number_88, v=number_89)
createUPlane_7 = Custom[createUPlane](w=b_04, h1=code_block_23, h2=h2_05, direction=string_32, p=pointAtParameter_42, w1=b2_04)
byPatch_42 = Surface.ByPatch(createUPlane_7)
number_90 = DoubleInput(0)
number_91 = DoubleInput(0.5)
pointAtParameter_43 = Surface.PointAtParameter(surface=byPatch_29, u=number_90, v=number_91)
createUPlane_8 = Custom[createUPlane](w=b_04, h1=code_block_23, h2=h2_05, direction=string_32, p=pointAtParameter_43, w1=b2_04)
byPatch_43 = Surface.ByPatch(createUPlane_8)
code_block_24 = CodeBlock(h=h_04, h1=h1_04) { h - h1; }
string_33 = StringInput("x")
number_92 = DoubleInput(0.5)
number_93 = DoubleInput(0)
pointAtParameter_44 = Surface.PointAtParameter(surface=byPatch_26, u=number_92, v=number_93)
createUPlane_9 = Custom[createUPlane](w=b_04, h1=code_block_24, h2=h2_04, direction=string_33, p=pointAtParameter_44, w1=b2_04)
byPatch_44 = Surface.ByPatch(createUPlane_9)
number_94 = DoubleInput(0.5)
number_95 = DoubleInput(1)
pointAtParameter_45 = Surface.PointAtParameter(surface=byPatch_27, u=number_94, v=number_95)
createUPlane_10 = Custom[createUPlane](w=b_04, h1=code_block_24, h2=h2_04, direction=string_33, p=pointAtParameter_45, w1=b2_04)
byPatch_45 = Surface.ByPatch(createUPlane_10)
string_34 = StringInput("y")
number_96 = DoubleInput(0)
number_97 = DoubleInput(0.5)
pointAtParameter_46 = Surface.PointAtParameter(surface=byPatch_24, u=number_96, v=number_97)
createUPlane_11 = Custom[createUPlane](w=b_04, h1=code_block_24, h2=h2_05, direction=string_34, p=pointAtParameter_46, w1=b2_04)
byPatch_46 = Surface.ByPatch(createUPlane_11)
number_98 = DoubleInput(0)
number_99 = DoubleInput(0.5)
pointAtParameter_47 = Surface.PointAtParameter(surface=byPatch_25, u=number_98, v=number_99)
createUPlane_12 = Custom[createUPlane](w=b_04, h1=code_block_24, h2=h2_05, direction=string_34, p=pointAtParameter_47, w1=b2_04)
byPatch_47 = Surface.ByPatch(createUPlane_12)
code_block_25 = CodeBlock(h=h_04, h1=h1_04) { h - h1; }
string_35 = StringInput("x")
number_100 = DoubleInput(0.5)
number_101 = DoubleInput(0)
pointAtParameter_48 = Surface.PointAtParameter(surface=byPatch_22, u=number_100, v=number_101)
createUPlane_13 = Custom[createUPlane](w=b_04, h1=code_block_25, h2=h2_04, direction=string_35, p=pointAtParameter_48, w1=b2_04)
byPatch_48 = Surface.ByPatch(createUPlane_13)
number_102 = DoubleInput(0.5)
number_103 = DoubleInput(1)
pointAtParameter_49 = Surface.PointAtParameter(surface=byPatch_23, u=number_102, v=number_103)
createUPlane_14 = Custom[createUPlane](w=b_04, h1=code_block_25, h2=h2_04, direction=string_35, p=pointAtParameter_49, w1=b2_04)
byPatch_49 = Surface.ByPatch(createUPlane_14)
string_36 = StringInput("y")
number_104 = DoubleInput(0)
number_105 = DoubleInput(0.5)
pointAtParameter_50 = Surface.PointAtParameter(surface=byPatch_20, u=number_104, v=number_105)
createUPlane_15 = Custom[createUPlane](w=b_04, h1=code_block_25, h2=h2_05, direction=string_36, p=pointAtParameter_50, w1=b2_04)
byPatch_50 = Surface.ByPatch(createUPlane_15)
number_106 = DoubleInput(0)
number_107 = DoubleInput(0.5)
pointAtParameter_51 = Surface.PointAtParameter(surface=byPatch_21, u=number_106, v=number_107)
createUPlane_16 = Custom[createUPlane](w=b_04, h1=code_block_25, h2=h2_05, direction=string_36, p=pointAtParameter_51, w1=b2_04)
byPatch_51 = Surface.ByPatch(createUPlane_16)
code_block_26 = CodeBlock(h=h_04, h1=h1_04) { h - h1; }
string_37 = StringInput("x")
number_108 = DoubleInput(0.5)
number_109 = DoubleInput(0)
pointAtParameter_52 = Surface.PointAtParameter(surface=byPatch_18, u=number_108, v=number_109)
createUPlane_17 = Custom[createUPlane](w=b_04, h1=code_block_26, h2=h2_04, direction=string_37, p=pointAtParameter_52, w1=b2_04)
byPatch_52 = Surface.ByPatch(createUPlane_17)
number_110 = DoubleInput(0.5)
number_111 = DoubleInput(1)
pointAtParameter_53 = Surface.PointAtParameter(surface=byPatch_19, u=number_110, v=number_111)
createUPlane_18 = Custom[createUPlane](w=b_04, h1=code_block_26, h2=h2_04, direction=string_37, p=pointAtParameter_53, w1=b2_04)
byPatch_53 = Surface.ByPatch(createUPlane_18)
string_38 = StringInput("y")
number_112 = DoubleInput(0)
number_113 = DoubleInput(0.5)
pointAtParameter_54 = Surface.PointAtParameter(surface=byPatch_16, u=number_112, v=number_113)
createUPlane_19 = Custom[createUPlane](w=b_04, h1=code_block_26, h2=h2_05, direction=string_38, p=pointAtParameter_54, w1=b2_04)
byPatch_54 = Surface.ByPatch(createUPlane_19)
number_114 = DoubleInput(0)
number_115 = DoubleInput(0.5)
pointAtParameter_55 = Surface.PointAtParameter(surface=byPatch_17, u=number_114, v=number_115)
createUPlane_20 = Custom[createUPlane](w=b_04, h1=code_block_26, h2=h2_05, direction=string_38, p=pointAtParameter_55, w1=b2_04)
byPatch_55 = Surface.ByPatch(createUPlane_20)
code_block_27 = CodeBlock(h=h_04, h1=h1_04) { h - h1; }
string_39 = StringInput("x")
number_116 = DoubleInput(0.5)
number_117 = DoubleInput(0)
pointAtParameter_56 = Surface.PointAtParameter(surface=byPatch_14, u=number_116, v=number_117)
createUPlane_21 = Custom[createUPlane](w=b_04, h1=code_block_27, h2=h2_04, direction=string_39, p=pointAtParameter_56, w1=b2_04)
byPatch_56 = Surface.ByPatch(createUPlane_21)
number_118 = DoubleInput(0.5)
number_119 = DoubleInput(1)
pointAtParameter_57 = Surface.PointAtParameter(surface=byPatch_15, u=number_118, v=number_119)
createUPlane_22 = Custom[createUPlane](w=b_04, h1=code_block_27, h2=h2_04, direction=string_39, p=pointAtParameter_57, w1=b2_04)
byPatch_57 = Surface.ByPatch(createUPlane_22)
string_40 = StringInput("y")
number_120 = DoubleInput(0)
number_121 = DoubleInput(0.5)
pointAtParameter_58 = Surface.PointAtParameter(surface=byPatch_12, u=number_120, v=number_121)
createUPlane_23 = Custom[createUPlane](w=b_04, h1=code_block_27, h2=h2_05, direction=string_40, p=pointAtParameter_58, w1=b2_04)
byPatch_58 = Surface.ByPatch(createUPlane_23)
number_122 = DoubleInput(0)
number_123 = DoubleInput(0.5)
pointAtParameter_59 = Surface.PointAtParameter(surface=byPatch_13, u=number_122, v=number_123)
createUPlane_24 = Custom[createUPlane](w=b_04, h1=code_block_27, h2=h2_05, direction=string_40, p=pointAtParameter_59, w1=b2_04)
byPatch_59 = Surface.ByPatch(createUPlane_24)
code_block_28 = CodeBlock(h=h_04, h1=h1_04) { h - h1; }
string_41 = StringInput("x")
number_124 = DoubleInput(0.5)
number_125 = DoubleInput(0)
pointAtParameter_60 = Surface.PointAtParameter(surface=byPatch_11, u=number_124, v=number_125)
createUPlane_25 = Custom[createUPlane](w=b_04, h1=code_block_28, h2=h2_04, direction=string_41, p=pointAtParameter_60, w1=b2_04)
byPatch_60 = Surface.ByPatch(createUPlane_25)
number_126 = DoubleInput(0.5)
number_127 = DoubleInput(1)
pointAtParameter_61 = Surface.PointAtParameter(surface=byPatch_10, u=number_126, v=number_127)
createUPlane_26 = Custom[createUPlane](w=b_04, h1=code_block_28, h2=h2_04, direction=string_41, p=pointAtParameter_61, w1=b2_04)
byPatch_61 = Surface.ByPatch(createUPlane_26)
string_42 = StringInput("y")
number_128 = DoubleInput(0)
number_129 = DoubleInput(0.5)
pointAtParameter_62 = Surface.PointAtParameter(surface=byPatch_9, u=number_128, v=number_129)
createUPlane_27 = Custom[createUPlane](w=b_04, h1=code_block_28, h2=h2_05, direction=string_42, p=pointAtParameter_62, w1=b2_04)
byPatch_62 = Surface.ByPatch(createUPlane_27)
number_130 = DoubleInput(0)
number_131 = DoubleInput(0.5)
pointAtParameter_63 = Surface.PointAtParameter(surface=byPatch_8, u=number_130, v=number_131)
createUPlane_28 = Custom[createUPlane](w=b_04, h1=code_block_28, h2=h2_05, direction=string_42, p=pointAtParameter_63, w1=b2_04)
byPatch_63 = Surface.ByPatch(createUPlane_28)
code_block_29 = CodeBlock(h2=h2_04, h1=code_block_28) { h2 / h1; }
code_block_30 = CodeBlock(b=b_04, b2=b2_04) { ((b - b2) / 2) + b2; }
code_block_31 = CodeBlock(w1=code_block_30, w=b_04) { w1 / w; }
pointAtParameter_64 = Surface.PointAtParameter(surface=byPatch_62, u=code_block_29, v=code_block_31)
code_block_32 = CodeBlock(b1_15=b1_15, b_05=b_04, b4_05=code_block_31) { b1_15 - (b_05 - b4_05); }
createHGFang = Custom[createHGFang](p=pointAtParameter_64, db=code_block_32, w=t_15, l=b_15, h=h_15)  # 获取华栱创建枋类构件的中心点 p->栌斗内角点 db->超出栌斗部分的长度 w->枋的宽 l->枋的长 h->枋的高
number_132 = DoubleInput(0.5)
number_133 = DoubleInput(0.5)
pointAtParameter_65 = Surface.PointAtParameter(surface=byPatch_5, u=number_132, v=number_133)
code_block_33 = CodeBlock(h=h_04, h1=h1_04, h2=h2_04) { h - h1 - h2; }
number_134 = DoubleInput(0.5)
number_135 = DoubleInput(0.5)
pointAtParameter_66 = Surface.PointAtParameter(surface=byPatch_6, u=number_134, v=number_135)
getMidPoint = Custom[getMidPoint](p2=pointAtParameter_65, h1=h1_04, dh=code_block_33, h=h_13, p1=pointAtParameter_66)  # 获取柱头坊的中心点 p1, p2->两侧散枓的内角点 h1->散枓的h1 dh->散枓的U型底高 h->枋的高
byLengths = Cuboid.ByLengths(origin=getMidPoint, width=w_14, length=l_14, height=h_13)
number_136 = DoubleInput(0)
number_137 = DoubleInput(0)
byCoordinates = Point.ByCoordinates(x=number_136, y=number_137, z=h_16)
translate_8 = Geometry.Translate(geometry=center, zTranslation=h_01)
byPointsRadius = Cylinder.ByPointsRadius(byCoordinates, translate_8, r_16)
number_138 = DoubleInput(0.5)
number_139 = DoubleInput(0.5)
pointAtParameter_67 = Surface.PointAtParameter(surface=byPatch_3, u=number_138, v=number_139)
code_block_34 = CodeBlock(h=h_04, h1=h1_04, h2=h2_04) { h - h1 - h2; }
number_140 = DoubleInput(0.5)
number_141 = DoubleInput(0.5)
pointAtParameter_68 = Surface.PointAtParameter(surface=byPatch_4, u=number_140, v=number_141)
getMidPoint_2 = Custom[getMidPoint](p2=pointAtParameter_67, h1=h1_04, dh=code_block_34, h=h_13, p1=pointAtParameter_68)
byLengths_2 = Cuboid.ByLengths(origin=getMidPoint_2, width=w_14, length=l_14, height=h_13)
number_142 = DoubleInput(0.5)
number_143 = DoubleInput(0.5)
pointAtParameter_69 = Surface.PointAtParameter(surface=byPatch, u=number_142, v=number_143)
code_block_35 = CodeBlock(h=h_04, h1=h1_04, h2=h2_04) { h - h1 - h2; }
number_144 = DoubleInput(0.5)
number_145 = DoubleInput(0.5)
pointAtParameter_70 = Surface.PointAtParameter(surface=byPatch_2, u=number_144, v=number_145)
getMidPoint_3 = Custom[getMidPoint](p2=pointAtParameter_69, h1=h1_04, dh=code_block_35, h=h_13, p1=pointAtParameter_70)
byLengths_3 = Cuboid.ByLengths(origin=getMidPoint_3, width=w_13, length=l_13, height=h_13)
number_146 = DoubleInput(0.5)
number_147 = DoubleInput(0.5)
pointAtParameter_71 = Surface.PointAtParameter(surface=byPatch_7, u=number_146, v=number_147)
code_block_36 = CodeBlock(h=h_04, h2=h2_04, h_14=h_13) { h - h2 + h_14 / 2; }
translate_9 = Geometry.Translate(geometry=pointAtParameter_71, zTranslation=code_block_36)
byLengths_4 = Cuboid.ByLengths(origin=translate_9, width=w_14, length=l_14, height=h_13)

# group: Outputs
SD1_Q = Output(byPatch)
SD2_Q = Output(byPatch_2)
SD3_Q = Output(byPatch_3)
SD4_Q = Output(byPatch_4)
SD5_Q = Output(byPatch_5)
SD6_Q = Output(byPatch_6)
JHD_Q = Output(byPatch_7)
JHD_T4 = Output(byPatch_8)
JHD_T3 = Output(byPatch_9)
JHD_T2 = Output(byPatch_10)
JHD_T1 = Output(byPatch_11)
SD6_T3 = Output(byPatch_12)
SD6_T4 = Output(byPatch_13)
SD6_T1 = Output(byPatch_14)
SD6_T2 = Output(byPatch_15)
SD5_T3 = Output(byPatch_16)
SD5_T4 = Output(byPatch_17)
SD5_T1 = Output(byPatch_18)
SD5_T2 = Output(byPatch_19)
SD4_T4 = Output(byPatch_20)
SD4_T3 = Output(byPatch_21)
SD4_T1 = Output(byPatch_22)
SD4_T2 = Output(byPatch_23)
SD3_T3 = Output(byPatch_24)
SD3_T4 = Output(byPatch_25)
SD3_T1 = Output(byPatch_26)
SD3_T2 = Output(byPatch_27)
SD2_T3 = Output(byPatch_28)
SD2_T4 = Output(byPatch_29)
SD2_T2 = Output(byPatch_30)
SD2_T1 = Output(byPatch_31)
SD1_T3 = Output(byPatch_32)
SD1_T4 = Output(byPatch_33)
SD1_T1 = Output(byPatch_34)
SD1_T2 = Output(byPatch_35)
SD1_U1 = Output(byPatch_36)
SD1_U2 = Output(byPatch_37)
SD1_U3 = Output(byPatch_38)
SD1_U4 = Output(byPatch_39)
SD2_U1 = Output(byPatch_40)
SD2_U2 = Output(byPatch_41)
SD2_U3 = Output(byPatch_42)
SD2_U4 = Output(byPatch_43)
SD3_U1 = Output(byPatch_44)
SD3_U2 = Output(byPatch_45)
SD3_U3 = Output(byPatch_46)
SD3_U4 = Output(byPatch_47)
SD4_U1 = Output(byPatch_48)
SD4_U2 = Output(byPatch_49)
SD4_U4 = Output(byPatch_50)
SD4_U3 = Output(byPatch_51)
SD5_U1 = Output(byPatch_52)
SD5_U2 = Output(byPatch_53)
SD5_U3 = Output(byPatch_54)
SD5_U4 = Output(byPatch_55)
SD6_U1 = Output(byPatch_56)
SD6_U2 = Output(byPatch_57)
SD6_U3 = Output(byPatch_58)
SD6_U4 = Output(byPatch_59)
JHD_U1 = Output(byPatch_60)
JHD_U2 = Output(byPatch_61)
JHD_U3 = Output(byPatch_62)
JHD_U4 = Output(byPatch_63)
n15_Fang = Output(createHGFang)  # "15_Fang"
n14_Fang1 = Output(byLengths)  # "14_Fang1"
n16_ChaZhu = Output(byPointsRadius)  # "16_ChaZhu"
n14_Fang2 = Output(byLengths_2)  # "14_Fang2"
n13_Fang = Output(byLengths_3)  # "13_Fang"
n14_Fang3 = Output(byLengths_4)  # "14_Fang3"
