# Dynamo custom node createHGFang.dyf (Dynamo 0.9.1.4062)
# category: Geometry.Cuboid
# 获取华栱创建枋类构件的中心点
# p->栌斗内角点
# db->超出栌斗部分的长度
# w->枋的宽
# l->枋的长
# h->枋的高

code_block = CodeBlock()
# ---------- code_block.designscript (18 lines) ----------
//获取华栱创建枋类构件的中心点
//p->栌斗内角点
//db->超出栌斗部分的长度
//w->枋的宽
//l->枋的长
//h->枋的高
def createHGFang(p, db, w, l, h)
{
 x1 = p.X + db - l / 2;
 y1 = p.Y - w / 2;
 z1 = p.Z + h / 2;

 p1 = Point.ByCoordinates(x1, y1, z1);

 cube = Cuboid.ByLengths(p1, l, w, h);

 return = cube;
};
# ----------------------------------------
p = Input(p:Point)  # Inner corner of Dou
db = Input(db:double)  # Length of overpassing Dou
w = Input(w:double)  # Width of Fang
l = Input(l:double)  # Length of Fang
h = Input(h:double)  # Height of Fang
code_block_2 = CodeBlock(p=p, db=db, w=w, l=l, h=h) { createHGFang(p, db, w, l, h); }
Cuboid = Output(code_block_2)
