# Dynamo custom node createJuanshaCurve.dyf (Dynamo 0.9.1.4062)
# category: Geometry.PolyCurve
# 创建卷杀曲线
# p->定位点
# b1->卷杀部分长
# b2->其余部分长
# m->卷杀段数
# h1->卷杀部分高
# h->整体高
# direc->方向

code_block = CodeBlock()
# ---------- code_block.designscript (195 lines) ----------
//创建卷杀曲线
//p->定位点
//b1->卷杀部分长
//b2->其余部分长
//m->卷杀段数
//h1->卷杀部分高
//h->整体高
//direc->方向
def createJuanshaCurve(p, b1, b2, m, h1, h, direc)
{
 x1 = 0;
 y1 = 0;
 z1 = 0;
 x2 = 0;
 y2 = 0;
 z2 = 0;
 x3 = 0;
 y3 = 0;
 z3 = 0;
 x4 = 0;
 y4 = 0;
 z4 = 0;
 x5 = 0;
 y5 = 0;
 z5 = 0;
 x6 = 0;
 y6 = 0;
 z6 = 0;
 x7 = 0;
 y7 = 0;
 z7 = 0;
 x8 = 0;
 y8 = 0;
 z8 = 0;
 geometry = [Imperative]
 {

  if(direc == "x+")
  {
   x1 = p.X;
   y1 = p.Y;
   z1 = p.Z;

   x2 = p.X + b2;
   y2 = p.Y;
   z2 = p.Z;

   x3 = p.X + b2 + ((4 / 10) * b1);
   y3 = p.Y;
   z3 = p.Z + ((1 / 10) * h1);

   x4 = p.X + b2 + ((7 / 10) * b1);
   y4 = p.Y;
   z4 = p.Z + ((3 / 10) * h1);

   x5 = p.X + b2 + ((9 / 10) * b1);
   y5 = p.Y;
   z5 = p.Z + ((6 / 10) * h1);

   x6 = p.X + b2 + b1;
   y6 = p.Y;
   z6 = p.Z + h1;

   x7 = p.X + b2 + b1;
   y7 = p.Y;
   z7 = p.Z + h;

   x8 = p.X;
   y8 = p.Y;
   z8 = p.Z + h;
  }

  if(direc == "x-")
  {
   x1 = p.X;
   y1 = p.Y;
   z1 = p.Z;

   x2 = p.X - b2;
   y2 = p.Y;
   z2 = p.Z;

   x3 = p.X - b2 - ((4 / 10) * b1);
   y3 = p.Y;
   z3 = p.Z + ((1 / 10) * h1);

   x4 = p.X - b2 - ((7 / 10) * b1);
   y4 = p.Y;
   z4 = p.Z + ((3 / 10) * h1);

   x5 = p.X - b2 - ((9 / 10) * b1);
   y5 = p.Y;
   z5 = p.Z + ((6 / 10) * h1);

   x6 = p.X - b2 - b1;
   y6 = p.Y;
   z6 = p.Z + h1;

   x7 = p.X - b2 - b1;
   y7 = p.Y;
   z7 = p.Z + h;

   x8 = p.X;
   y8 = p.Y;
   z8 = p.Z + h;
  }

  if(direc == "y+")
  {
   x1 = p.X;
   y1 = p.Y;
   z1 = p.Z;

   x2 = p.X;
   y2 = p.Y + b2;
   z2 = p.Z;

   x3 = p.X;
   y3 = p.Y + b2 + ((4 / 10) * b1);
   z3 = p.Z + ((1 / 10) * h1);

   x4 = p.X;
   y4 = p.Y + b2 + ((7 / 10) * b1);
   z4 = p.Z + ((3 / 10) * h1);

   x5 = p.X;
   y5 = p.Y + b2 + ((9 / 10) * b1);
   z5 = p.Z + ((6 / 10) * h1);

   x6 = p.X;
   y6 = p.Y + b2 + b1;
   z6 = p.Z + h1;

   x7 = p.X;
   y7 = p.Y + b2 + b1;
   z7 = p.Z + h;

   x8 = p.X;
   y8 = p.Y;
   z8 = p.Z + h;
  }

  if(direc == "y-")
  {
   x1 = p.X;
   y1 = p.Y;
   z1 = p.Z;

   x2 = p.X;
   y2 = p.Y - b2;
   z2 = p.Z;

   x3 = p.X;
   y3 = p.Y - b2 - ((4 / 10) * b1);
   z3 = p.Z + ((1 / 10) * h1);

   x4 = p.X;
   y4 = p.Y - b2 - ((7 / 10) * b1);
   z4 = p.Z + ((3 / 10) * h1);

   x5 = p.X;
   y5 = p.Y - b2 - ((9 / 10) * b1);
   z5 = p.Z + ((6 / 10) * h1);

   x6 = p.X;
   y6 = p.Y - b2 - b1;
   z6 = p.Z + h1;

   x7 = p.X;
   y7 = p.Y - b2 - b1;
   z7 = p.Z + h;

   x8 = p.X;
   y8 = p.Y;
   z8 = p.Z + h;
  }
 }


 p1 = Point.ByCoordinates(x1, y1, z1);
 p2 = Point.ByCoordinates(x2, y2, z2);
 p3 = Point.ByCoordinates(x3, y3, z3);
 p4 = Point.ByCoordinates(x4, y4, z4);
 p5 = Point.ByCoordinates(x5, y5, z5);
 p6 = Point.ByCoordinates(x6, y6, z6);
 p7 = Point.ByCoordinates(x7, y7, z7);
 p8 = Point.ByCoordinates(x8, y8, z8);

 poly = Polygon.ByPoints({p1, p2, p3, p4, p5, p6, p7, p8});

 curve = PolyCurve.ByPoints({p1, p2, p3, p4, p5, p6, p7, p8}, true);

 return = curve;

};
# ----------------------------------------
p = Input(p:Point)  # Location point
b1 = Input(b1:double)  # Length of Juansha
b2 = Input(b2:double)  # Length of orthers
m = Input(m:int)  # Number of Juansha
h1 = Input(h1:double)  # Height of Juansha
h = Input(h:double)  # height of all
direction = Input(direction:string)  # direction
code_block_2 = CodeBlock(p=p, b1=b1, b2=b2, m=m, h1=h1, h=h, direction=direction) { createJuanshaCurve(p, b1, b2, m, h1, h, direction); }
PolyCurve = Output(code_block_2)
