# Dynamo custom node createQuad.dyf (Dynamo 0.9.1.4062)
# category: Geometry.Polygon
# 创建四边形面
# p->面的中心点
# r->面的边长
# z->面的位置z值

code_block = CodeBlock()
# ---------- code_block.designscript (46 lines) ----------
//创建四边形面
//p->面的中心点
//r->面的边长
//z->面的位置z值
def createQuadCenter(p, r)
{
 // .p1----.p2
 // |  |
 // | p |
 // |  |
 // |  |
 // .p4----.p3
 x1 = p.X - r;
 y1 = p.Y - r;
 z1 = p.Z;

 //test=p.X;

 x2 = p.X + r;
 y2 = p.Y - r;
 z2 = p.Z;

 x3 = p.X + r;
 y3 = p.Y + r;
 z3 = p.Z;

 x4 = p.X - r;
 y4 = p.Y + r;
 z4 = p.Z;

 p1 = Point.ByCoordinates(x1, y1, z1);
 p2 = Point.ByCoordinates(x2, y2, z2);
 p3 = Point.ByCoordinates(x3, y3, z3);
 p4 = Point.ByCoordinates(x4, y4, z4);

 poly = Polygon.ByPoints({p1, p2, p3, p4});

 //l1 = List.FirstItem(p1);
 //l1 = List.AddItemToEnd(p2);
 //l1 = List.AddItemToEnd(p3);
 //l1 = List.AddItemToEnd(p4);

 //sur = Surface.ByPatch(ploy);

 return = poly;
};
# ----------------------------------------
p = Input(p:Point)  # center of quad
radius = Input(radius:double)  # radius of quad
code_block_2 = CodeBlock(p=p, r=radius) { createQuadCenter(p, r); }
Polygon = Output(code_block_2)
