# Dynamo custom node createSecondTiao.dyf (Dynamo 0.9.1.4062)
# category: Geometry.Solid
# 创建第二跳

# group: Inputs
JSC_D1_1 = Input(JSC_D1_1 : Surface)  # Juansha Curve direction 1
b2_01 = Input(b2_01 : double = 40.0)  # b2 of LuDou
b1_04 = Input(b1_04 : double = 46.0)  # b1 of SanDou
JSC_D2_1 = Input(JSC_D2_1 : Surface)  # Juansha Curve direction 2
JSC_D3_1 = Input(JSC_D3_1 : Surface)  # Juansha Curve direction 3
b_04 = Input(b_04 : double = 70.0)  # b of SanDou/JiaohuDou
h1_04 = Input(h1_04 : double = 17.0)  # h1 of SanDou/JiaohuDou
h_04 = Input(h_04 : double = 45.0)  # h of SanDou/JiaohuDou
h2_04 = Input(h2_04 : double = 18.0)  # h2 of SanDou
b2_04 = Input(b2_04 : double = 40.0)  # b2 of SanDou/JiaohuDou
h2_05 = Input(h2_05 :double = 0.0)  # h2 of JiaohuDou
h_06 = Input(h_06 : double = 64.0)  # h of NidaolingGong
b1_06 = Input(b1_06 : double = 60.0)  # b1 of NidaolingGong
b_06 = Input(b_06 : double = 468.0)  # b of NidaolingGong
b_01 = Input(b_01 : double = 120.0)  # b of LuDou
m = Input(m : int = 4)  # Number of Juansha
h1_06 = Input(h1_06 : double = 32.0)  # h1 of NidaolingGong
b2_08 = Input(b2_08 : double = 90)  # b2 of HuaGong

number = DoubleInput(1)
number_2 = DoubleInput(0)
pointAtParameter = Surface.PointAtParameter(surface=JSC_D1_1, u=number, v=number_2)
x_draft = CodeBlock(b=b2_01) { b / 2; }
y_draft = CodeBlock(b=b1_04) { b / 2; }
translate = Geometry.Translate(geometry=pointAtParameter, xTranslation=x_draft, yTranslation=y_draft)
code_block = CodeBlock(b1=b1_04) { b1 / 2; }
createQuad = Custom[createQuad](p=translate, radius=code_block)  # 创建四边形面 p->面的中心点 r->面的边长 z->面的位置z值
byPatch = Surface.ByPatch(createQuad)
number_3 = DoubleInput(0)
number_4 = DoubleInput(1)
pointAtParameter_2 = Surface.PointAtParameter(surface=JSC_D2_1, u=number_3, v=number_4)
x_draft_2 = CodeBlock(b=b2_01) { b / 2; }
y_draft_2 = CodeBlock(b=b1_04) { b / 2; }
code_block_2 = CodeBlock(y=y_draft_2) { -y; }
translate_2 = Geometry.Translate(geometry=pointAtParameter_2, xTranslation=x_draft_2, yTranslation=code_block_2)
code_block_3 = CodeBlock(b1=b1_04) { b1 / 2; }
createQuad_2 = Custom[createQuad](p=translate_2, radius=code_block_3)
byPatch_2 = Surface.ByPatch(createQuad_2)
number_5 = DoubleInput(0)
number_6 = DoubleInput(1)
pointAtParameter_3 = Surface.PointAtParameter(surface=JSC_D3_1, u=number_5, v=number_6)
x_draft_3 = CodeBlock(b=b1_04) { b / 2; }
code_block_4 = CodeBlock(x=x_draft_3) { -x; }
y_draft_3 = CodeBlock(b=b2_01) { b / 2; }
translate_3 = Geometry.Translate(geometry=pointAtParameter_3, xTranslation=code_block_4, yTranslation=y_draft_3)
code_block_5 = CodeBlock(b1=b1_04) { b1 / 2; }
createQuad_3 = Custom[createQuad](p=translate_3, radius=code_block_5)
byPatch_3 = Surface.ByPatch(createQuad_3)
number_7 = DoubleInput(0.5)
number_8 = DoubleInput(0)
pointAtParameter_4 = Surface.PointAtParameter(surface=byPatch, u=number_7, v=number_8)
code_block_6 = CodeBlock(b=b_04, b1=b1_04) { (b - b1) / 2; }
string = StringInput("y-")
code_block_7 = CodeBlock(center=pointAtParameter_4, d1=b1_04, d2=b_04, h=h1_04, d=code_block_6, direction=string) { createTrape(center, d1, d2, h, d, direction); }
byPatch_4 = Surface.ByPatch(code_block_7)
number_9 = DoubleInput(0.5)
number_10 = DoubleInput(1)
pointAtParameter_5 = Surface.PointAtParameter(surface=byPatch, u=number_9, v=number_10)
string_2 = StringInput("y+")
code_block_8 = CodeBlock(center=pointAtParameter_5, d1=b1_04, d2=b_04, h=h1_04, dy=code_block_6, direction=string_2) { createTrape(center, d1, d2, h ,dy, direction); }
byPatch_5 = Surface.ByPatch(code_block_8)
number_11 = DoubleInput(1)
number_12 = DoubleInput(0.5)
pointAtParameter_6 = Surface.PointAtParameter(surface=byPatch, u=number_11, v=number_12)
string_3 = StringInput("x+")
code_block_9 = CodeBlock(center=pointAtParameter_6, d1=b1_04, d2=b_04, h=h1_04, dy=code_block_6, direction=string_3) { createTrape(center, d1, d2, h ,dy, direction); }
byPatch_6 = Surface.ByPatch(code_block_9)
number_13 = DoubleInput(0)
number_14 = DoubleInput(0.5)
pointAtParameter_7 = Surface.PointAtParameter(surface=byPatch, u=number_13, v=number_14)
string_4 = StringInput("x-")
code_block_10 = CodeBlock(center=pointAtParameter_7, d1=b1_04, d2=b_04, h=h1_04, dy=code_block_6, direction=string_4) { createTrape(center, d1, d2, h ,dy, direction); }
byPatch_7 = Surface.ByPatch(code_block_10)
code_block_11 = CodeBlock(h=h_04, h1=h1_04) { h - h1; }
string_5 = StringInput("x")
number_15 = DoubleInput(0.5)
number_16 = DoubleInput(0)
pointAtParameter_8 = Surface.PointAtParameter(surface=byPatch_4, u=number_15, v=number_16)
createUPlane = Custom[createUPlane](w=b_04, h1=code_block_11, h2=h2_04, direction=string_5, p=pointAtParameter_8, w1=b2_04)  # 创建枓U型侧面 p->底边中心定位点 w->长边长 w1->顶部短边长 h1->高（h - h1) h2->中间U型部分高 direc->绘制方向
byPatch_8 = Surface.ByPatch(createUPlane)
number_17 = DoubleInput(0.5)
number_18 = DoubleInput(1)
pointAtParameter_9 = Surface.PointAtParameter(surface=byPatch_5, u=number_17, v=number_18)
createUPlane_2 = Custom[createUPlane](w=b_04, h1=code_block_11, h2=h2_04, direction=string_5, p=pointAtParameter_9, w1=b2_04)
byPatch_9 = Surface.ByPatch(createUPlane_2)
string_6 = StringInput("y")
number_19 = DoubleInput(0)
number_20 = DoubleInput(0.5)
pointAtParameter_10 = Surface.PointAtParameter(surface=byPatch_6, u=number_19, v=number_20)
createUPlane_3 = Custom[createUPlane](w=b_04, h1=code_block_11, h2=h2_05, direction=string_6, p=pointAtParameter_10, w1=b2_04)
byPatch_10 = Surface.ByPatch(createUPlane_3)
number_21 = DoubleInput(0)
number_22 = DoubleInput(0.5)
pointAtParameter_11 = Surface.PointAtParameter(surface=byPatch_7, u=number_21, v=number_22)
createUPlane_4 = Custom[createUPlane](w=b_04, h1=code_block_11, h2=h2_05, direction=string_6, p=pointAtParameter_11, w1=b2_04)
byPatch_11 = Surface.ByPatch(createUPlane_4)
number_23 = DoubleInput(0.5)
number_24 = DoubleInput(0)
pointAtParameter_12 = Surface.PointAtParameter(surface=byPatch_2, u=number_23, v=number_24)
code_block_12 = CodeBlock(b=b_04, b1=b1_04) { (b - b1) / 2; }
string_7 = StringInput("y-")
code_block_13 = CodeBlock(center=pointAtParameter_12, d1=b1_04, d2=b_04, h=h1_04, d=code_block_12, direction=string_7) { createTrape(center, d1, d2, h, d, direction); }
byPatch_12 = Surface.ByPatch(code_block_13)
number_25 = DoubleInput(0.5)
number_26 = DoubleInput(1)
pointAtParameter_13 = Surface.PointAtParameter(surface=byPatch_2, u=number_25, v=number_26)
string_8 = StringInput("y+")
code_block_14 = CodeBlock(center=pointAtParameter_13, d1=b1_04, d2=b_04, h=h1_04, dy=code_block_12, direction=string_8) { createTrape(center, d1, d2, h ,dy, direction); }
byPatch_13 = Surface.ByPatch(code_block_14)
code_block_15 = CodeBlock(h=h_04, h1=h1_04) { h - h1; }
string_9 = StringInput("x")
number_27 = DoubleInput(0.5)
number_28 = DoubleInput(0)
pointAtParameter_14 = Surface.PointAtParameter(surface=byPatch_12, u=number_27, v=number_28)
createUPlane_5 = Custom[createUPlane](w=b_04, h1=code_block_15, h2=h2_04, direction=string_9, p=pointAtParameter_14, w1=b2_04)
byPatch_14 = Surface.ByPatch(createUPlane_5)
number_29 = DoubleInput(0.5)
number_30 = DoubleInput(1)
pointAtParameter_15 = Surface.PointAtParameter(surface=byPatch_13, u=number_29, v=number_30)
createUPlane_6 = Custom[createUPlane](w=b_04, h1=code_block_15, h2=h2_04, direction=string_9, p=pointAtParameter_15, w1=b2_04)
byPatch_15 = Surface.ByPatch(createUPlane_6)
number_31 = DoubleInput(1)
number_32 = DoubleInput(0.5)
pointAtParameter_16 = Surface.PointAtParameter(surface=byPatch_2, u=number_31, v=number_32)
string_10 = StringInput("x+")
code_block_16 = CodeBlock(center=pointAtParameter_16, d1=b1_04, d2=b_04, h=h1_04, dy=code_block_12, direction=string_10) { createTrape(center, d1, d2, h ,dy, direction); }
byPatch_16 = Surface.ByPatch(code_block_16)
number_33 = DoubleInput(0)
number_34 = DoubleInput(0.5)
pointAtParameter_17 = Surface.PointAtParameter(surface=byPatch_2, u=number_33, v=number_34)
string_11 = StringInput("x-")
code_block_17 = CodeBlock(center=pointAtParameter_17, d1=b1_04, d2=b_04, h=h1_04, dy=code_block_12, direction=string_11) { createTrape(center, d1, d2, h ,dy, direction); }
byPatch_17 = Surface.ByPatch(code_block_17)
string_12 = StringInput("y")
number_35 = DoubleInput(0)
number_36 = DoubleInput(0.5)
pointAtParameter_18 = Surface.PointAtParameter(surface=byPatch_16, u=number_35, v=number_36)
createUPlane_7 = Custom[createUPlane](w=b_04, h1=code_block_15, h2=h2_05, direction=string_12, p=pointAtParameter_18, w1=b2_04)
byPatch_18 = Surface.ByPatch(createUPlane_7)
number_37 = DoubleInput(0)
number_38 = DoubleInput(0.5)
pointAtParameter_19 = Surface.PointAtParameter(surface=byPatch_17, u=number_37, v=number_38)
createUPlane_8 = Custom[createUPlane](w=b_04, h1=code_block_15, h2=h2_05, direction=string_12, p=pointAtParameter_19, w1=b2_04)
byPatch_19 = Surface.ByPatch(createUPlane_8)
number_39 = DoubleInput(0.5)
number_40 = DoubleInput(0)
pointAtParameter_20 = Surface.PointAtParameter(surface=byPatch_3, u=number_39, v=number_40)
code_block_18 = CodeBlock(b=b_04, b1=b1_04) { (b - b1) / 2; }
string_13 = StringInput("y-")
code_block_19 = CodeBlock(center=pointAtParameter_20, d1=b1_04, d2=b_04, h=h1_04, d=code_block_18, direction=string_13) { createTrape(center, d1, d2, h, d, direction); }
byPatch_20 = Surface.ByPatch(code_block_19)
number_41 = DoubleInput(0.5)
number_42 = DoubleInput(1)
pointAtParameter_21 = Surface.PointAtParameter(surface=byPatch_3, u=number_41, v=number_42)
string_14 = StringInput("y+")
code_block_20 = CodeBlock(center=pointAtParameter_21, d1=b1_04, d2=b_04, h=h1_04, dy=code_block_18, direction=string_14) { createTrape(center, d1, d2, h ,dy, direction); }
byPatch_21 = Surface.ByPatch(code_block_20)
code_block_21 = CodeBlock(h=h_04, h1=h1_04) { h - h1; }
string_15 = StringInput("x")
number_43 = DoubleInput(0.5)
number_44 = DoubleInput(0)
pointAtParameter_22 = Surface.PointAtParameter(surface=byPatch_20, u=number_43, v=number_44)
createUPlane_9 = Custom[createUPlane](w=b_04, h1=code_block_21, h2=h2_04, direction=string_15, p=pointAtParameter_22, w1=b2_04)
byPatch_22 = Surface.ByPatch(createUPlane_9)
number_45 = DoubleInput(0.5)
number_46 = DoubleInput(1)
pointAtParameter_23 = Surface.PointAtParameter(surface=byPatch_21, u=number_45, v=number_46)
createUPlane_10 = Custom[createUPlane](w=b_04, h1=code_block_21, h2=h2_04, direction=string_15, p=pointAtParameter_23, w1=b2_04)
byPatch_23 = Surface.ByPatch(createUPlane_10)
number_47 = DoubleInput(1)
number_48 = DoubleInput(0.5)
pointAtParameter_24 = Surface.PointAtParameter(surface=byPatch_3, u=number_47, v=number_48)
string_16 = StringInput("x+")
code_block_22 = CodeBlock(center=pointAtParameter_24, d1=b1_04, d2=b_04, h=h1_04, dy=code_block_18, direction=string_16) { createTrape(center, d1, d2, h ,dy, direction); }
byPatch_24 = Surface.ByPatch(code_block_22)
number_49 = DoubleInput(0)
number_50 = DoubleInput(0.5)
pointAtParameter_25 = Surface.PointAtParameter(surface=byPatch_3, u=number_49, v=number_50)
string_17 = StringInput("x-")
code_block_23 = CodeBlock(center=pointAtParameter_25, d1=b1_04, d2=b_04, h=h1_04, dy=code_block_18, direction=string_17) { createTrape(center, d1, d2, h ,dy, direction); }
byPatch_25 = Surface.ByPatch(code_block_23)
string_18 = StringInput("y")
number_51 = DoubleInput(0)
number_52 = DoubleInput(0.5)
pointAtParameter_26 = Surface.PointAtParameter(surface=byPatch_24, u=number_51, v=number_52)
createUPlane_11 = Custom[createUPlane](w=b_04, h1=code_block_21, h2=h2_05, direction=string_18, p=pointAtParameter_26, w1=b2_04)
byPatch_26 = Surface.ByPatch(createUPlane_11)
number_53 = DoubleInput(0)
number_54 = DoubleInput(0.5)
pointAtParameter_27 = Surface.PointAtParameter(surface=byPatch_25, u=number_53, v=number_54)
createUPlane_12 = Custom[createUPlane](w=b_04, h1=code_block_21, h2=h2_05, direction=string_18, p=pointAtParameter_27, w1=b2_04)
byPatch_27 = Surface.ByPatch(createUPlane_12)
code_block_24 = CodeBlock(h2=h2_04, h1=code_block_15) { h2 / h1; }
code_block_25 = CodeBlock(b=b_04, b2=b2_04) { ((b - b2) / 2) + b2; }
code_block_26 = CodeBlock(w1=code_block_25, w=b_04) { w1 / w; }
pointAtParameter_28 = Surface.PointAtParameter(surface=byPatch_8, u=code_block_24, v=code_block_26)
code_block_27 = CodeBlock(b=b_06, b1=b1_06, b_01=b_01, d_04=code_block_6) { ((b - 2 * b1) - b_01 - 2 * d_04) / 2; }
string_19 = StringInput("y-")
createJuanshaCurve = Custom[createJuanshaCurve](h=h_06, p=pointAtParameter_28, b1=b1_06, b2=code_block_27, m=m, h1=h1_06, direction=string_19)  # 创建卷杀曲线 p->定位点 b1->卷杀部分长 b2->其余部分长 m->卷杀段数 h1->卷杀部分高 h->整体高 direc->方向
byPatch_28 = Surface.ByPatch(createJuanshaCurve)
code_block_28 = CodeBlock(w1=code_block_25, w=b_04) { 1 - w1 / w; }
pointAtParameter_29 = Surface.PointAtParameter(surface=byPatch_8, u=code_block_24, v=code_block_28)
createJuanshaCurve_2 = Custom[createJuanshaCurve](h=h_06, p=pointAtParameter_29, b1=b1_06, b2=code_block_27, m=m, h1=h1_06, direction=string_19)
byPatch_29 = Surface.ByPatch(createJuanshaCurve_2)
join = List.Join(createJuanshaCurve, createJuanshaCurve_2)
byLoft = PolySurface.ByLoft(join)
pointAtParameter_30 = Surface.PointAtParameter(surface=byPatch_15, u=code_block_24, v=code_block_26)
string_20 = StringInput("y+")
createJuanshaCurve_3 = Custom[createJuanshaCurve](h=h_06, p=pointAtParameter_30, b1=b1_06, b2=code_block_27, m=m, h1=h1_06, direction=string_20)
byPatch_30 = Surface.ByPatch(createJuanshaCurve_3)
pointAtParameter_31 = Surface.PointAtParameter(surface=byPatch_15, u=code_block_24, v=code_block_28)
createJuanshaCurve_4 = Custom[createJuanshaCurve](h=h_06, p=pointAtParameter_31, b1=b1_06, b2=code_block_27, m=m, h1=h1_06, direction=string_20)
byPatch_31 = Surface.ByPatch(createJuanshaCurve_4)
join_2 = List.Join(createJuanshaCurve_3, createJuanshaCurve_4)
byLoft_2 = PolySurface.ByLoft(join_2)
pointAtParameter_32 = Surface.PointAtParameter(surface=byPatch_22, u=code_block_24, v=code_block_26)
string_21 = StringInput("y-")
createJuanshaCurve_5 = Custom[createJuanshaCurve](h=h_06, p=pointAtParameter_32, b1=b1_06, b2=code_block_27, m=m, h1=h1_06, direction=string_21)
byPatch_32 = Surface.ByPatch(createJuanshaCurve_5)
pointAtParameter_33 = Surface.PointAtParameter(surface=byPatch_22, u=code_block_24, v=code_block_28)
createJuanshaCurve_6 = Custom[createJuanshaCurve](h=h_06, p=pointAtParameter_33, b1=b1_06, b2=code_block_27, m=m, h1=h1_06, direction=string_21)
byPatch_33 = Surface.ByPatch(createJuanshaCurve_6)
join_3 = List.Join(createJuanshaCurve_5, createJuanshaCurve_6)
byLoft_3 = PolySurface.ByLoft(join_3)
pointAtParameter_34 = Surface.PointAtParameter(surface=byPatch_23, u=code_block_24, v=code_block_26)
string_22 = StringInput("y+")
createJuanshaCurve_7 = Custom[createJuanshaCurve](h=h_06, p=pointAtParameter_34, b1=b1_06, b2=code_block_27, m=m, h1=h1_06, direction=string_22)
byPatch_34 = Surface.ByPatch(createJuanshaCurve_7)
pointAtParameter_35 = Surface.PointAtParameter(surface=byPatch_23, u=code_block_24, v=code_block_28)
createJuanshaCurve_8 = Custom[createJuanshaCurve](h=h_06, p=pointAtParameter_35, b1=b1_06, b2=code_block_27, m=m, h1=h1_06, direction=string_22)
byPatch_35 = Surface.ByPatch(createJuanshaCurve_8)
join_4 = List.Join(createJuanshaCurve_7, createJuanshaCurve_8)
byLoft_4 = PolySurface.ByLoft(join_4)
pointAtParameter_36 = Surface.PointAtParameter(surface=byPatch_26, u=code_block_24, v=code_block_26)
code_block_29 = CodeBlock(b2=b2_08, b1=b1_06, b_04=b_04, w1_04=code_block_25) { b2 - b1 - (b_04 - w1_04); }
string_23 = StringInput("x+")
createJuanshaCurve_9 = Custom[createJuanshaCurve](h=h_06, p=pointAtParameter_36, b1=b1_06, b2=code_block_29, m=m, h1=h1_06, direction=string_23)
byPatch_36 = Surface.ByPatch(createJuanshaCurve_9)
pointAtParameter_37 = Surface.PointAtParameter(surface=byPatch_26, u=code_block_24, v=code_block_28)
createJuanshaCurve_10 = Custom[createJuanshaCurve](h=h_06, p=pointAtParameter_37, b1=b1_06, b2=code_block_29, m=m, h1=h1_06, direction=string_23)
byPatch_37 = Surface.ByPatch(createJuanshaCurve_10)
join_5 = List.Join(createJuanshaCurve_9, createJuanshaCurve_10)
byLoft_5 = PolySurface.ByLoft(join_5)
surfaces = PolySurface.Surfaces(byLoft)
number_55 = DoubleInput(7)
getItemAtIndex = List.GetItemAtIndex(list=surfaces, index=number_55)
perimeterCurves = Surface.PerimeterCurves(getItemAtIndex)
byJoinedCurves = PolyCurve.ByJoinedCurves(perimeterCurves)
surfaces_2 = PolySurface.Surfaces(byLoft_2)
number_56 = DoubleInput(7)
getItemAtIndex_2 = List.GetItemAtIndex(list=surfaces_2, index=number_56)
perimeterCurves_2 = Surface.PerimeterCurves(getItemAtIndex_2)
byJoinedCurves_2 = PolyCurve.ByJoinedCurves(perimeterCurves_2)
join_6 = List.Join(byJoinedCurves, byJoinedCurves_2)
byLoft_6 = PolySurface.ByLoft(join_6)
surfaces_3 = PolySurface.Surfaces(byLoft_5)
number_57 = DoubleInput(7)
getItemAtIndex_3 = List.GetItemAtIndex(list=surfaces_3, index=number_57)
perimeterCurves_3 = Surface.PerimeterCurves(getItemAtIndex_3)
byJoinedCurves_3 = PolyCurve.ByJoinedCurves(perimeterCurves_3)
number_58 = DoubleInput(0)
getItemAtIndex_4 = List.GetItemAtIndex(list=perimeterCurves_3, index=number_58)
n08_b = DoubleInput(396)  # "08-b"
code_block_30 = CodeBlock(b=n08_b, b1=b1_06, d=code_block_29) { b - b1 - d; }
string_24 = StringInput("x-")
createCubiod = Custom[createCubiod](cur=getItemAtIndex_4, width=code_block_30, direction=string_24)  # 创建单卷杀长方体栱部分， cur->边界曲线 width->长方体长度 direction->延伸方向
number_59 = DoubleInput(1)
getItemAtIndex_5 = List.GetItemAtIndex(list=perimeterCurves_3, index=number_59)
createCubiod_2 = Custom[createCubiod](cur=getItemAtIndex_5, width=code_block_30, direction=string_24)
number_60 = DoubleInput(2)
getItemAtIndex_6 = List.GetItemAtIndex(list=perimeterCurves_3, index=number_60)
createCubiod_3 = Custom[createCubiod](cur=getItemAtIndex_6, width=code_block_30, direction=string_24)
number_61 = DoubleInput(3)
getItemAtIndex_7 = List.GetItemAtIndex(list=perimeterCurves_3, index=number_61)
createCubiod_4 = Custom[createCubiod](cur=getItemAtIndex_7, width=code_block_30, direction=string_24)
join_7 = List.Join(createCubiod, createCubiod_2, createCubiod_3, createCubiod_4)
byJoinedCurves_4 = PolyCurve.ByJoinedCurves(join_7)
join_8 = List.Join(byJoinedCurves_3, byJoinedCurves_4)
byLoft_7 = Solid.ByLoft(join_8)

# group: Outputs
SD1_Q = Output(byPatch)
Quad_of_SanDou_2 = Output(byPatch_2)
Quad_of_JiaohuDou_1 = Output(byPatch_3)
SD1_T1 = Output(byPatch_4)
SD1_T2 = Output(byPatch_5)
SD1_T3 = Output(byPatch_6)
SD1_T4 = Output(byPatch_7)
SD1_U1 = Output(byPatch_8)
SD1_U2 = Output(byPatch_9)
SD1_U3 = Output(byPatch_10)
SD1_U4 = Output(byPatch_11)
SD2_T1 = Output(byPatch_12)
SD2_T2 = Output(byPatch_13)
SD2_U1 = Output(byPatch_14)
SD2_U2 = Output(byPatch_15)
SD2_T3 = Output(byPatch_16)
SD2_t4 = Output(byPatch_17)
SD2_U3 = Output(byPatch_18)
SD2_U4 = Output(byPatch_19)
JHD1_T1 = Output(byPatch_20)
JHD1_T2 = Output(byPatch_21)
JHD1_U1 = Output(byPatch_22)
JHD1_U2 = Output(byPatch_23)
JHD1_T3 = Output(byPatch_24)
JHD1_T4 = Output(byPatch_25)
JHD1_U3 = Output(byPatch_26)
JHD1_U3_2 = Output(byPatch_27)  # "JHD1_U3"
JS1_C1 = Output(byPatch_28)
JS1_C2 = Output(byPatch_29)
JS1_S = Output(byLoft)
JS2_C1 = Output(byPatch_30)
JS1_C2_2 = Output(byPatch_31)  # "JS1_C2"
JS2_S = Output(byLoft_2)
JS3_C1 = Output(byPatch_32)
JS3_C2 = Output(byPatch_33)
JS3_S = Output(byLoft_3)
JS4_C1 = Output(byPatch_34)
JS4_C2 = Output(byPatch_35)
JS4_S = Output(byLoft_4)
JS5_C1 = Output(byPatch_36)
JS5_C2 = Output(byPatch_37)
JS5_S = Output(byLoft_5)
MidCuboid = Output(byLoft_6)
CuboidOfHG = Output(byLoft_7)
