# Dynamo custom node createTrape.dyf (Dynamo 0.9.1.4062)
# category: Geometry.Polygon
# 创建梯形平面
# p->短边中心点
# d1->短边边长
# d2->长边边长
# h->高
# d->倾斜进深
# direc->倾斜方向

code_block = CodeBlock()
# ---------- code_block.designscript (112 lines) ----------
//创建梯形平面
//p->短边中心点
//d1->短边边长
//d2->长边边长
//h->高
//d->倾斜进深
//direc->倾斜方向
def createTrape(p, d1, d2, h, d, direc)
{

 x1 = 0;
 x2 = 0;
 x3 = 0;
 x4 = 0;
 y1 = 0;
 y2 = 0;
 y3 = 0;
 y4 = 0;
 z1 = 0;
 z2 = 0;
 z3 = 0;
 z4 = 0;
 geometry = [Imperative]
 {
  if(direc == "y-")
  {
   x1 = p.X - d1 / 2;
   y1 = p.Y;
   z1 = p.Z;

   x2 = p.X + d1 / 2;
   y2 = p.Y;
   z2 = p.Z;

   x3 = p.X + d2 / 2;
   y3 = p.Y - d;
   z3 = p.Z + h;

   x4 = p.X - d2 / 2;
   y4 = p.Y - d;
   z4 = p.Z + h;
  }

  if(direc == "y+")
  {
   x1 = p.X - d1 / 2;
   y1 = p.Y;
   z1 = p.Z;

   x2 = p.X + d1 / 2;
   y2 = p.Y;
   z2 = p.Z;

   x3 = p.X + d2 / 2;
   y3 = p.Y + d;
   z3 = p.Z + h;

   x4 = p.X - d2 / 2;
   y4 = p.Y + d;
   z4 = p.Z + h;
  }

  if(direc == "x-")
  {
   x1 = p.X;
   y1 = p.Y - d1 / 2;
   z1 = p.Z;

   x2 = p.X;
   y2 = p.Y+ d1 / 2;
   z2 = p.Z;

   x3 = p.X - d;
   y3 = p.Y + d2 / 2;
   z3 = p.Z + h;

   x4 = p.X - d;
   y4 = p.Y - d2 / 2;
   z4 = p.Z + h;
  }

  if(direc == "x+")
  {
   x1 = p.X;
   y1 = p.Y- d1 / 2;
   z1 = p.Z;

   x2 = p.X;
   y2 = p.Y+ d1 / 2;
   z2 = p.Z;

   x3 = p.X + d;
   y3 = p.Y + d2 / 2;
   z3 = p.Z + h;

   x4 = p.X + d;
   y4 = p.Y - d2 / 2;
   z4 = p.Z + h;
  }

 }

 p1 = Point.ByCoordinates(x1, y1, z1);
 p2 = Point.ByCoordinates(x2, y2, z2);
 p3 = Point.ByCoordinates(x3, y3, z3);
 p4 = Point.ByCoordinates(x4, y4, z4);

 poly = Polygon.ByPoints({p1, p2, p3, p4});

 return = poly;

};
# ----------------------------------------
p = Input(p:Point)  # Center point of short length of trape
d1 = Input(d1:double)  # Short length
d2 = Input(d2:double)  # Long length
h = Input(h:double)  # Height
d = Input(d:double)  # Tilting depth
direction = Input(direction:string)  # Tilting direction
code_block_2 = CodeBlock(p=p, d1=d1, d2=d2, h=h, d=d, direction=direction) { createTrape(p, d1, d2, h, d, direction); }
Polygon = Output(code_block_2)
