# Dynamo custom node createUPlane.dyf (Dynamo 0.9.1.4062)
# category: Geometry.Polygon
# 创建枓U型侧面
# p->底边中心定位点
# w->长边长
# w1->顶部短边长
# h1->高（h - h1)
# h2->中间U型部分高
# direc->绘制方向

code_block = CodeBlock()
# ---------- code_block.designscript (122 lines) ----------
//创建栌枓U型侧面
//p->底边中心定位点
//w->长边长
//w1->顶部短边长
//h1->高（h - h1)
//h2->中间U型部分高
//direc->绘制方向
def createUPlane(p, w, w1, h1, h2, direc)
{
 x1 =0;
 y1 =0;
 z1 =0;
 x2 =0;
 y2 =0;
 z2 =0;
 x3 =0;
 y3 =0;
 z3 =0;
 x4 =0;
 y4 =0;
 z4 =0;
 x5 =0;
 y5 =0;
 z5 =0;
 x6 =0;
 y6 =0;
 z6 =0;
 x7 =0;
 y7 =0;
 z7 =0;
 x8 =0;
 y8 =0;
 z8 =0;

 geometry = [Imperative]
 {

  if(direc == "x")
  {
   x1 = p.X - w / 2;
   y1 = p.Y;
   z1 = p.Z;

   x2 = p.X + w / 2;
   y2 = p.Y;
   z2 = p.Z;

   x3 = p.X + w / 2;
   y3 = p.Y;
   z3 = p.Z + h1;

   x4 = p.X + w1 / 2;
   y4 = p.Y;
   z4 = p.Z + h1;

   x5 = p.X + w1 / 2;
   y5 = p.Y;
   z5 = p.Z + h1 - h2;

   x6 = p.X - w1 / 2;
   y6 = p.Y;
   z6 = p.Z + h1 - h2;

   x7 = p.X - w1 / 2;
   y7 = p.Y;
   z7 = p.Z + h1;

   x8 = p.X - w / 2;
   y8 = p.Y;
   z8 = p.Z + h1;
  }

  if(direc == "y")
  {
   x1 = p.X;
   y1 = p.Y - w / 2;
   z1 = p.Z;

   x2 = p.X;
   y2 = p.Y + w / 2;
   z2 = p.Z;

   x3 = p.X;
   y3 = p.Y + w / 2;
   z3 = p.Z + h1;

   x4 = p.X;
   y4 = p.Y + w1 / 2;
   z4 = p.Z + h1;

   x5 = p.X;
   y5 = p.Y + w1 / 2;
   z5 = p.Z + h1 - h2;

   x6 = p.X;
   y6 = p.Y - w1 / 2;
   z6 = p.Z + h1 - h2;

   x7 = p.X;
   y7 = p.Y - w1 / 2;
   z7 = p.Z + h1;

   x8 = p.X;
   y8 = p.Y - w / 2;
   z8 = p.Z + h1;
  }

 }

 p1 = Point.ByCoordinates(x1, y1, z1);
 p2 = Point.ByCoordinates(x2, y2, z2);
 p3 = Point.ByCoordinates(x3, y3, z3);
 p4 = Point.ByCoordinates(x4, y4, z4);
 p5 = Point.ByCoordinates(x5, y5, z5);
 p6 = Point.ByCoordinates(x6, y6, z6);
 p7 = Point.ByCoordinates(x7, y7, z7);
 p8 = Point.ByCoordinates(x8, y8, z8);

 poly = Polygon.ByPoints({p1, p2, p3, p4, p5, p6, p7, p8});

 return = poly;
};
# ----------------------------------------
p = Input(p:Point)  # Center point of bootom
w = Input(w:double)  # long length
w1 = Input(w1:double)  # Top middle short length
h1 = Input(h1:double)  # height(h - h1)
h2 = Input(h2:double)  # height of middle U-shaped
direction = Input(direction:string)  # direction of creation
code_block_2 = CodeBlock(p=p, w=w, w1=w1, h1=h1, h2=h2, direction=direction) { createUPlane(p ,w, w1, h1, h2, direction); }
Polygon = Output(code_block_2)
