# Dynamo graph draw.dyn (Dynamo 0.9.1.4062)

# group: 创建最底面
code_block = CodeBlock()
# ---------- code_block.designscript (46 lines) ----------
//创建四边形面
//p->面的中心点
//r->面的边长
//z->面的位置z值
def createQuadCenter(p, r)
{
 // .p1----.p2
 // |  |
 // | p |
 // |  |
 // |  |
 // .p4----.p3
 x1 = p.X - r;
 y1 = p.Y - r;
 z1 = p.Z;

 //test=p.X;

 x2 = p.X + r;
 y2 = p.Y - r;
 z2 = p.Z;

 x3 = p.X + r;
 y3 = p.Y + r;
 z3 = p.Z;

 x4 = p.X - r;
 y4 = p.Y + r;
 z4 = p.Z;

 p1 = Point.ByCoordinates(x1, y1, z1);
 p2 = Point.ByCoordinates(x2, y2, z2);
 p3 = Point.ByCoordinates(x3, y3, z3);
 p4 = Point.ByCoordinates(x4, y4, z4);

 poly = Polygon.ByPoints({p1, p2, p3, p4});

 //l1 = List.FirstItem(p1);
 //l1 = List.AddItemToEnd(p2);
 //l1 = List.AddItemToEnd(p3);
 //l1 = List.AddItemToEnd(p4);

 //sur = Surface.ByPatch(ploy);

 return = poly;
};
# ----------------------------------------
number = DoubleInput(0)
number_2 = DoubleInput(0)
number_3 = DoubleInput(0)
byCoordinates = Point.ByCoordinates(x=number, y=number_2, z=number_3)
n01_b1 = DoubleInput(100)  # "01-b1"
code_block_2 = CodeBlock(b1=n01_b1) { b1 / 2; }
code_block_3 = CodeBlock(p=byCoordinates, r=code_block_2) { createQuadCenter(p, r); }
byPatch = Surface.ByPatch(code_block_3)

# group: 创建镜像平面（备用）
number_4 = DoubleInput(0.5)
number_5 = DoubleInput(0.5)
pointAtParameter = Surface.PointAtParameter(u=number_4, v=number_5)
code_block_4 = CodeBlock()
# ---------- code_block_4.designscript (73 lines) ----------
//创建镜像平面
//p->镜像平面底边中心点
//direc->镜像方向
//r->边长
//if中的变量需要提前初始化
def createMirrorPlane(p, direc, r)
{
 x1 = 0;
 x2 = 0;
 x3 = 0;
 x4 = 0;
 y1 = 0;
 y2 = 0;
 y3 = 0;
 y4 = 0;
 z1 = 0;
 z2 = 0;
 z3 = 0;
 z4 = 0;
 geometry = [Imperative]
 {
  if(direc == "x")
  {

   x1 = p.X - r / 2;
   y1 = p.Y;
   z1 = p.Z;

   x2 = p.X + r / 2;
   y2 = p.Y;
   z2 = p.Z;

   x3 = p.X + r / 2;
   y3 = p.Y;
   z3 = p.Z + r;

   x4 = p.X - r / 2;
   y4 = p.Y;
   z4 = p.Z + r;


  }
  if(direc == "y")
  {
   x1 = p.X;
   y1 = p.Y - r / 2;
   z1 = p.Z;

   x2 = p.X;
   y2 = p.Y + r / 2;
   z2 = p.Z;

   x3 = p.X;
   y3 = p.Y + r / 2;
   z3 = p.Z + r;

   x4 = p.X;
   y4 = p.Y - r / 2;
   z4 = p.Z + r;


  }
 }

 p1 = Point.ByCoordinates(x1, y1, z1);
 p2 = Point.ByCoordinates(x2, y2, z2);
 p3 = Point.ByCoordinates(x3, y3, z3);
 p4 = Point.ByCoordinates(x4, y4, z4);

 poly = Polygon.ByPoints({p1, p2, p3, p4});

 return = poly;
};
# ----------------------------------------
string = StringInput("x")
code_block_5 = CodeBlock { r; }
code_block_6 = CodeBlock(direction=string, r=code_block_5) { createMirrorPlane(center, direction, r); }
code_block_7 = CodeBlock()
# ---------- code_block_7.designscript (34 lines) ----------
def createJuanshaPath(p, d, direc)
{

 x1 = 0;
 y1 = 0;
 z1 = 0;
 x2 = 0;
 y2 = 0;
 z2 = 0;

 geometry = [Imperative]
 {
  if(direc == "x")
  {
   x1 = p.X;
   y1 = p.Y;
   z1 = p.Z;

   x2 = p.X + d;
   y2 = p.Y;
   z2 = p.Z;

  }
 }

 p1 = Point.ByCoordinates(x1, y1, z1);
 p2 = Point.ByCoordinates(x2, y2, z2);

 poly = Polygon.ByPoints({p1, p2});

 curve = PolygonCurve.ByPoints({p1, p2}, false);

 return = poly;
};
# ----------------------------------------

watch = Watch()

# group: 创建栌枓四个倾斜梯形面
number_6 = DoubleInput(0.5)
number_7 = DoubleInput(0)
pointAtParameter_2 = Surface.PointAtParameter(surface=byPatch, u=number_6, v=number_7)
code_block_8 = CodeBlock(d1=n01_b1) { d1; }
n01_b = DoubleInput(120)  # "01-b"
n01_h1 = DoubleInput(30)  # "01-h1"
code_block_9 = CodeBlock(b=n01_b, b1=n01_b1) { (b - b1) / 2; }
string_2 = StringInput("y-")
code_block_10 = CodeBlock(center=pointAtParameter_2, d1=code_block_8, d2=n01_b, h=n01_h1, dy=code_block_9, direction=string_2) { createTrape(center, d1, d2, h ,dy, direction); }
byPatch_2 = Surface.ByPatch(code_block_10)
number_8 = DoubleInput(0.5)
number_9 = DoubleInput(1)
pointAtParameter_3 = Surface.PointAtParameter(surface=byPatch, u=number_8, v=number_9)
string_3 = StringInput("y+")
code_block_11 = CodeBlock(center=pointAtParameter_3, d1=code_block_8, d2=n01_b, h=n01_h1, dy=code_block_9, direction=string_3) { createTrape(center, d1, d2, h ,dy, direction); }
byPatch_3 = Surface.ByPatch(code_block_11)
number_10 = DoubleInput(1)
number_11 = DoubleInput(0.5)
pointAtParameter_4 = Surface.PointAtParameter(surface=byPatch, u=number_10, v=number_11)
string_4 = StringInput("x+")
code_block_12 = CodeBlock(center=pointAtParameter_4, d1=code_block_8, d2=n01_b, h=n01_h1, dy=code_block_9, direction=string_4) { createTrape(center, d1, d2, h ,dy, direction); }
byPatch_4 = Surface.ByPatch(code_block_12)
number_12 = DoubleInput(0)
number_13 = DoubleInput(0.5)
pointAtParameter_5 = Surface.PointAtParameter(surface=byPatch, u=number_12, v=number_13)
string_5 = StringInput("x-")
code_block_13 = CodeBlock(center=pointAtParameter_5, d1=code_block_8, d2=n01_b, h=n01_h1, dy=code_block_9, direction=string_5) { createTrape(center, d1, d2, h ,dy, direction); }
byPatch_5 = Surface.ByPatch(code_block_13)
code_block_14 = CodeBlock()
# ---------- code_block_14.designscript (112 lines) ----------
//创建梯形平面
//p->短边中心点
//d1->短边边长
//d2->长边边长
//h->高
//d->倾斜进深
//direc->倾斜方向
def createTrape(p, d1, d2, h, d, direc)
{

 x1 = 0;
 x2 = 0;
 x3 = 0;
 x4 = 0;
 y1 = 0;
 y2 = 0;
 y3 = 0;
 y4 = 0;
 z1 = 0;
 z2 = 0;
 z3 = 0;
 z4 = 0;
 geometry = [Imperative]
 {
  if(direc == "y-")
  {
   x1 = p.X - d1 / 2;
   y1 = p.Y;
   z1 = p.Z;

   x2 = p.X + d1 / 2;
   y2 = p.Y;
   z2 = p.Z;

   x3 = p.X + d2 / 2;
   y3 = p.Y - d;
   z3 = p.Z + h;

   x4 = p.X - d2 / 2;
   y4 = p.Y - d;
   z4 = p.Z + h;
  }

  if(direc == "y+")
  {
   x1 = p.X - d1 / 2;
   y1 = p.Y;
   z1 = p.Z;

   x2 = p.X + d1 / 2;
   y2 = p.Y;
   z2 = p.Z;

   x3 = p.X + d2 / 2;
   y3 = p.Y + d;
   z3 = p.Z + h;

   x4 = p.X - d2 / 2;
   y4 = p.Y + d;
   z4 = p.Z + h;
  }

  if(direc == "x-")
  {
   x1 = p.X;
   y1 = p.Y - d1 / 2;
   z1 = p.Z;

   x2 = p.X;
   y2 = p.Y+ d1 / 2;
   z2 = p.Z;

   x3 = p.X - d;
   y3 = p.Y + d2 / 2;
   z3 = p.Z + h;

   x4 = p.X - d;
   y4 = p.Y - d2 / 2;
   z4 = p.Z + h;
  }

  if(direc == "x+")
  {
   x1 = p.X;
   y1 = p.Y- d1 / 2;
   z1 = p.Z;

   x2 = p.X;
   y2 = p.Y+ d1 / 2;
   z2 = p.Z;

   x3 = p.X + d;
   y3 = p.Y + d2 / 2;
   z3 = p.Z + h;

   x4 = p.X + d;
   y4 = p.Y - d2 / 2;
   z4 = p.Z + h;
  }

 }

 p1 = Point.ByCoordinates(x1, y1, z1);
 p2 = Point.ByCoordinates(x2, y2, z2);
 p3 = Point.ByCoordinates(x3, y3, z3);
 p4 = Point.ByCoordinates(x4, y4, z4);

 poly = Polygon.ByPoints({p1, p2, p3, p4});

 return = poly;

};
# ----------------------------------------

# group: 创建栌枓U型面
code_block_15 = CodeBlock()
# ---------- code_block_15.designscript (122 lines) ----------
//创建栌枓U型侧面
//p->底边中心定位点
//w->长边长
//w1->顶部短边长
//h1->高（h - h1)
//h2->中间U型部分高
//direc->绘制方向
def createUPlane(p, w, w1, h1, h2, direc)
{
 x1 =0;
 y1 =0;
 z1 =0;
 x2 =0;
 y2 =0;
 z2 =0;
 x3 =0;
 y3 =0;
 z3 =0;
 x4 =0;
 y4 =0;
 z4 =0;
 x5 =0;
 y5 =0;
 z5 =0;
 x6 =0;
 y6 =0;
 z6 =0;
 x7 =0;
 y7 =0;
 z7 =0;
 x8 =0;
 y8 =0;
 z8 =0;

 geometry = [Imperative]
 {

  if(direc == "x")
  {
   x1 = p.X - w / 2;
   y1 = p.Y;
   z1 = p.Z;

   x2 = p.X + w / 2;
   y2 = p.Y;
   z2 = p.Z;

   x3 = p.X + w / 2;
   y3 = p.Y;
   z3 = p.Z + h1;

   x4 = p.X + w1 / 2;
   y4 = p.Y;
   z4 = p.Z + h1;

   x5 = p.X + w1 / 2;
   y5 = p.Y;
   z5 = p.Z + h1 - h2;

   x6 = p.X - w1 / 2;
   y6 = p.Y;
   z6 = p.Z + h1 - h2;

   x7 = p.X - w1 / 2;
   y7 = p.Y;
   z7 = p.Z + h1;

   x8 = p.X - w / 2;
   y8 = p.Y;
   z8 = p.Z + h1;
  }

  if(direc == "y")
  {
   x1 = p.X;
   y1 = p.Y - w / 2;
   z1 = p.Z;

   x2 = p.X;
   y2 = p.Y + w / 2;
   z2 = p.Z;

   x3 = p.X;
   y3 = p.Y + w / 2;
   z3 = p.Z + h1;

   x4 = p.X;
   y4 = p.Y + w1 / 2;
   z4 = p.Z + h1;

   x5 = p.X;
   y5 = p.Y + w1 / 2;
   z5 = p.Z + h1 - h2;

   x6 = p.X;
   y6 = p.Y - w1 / 2;
   z6 = p.Z + h1 - h2;

   x7 = p.X;
   y7 = p.Y - w1 / 2;
   z7 = p.Z + h1;

   x8 = p.X;
   y8 = p.Y - w / 2;
   z8 = p.Z + h1;
  }

 }

 p1 = Point.ByCoordinates(x1, y1, z1);
 p2 = Point.ByCoordinates(x2, y2, z2);
 p3 = Point.ByCoordinates(x3, y3, z3);
 p4 = Point.ByCoordinates(x4, y4, z4);
 p5 = Point.ByCoordinates(x5, y5, z5);
 p6 = Point.ByCoordinates(x6, y6, z6);
 p7 = Point.ByCoordinates(x7, y7, z7);
 p8 = Point.ByCoordinates(x8, y8, z8);

 poly = Polygon.ByPoints({p1, p2, p3, p4, p5, p6, p7, p8});

 return = poly;
};
# ----------------------------------------
number_14 = DoubleInput(0)
number_15 = DoubleInput(0.5)
pointAtParameter_6 = Surface.PointAtParameter(surface=byPatch_2, u=number_14, v=number_15)
n01_b2 = DoubleInput(40)  # "01-b2"
n01_h = DoubleInput(80)  # "01-h"
code_block_16 = CodeBlock(h=n01_h, h1=n01_h1) { h - h1; }
n01_h2 = DoubleInput(36)  # "01-h2"
string_6 = StringInput("x")
code_block_17 = CodeBlock(center=pointAtParameter_6, w=n01_b, w1=n01_b2, h1=code_block_16, h2=n01_h2, direction=string_6) { createUPlane(center, w, w1, h1, h2, direction); }
pointAtParameter_7 = Surface.PointAtParameter(surface=byPatch_3, u=number_14, v=number_15)
code_block_18 = CodeBlock(center=pointAtParameter_7, w=n01_b, w1=n01_b2, h1=code_block_16, h2=n01_h2, direction=string_6) { createUPlane(center, w, w1, h1, h2, direction); }
pointAtParameter_8 = Surface.PointAtParameter(surface=byPatch_4, u=number_14, v=number_15)
string_7 = StringInput("y")
code_block_19 = CodeBlock(center=pointAtParameter_8, w=n01_b, w1=n01_b2, h1=code_block_16, h2=n01_h2, direction=string_7) { createUPlane(center, w, w1, h1, h2, direction); }
pointAtParameter_9 = Surface.PointAtParameter(surface=byPatch_5, u=number_14, v=number_15)
code_block_20 = CodeBlock(center=pointAtParameter_9, w=n01_b, w1=n01_b2, h1=code_block_16, h2=n01_h2, direction=string_7) { createUPlane(center, w, w1, h1, h2, direction); }

# group: 创建卷杀部分
code_block_21 = CodeBlock()
# ---------- code_block_21.designscript (195 lines) ----------
//创建卷杀曲线
//p->定位点
//b1->卷杀部分长
//b2->其余部分长
//m->卷杀段数
//h1->卷杀部分高
//h->整体高
//direc->方向
def createJuanshaCurve(p, b1, b2, m, h1, h, direc)
{
 x1 = 0;
 y1 = 0;
 z1 = 0;
 x2 = 0;
 y2 = 0;
 z2 = 0;
 x3 = 0;
 y3 = 0;
 z3 = 0;
 x4 = 0;
 y4 = 0;
 z4 = 0;
 x5 = 0;
 y5 = 0;
 z5 = 0;
 x6 = 0;
 y6 = 0;
 z6 = 0;
 x7 = 0;
 y7 = 0;
 z7 = 0;
 x8 = 0;
 y8 = 0;
 z8 = 0;
 geometry = [Imperative]
 {

  if(direc == "x+")
  {
   x1 = p.X;
   y1 = p.Y;
   z1 = p.Z;

   x2 = p.X + b2;
   y2 = p.Y;
   z2 = p.Z;

   x3 = p.X + b2 + ((4 / 10) * b1);
   y3 = p.Y;
   z3 = p.Z + ((1 / 10) * h1);

   x4 = p.X + b2 + ((7 / 10) * b1);
   y4 = p.Y;
   z4 = p.Z + ((3 / 10) * h1);

   x5 = p.X + b2 + ((9 / 10) * b1);
   y5 = p.Y;
   z5 = p.Z + ((6 / 10) * h1);

   x6 = p.X + b2 + b1;
   y6 = p.Y;
   z6 = p.Z + h1;

   x7 = p.X + b2 + b1;
   y7 = p.Y;
   z7 = p.Z + h;

   x8 = p.X;
   y8 = p.Y;
   z8 = p.Z + h;
  }

  if(direc == "x-")
  {
   x1 = p.X;
   y1 = p.Y;
   z1 = p.Z;

   x2 = p.X - b2;
   y2 = p.Y;
   z2 = p.Z;

   x3 = p.X - b2 - ((4 / 10) * b1);
   y3 = p.Y;
   z3 = p.Z + ((1 / 10) * h1);

   x4 = p.X - b2 - ((7 / 10) * b1);
   y4 = p.Y;
   z4 = p.Z + ((3 / 10) * h1);

   x5 = p.X - b2 - ((9 / 10) * b1);
   y5 = p.Y;
   z5 = p.Z + ((6 / 10) * h1);

   x6 = p.X - b2 - b1;
   y6 = p.Y;
   z6 = p.Z + h1;

   x7 = p.X - b2 - b1;
   y7 = p.Y;
   z7 = p.Z + h;

   x8 = p.X;
   y8 = p.Y;
   z8 = p.Z + h;
  }

  if(direc == "y+")
  {
   x1 = p.X;
   y1 = p.Y;
   z1 = p.Z;

   x2 = p.X;
   y2 = p.Y + b2;
   z2 = p.Z;

   x3 = p.X;
   y3 = p.Y + b2 + ((4 / 10) * b1);
   z3 = p.Z + ((1 / 10) * h1);

   x4 = p.X;
   y4 = p.Y + b2 + ((7 / 10) * b1);
   z4 = p.Z + ((3 / 10) * h1);

   x5 = p.X;
   y5 = p.Y + b2 + ((9 / 10) * b1);
   z5 = p.Z + ((6 / 10) * h1);

   x6 = p.X;
   y6 = p.Y + b2 + b1;
   z6 = p.Z + h1;

   x7 = p.X;
   y7 = p.Y + b2 + b1;
   z7 = p.Z + h;

   x8 = p.X;
   y8 = p.Y;
   z8 = p.Z + h;
  }

  if(direc == "y-")
  {
   x1 = p.X;
   y1 = p.Y;
   z1 = p.Z;

   x2 = p.X;
   y2 = p.Y - b2;
   z2 = p.Z;

   x3 = p.X;
   y3 = p.Y - b2 - ((4 / 10) * b1);
   z3 = p.Z + ((1 / 10) * h1);

   x4 = p.X;
   y4 = p.Y - b2 - ((7 / 10) * b1);
   z4 = p.Z + ((3 / 10) * h1);

   x5 = p.X;
   y5 = p.Y - b2 - ((9 / 10) * b1);
   z5 = p.Z + ((6 / 10) * h1);

   x6 = p.X;
   y6 = p.Y - b2 - b1;
   z6 = p.Z + h1;

   x7 = p.X;
   y7 = p.Y - b2 - b1;
   z7 = p.Z + h;

   x8 = p.X;
   y8 = p.Y;
   z8 = p.Z + h;
  }
 }


 p1 = Point.ByCoordinates(x1, y1, z1);
 p2 = Point.ByCoordinates(x2, y2, z2);
 p3 = Point.ByCoordinates(x3, y3, z3);
 p4 = Point.ByCoordinates(x4, y4, z4);
 p5 = Point.ByCoordinates(x5, y5, z5);
 p6 = Point.ByCoordinates(x6, y6, z6);
 p7 = Point.ByCoordinates(x7, y7, z7);
 p8 = Point.ByCoordinates(x8, y8, z8);

 poly = Polygon.ByPoints({p1, p2, p3, p4, p5, p6, p7, p8});

 curve = PolyCurve.ByPoints({p1, p2, p3, p4, p5, p6, p7, p8}, true);

 return = curve;

};
# ----------------------------------------
byPatch_6 = Surface.ByPatch(code_block_17)
code_block_22 = CodeBlock(h2=n01_h2, h1=code_block_16) { h2 / h1; }
code_block_23 = CodeBlock(w1=n01_b2, w=n01_b) { w1 / w; }
pointAtParameter_10 = Surface.PointAtParameter(surface=byPatch_6, u=code_block_22, v=code_block_23)
n02_b1 = DoubleInput(60)  # "02-b1"
n02_b = DoubleInput(280)  # "02-b"
b2_新定义中间参数 = CodeBlock(b=n02_b, b1=n02_b1, b_01=n01_b) { ((b - 2 * b1) - b_01) / 2; }
number_16 = DoubleInput(4)
n02_h1 = DoubleInput(32)  # "02-h1"
n02_h = DoubleInput(60)  # "02-h"
string_8 = StringInput("y-")
code_block_24 = CodeBlock(p=pointAtParameter_10, b1=n02_b1, b2=b2_新定义中间参数, m=number_16, h1=n02_h1, h=n02_h, direc=string_8) { createJuanshaCurve(p, b1, b2, m, h1, h, direc); }
code_block_25 = CodeBlock(w1=n01_b2, w=n01_b) { 1 - w1 / w; }
pointAtParameter_11 = Surface.PointAtParameter(surface=byPatch_6, u=code_block_22, v=code_block_25)
code_block_26 = CodeBlock(p=pointAtParameter_11, b1=n02_b1, b2=b2_新定义中间参数, m=number_16, h1=n02_h1, h=n02_h, direc=string_8) { createJuanshaCurve(p, b1, b2, m, h1, h, direc); }
join = List.Join(code_block_24, code_block_26)
byLoft = Surface.ByLoft(join)
byPatch_7 = Surface.ByPatch(code_block_26)
byPatch_8 = Surface.ByPatch(code_block_18)
pointAtParameter_12 = Surface.PointAtParameter(surface=byPatch_8, u=code_block_22, v=code_block_23)
string_9 = StringInput("y+")
code_block_27 = CodeBlock(p=pointAtParameter_12, b1=n02_b1, b2=b2_新定义中间参数, m=number_16, h1=n02_h1, h=n02_h, direc=string_9) { createJuanshaCurve(p, b1, b2, m, h1, h, direc); }
pointAtParameter_13 = Surface.PointAtParameter(surface=byPatch_8, u=code_block_22, v=code_block_25)
code_block_28 = CodeBlock(p=pointAtParameter_13, b1=n02_b1, b2=b2_新定义中间参数, m=number_16, h1=n02_h1, h=n02_h, direc=string_9) { createJuanshaCurve(p, b1, b2, m, h1, h, direc); }
join_2 = List.Join(code_block_27, code_block_28)
byLoft_2 = Surface.ByLoft(join_2)
byPatch_9 = Surface.ByPatch(code_block_28)
byPatch_10 = Surface.ByPatch(code_block_19)
pointAtParameter_14 = Surface.PointAtParameter(surface=byPatch_10, u=code_block_22, v=code_block_23)
string_10 = StringInput("x+")
code_block_29 = CodeBlock(p=pointAtParameter_14, b1=n02_b1, b2=b2_新定义中间参数, m=number_16, h1=n02_h1, h=n02_h, direc=string_10) { createJuanshaCurve(p, b1, b2, m, h1, h, direc); }
pointAtParameter_15 = Surface.PointAtParameter(surface=byPatch_10, u=code_block_22, v=code_block_25)
code_block_30 = CodeBlock(p=pointAtParameter_15, b1=n02_b1, b2=b2_新定义中间参数, m=number_16, h1=n02_h1, h=n02_h, direc=string_10) { createJuanshaCurve(p, b1, b2, m, h1, h, direc); }
join_3 = List.Join(code_block_29, code_block_30)
byLoft_3 = Surface.ByLoft(join_3)
byPatch_11 = Surface.ByPatch(code_block_30)
byPatch_12 = Surface.ByPatch(code_block_20)
pointAtParameter_16 = Surface.PointAtParameter(surface=byPatch_12, u=code_block_22, v=code_block_23)
string_11 = StringInput("x-")
code_block_31 = CodeBlock(p=pointAtParameter_16, b1=n02_b1, b2=b2_新定义中间参数, m=number_16, h1=n02_h1, h=n02_h, direc=string_11) { createJuanshaCurve(p, b1, b2, m, h1, h, direc); }
byPatch_13 = Surface.ByPatch(code_block_31)
pointAtParameter_17 = Surface.PointAtParameter(surface=byPatch_12, u=code_block_22, v=code_block_25)
code_block_32 = CodeBlock(p=pointAtParameter_17, b1=n02_b1, b2=b2_新定义中间参数, m=number_16, h1=n02_h1, h=n02_h, direc=string_11) { createJuanshaCurve(p, b1, b2, m, h1, h, direc); }
join_4 = List.Join(code_block_31, code_block_32)
byLoft_4 = Surface.ByLoft(join_4)
byPatch_14 = Surface.ByPatch(code_block_32)
byPatch_15 = Surface.ByPatch(code_block_24)
byPatch_16 = Surface.ByPatch(code_block_27)
byPatch_17 = Surface.ByPatch(code_block_29)

# group: 创建二跳散枓/交互枓底面
number_17 = DoubleInput(1)
number_18 = DoubleInput(0)
pointAtParameter_18 = Surface.PointAtParameter(surface=byPatch_15, u=number_17, v=number_18)
x_draft = CodeBlock(b=n01_b2) { b / 2; }
n04_b1 = DoubleInput(46)  # "04-b1"
y_draft = CodeBlock(b=n04_b1) { b / 2; }
translate = Geometry.Translate(geometry=pointAtParameter_18, xTranslation=x_draft, yTranslation=y_draft)
code_block_33 = CodeBlock(b1=n04_b1) { b1 / 2; }
code_block_34 = CodeBlock(p=translate, r=code_block_33) { createQuadCenter(p, r); }
byPatch_18 = Surface.ByPatch(code_block_34)

# group: 创建二跳散枓/交互枓的梯形面
number_19 = DoubleInput(0)
number_20 = DoubleInput(0.5)
number_21 = DoubleInput(1)
pointAtParameter_19 = Surface.PointAtParameter(surface=byPatch_18, u=number_20, v=number_21)
code_block_35 = CodeBlock(d1=n04_b1) { d1; }
n04_b = DoubleInput(70)  # "04-b"
n04_h1 = DoubleInput(17)  # "04-h1"
code_block_36 = CodeBlock(b=n04_b, b1=n04_b1) { (b - b1) / 2; }
string_12 = StringInput("y+")
code_block_37 = CodeBlock(center=pointAtParameter_19, d1=code_block_35, d2=n04_b, h=n04_h1, dy=code_block_36, direction=string_12) { createTrape(center, d1, d2, h ,dy, direction); }
byPatch_19 = Surface.ByPatch(code_block_37)
number_22 = DoubleInput(1)
number_23 = DoubleInput(0.5)
pointAtParameter_20 = Surface.PointAtParameter(surface=byPatch_18, u=number_22, v=number_23)
string_13 = StringInput("x+")
code_block_38 = CodeBlock(center=pointAtParameter_20, d1=code_block_35, d2=n04_b, h=n04_h1, dy=code_block_36, direction=string_13) { createTrape(center, d1, d2, h ,dy, direction); }
byPatch_20 = Surface.ByPatch(code_block_38)
number_24 = DoubleInput(0)
number_25 = DoubleInput(0.5)
pointAtParameter_21 = Surface.PointAtParameter(surface=byPatch_18, u=number_24, v=number_25)
string_14 = StringInput("x-")
code_block_39 = CodeBlock(center=pointAtParameter_21, d1=code_block_35, d2=n04_b, h=n04_h1, dy=code_block_36, direction=string_14) { createTrape(center, d1, d2, h ,dy, direction); }
byPatch_21 = Surface.ByPatch(code_block_39)
number_26 = DoubleInput(0.5)
number_27 = DoubleInput(0)
pointAtParameter_22 = Surface.PointAtParameter(surface=byPatch_18, u=number_26, v=number_27)
string_15 = StringInput("y-")
code_block_40 = CodeBlock(center=pointAtParameter_22, d1=code_block_35, d2=n04_b, h=n04_h1, d=code_block_36, direction=string_15) { createTrape(center, d1, d2, h, d, direction); }
byPatch_22 = Surface.ByPatch(code_block_40)

# group: 创建二跳散枓U型面
number_28 = DoubleInput(0.5)
number_29 = DoubleInput(1)
pointAtParameter_23 = Surface.PointAtParameter(surface=byPatch_19, u=number_28, v=number_29)
n04_b_2 = DoubleInput(70)  # "04-b"
n04_b2 = DoubleInput(40)  # "04-b2"
n04_h = DoubleInput(45)  # "04-h"
n04_h1_2 = DoubleInput(17)  # "04-h1"
code_block_41 = CodeBlock(h=n04_h, h1=n04_h1_2) { h - h1; }
n04_h2 = DoubleInput(18)  # "04-h2"
string_16 = StringInput("x")
code_block_42 = CodeBlock(center=pointAtParameter_23, w=n04_b_2, w1=n04_b2, h1=code_block_41, h2=n04_h2, cirection=string_16) { createUPlane(center, w, w1, h1, h2, cirection); }
byPatch_23 = Surface.ByPatch(code_block_42)
number_30 = DoubleInput(0)
number_31 = DoubleInput(0.5)
pointAtParameter_24 = Surface.PointAtParameter(surface=byPatch_20, u=number_30, v=number_31)
number_32 = DoubleInput(0)
string_17 = StringInput("y")
code_block_43 = CodeBlock(center=pointAtParameter_24, w=n04_b_2, w1=n04_b2, h1=code_block_41, h2=number_32, cirection=string_17) { createUPlane(center, w, w1, h1, h2, cirection); }
byPatch_24 = Surface.ByPatch(code_block_43)
number_33 = DoubleInput(0)
number_34 = DoubleInput(0.5)
pointAtParameter_25 = Surface.PointAtParameter(surface=byPatch_21, u=number_33, v=number_34)
code_block_44 = CodeBlock(center=pointAtParameter_25, w=n04_b_2, w1=n04_b2, h1=code_block_41, h2=number_32, cirection=string_17) { createUPlane(center, w, w1, h1, h2, cirection); }
byPatch_25 = Surface.ByPatch(code_block_44)
number_35 = DoubleInput(0.5)
number_36 = DoubleInput(0)
pointAtParameter_26 = Surface.PointAtParameter(surface=byPatch_22, u=number_35, v=number_36)
code_block_45 = CodeBlock(center=pointAtParameter_26, w=n04_b_2, w1=n04_b2, h1=code_block_41, h2=n04_h2, cirection=string_16) { createUPlane(center, w, w1, h1, h2, cirection); }
byPatch_26 = Surface.ByPatch(code_block_45)

# group: 创建二跳散枓/交互枓底面
number_37 = DoubleInput(0)
number_38 = DoubleInput(1)
pointAtParameter_27 = Surface.PointAtParameter(surface=byPatch_16, u=number_37, v=number_38)
x_draft_2 = CodeBlock(b=n01_b2) { b / 2; }
n04_b1_2 = DoubleInput(46)  # "04-b1"
y_draft_2 = CodeBlock(b=n04_b1_2) { b / 2; }
code_block_46 = CodeBlock(y=y_draft_2) { -y; }
translate_2 = Geometry.Translate(geometry=pointAtParameter_27, xTranslation=x_draft_2, yTranslation=code_block_46)
code_block_47 = CodeBlock(b1=n04_b1_2) { b1 / 2; }
code_block_48 = CodeBlock(p=translate_2, r=code_block_47) { createQuadCenter(p, r); }
byPatch_27 = Surface.ByPatch(code_block_48)

# group: 创建二跳散枓/交互枓的梯形面
number_39 = DoubleInput(0)
number_40 = DoubleInput(1)
number_41 = DoubleInput(0.5)
pointAtParameter_28 = Surface.PointAtParameter(surface=byPatch_27, u=number_40, v=number_41)
code_block_49 = CodeBlock(d1=n04_b1_2) { d1; }
n04_b_3 = DoubleInput(68)  # "04-b"
n04_h1_3 = DoubleInput(17)  # "04-h1"
code_block_50 = CodeBlock(b=n04_b_3, b1=n04_b1_2) { (b - b1) / 2; }
string_18 = StringInput("x+")
code_block_51 = CodeBlock(center=pointAtParameter_28, d1=code_block_49, d2=n04_b_3, h=n04_h1_3, dy=code_block_50, direction=string_18) { createTrape(center, d1, d2, h ,dy, direction); }
byPatch_28 = Surface.ByPatch(code_block_51)
number_42 = DoubleInput(0.5)
number_43 = DoubleInput(0)
pointAtParameter_29 = Surface.PointAtParameter(surface=byPatch_27, u=number_42, v=number_43)
string_19 = StringInput("y-")
code_block_52 = CodeBlock(center=pointAtParameter_29, d1=code_block_49, d2=n04_b_3, h=n04_h1_3, d=code_block_50, direction=string_19) { createTrape(center, d1, d2, h, d, direction); }
byPatch_29 = Surface.ByPatch(code_block_52)
number_44 = DoubleInput(0)
number_45 = DoubleInput(0.5)
pointAtParameter_30 = Surface.PointAtParameter(surface=byPatch_27, u=number_44, v=number_45)
string_20 = StringInput("x-")
code_block_53 = CodeBlock(center=pointAtParameter_30, d1=code_block_49, d2=n04_b_3, h=n04_h1_3, dy=code_block_50, direction=string_20) { createTrape(center, d1, d2, h ,dy, direction); }
byPatch_30 = Surface.ByPatch(code_block_53)
number_46 = DoubleInput(0.5)
number_47 = DoubleInput(1)
pointAtParameter_31 = Surface.PointAtParameter(surface=byPatch_27, u=number_46, v=number_47)
string_21 = StringInput("y+")
code_block_54 = CodeBlock(center=pointAtParameter_31, d1=code_block_49, d2=n04_b_3, h=n04_h1_3, dy=code_block_50, direction=string_21) { createTrape(center, d1, d2, h ,dy, direction); }
byPatch_31 = Surface.ByPatch(code_block_54)

# group: 创建二跳散枓U型面
number_48 = DoubleInput(0)
number_49 = DoubleInput(0.5)
pointAtParameter_32 = Surface.PointAtParameter(surface=byPatch_28, u=number_48, v=number_49)
n04_b_4 = DoubleInput(70)  # "04-b"
n04_b2_2 = DoubleInput(40)  # "04-b2"
n04_h_2 = DoubleInput(45)  # "04-h"
n04_h1_4 = DoubleInput(17)  # "04-h1"
code_block_55 = CodeBlock(h=n04_h_2, h1=n04_h1_4) { h - h1; }
number_50 = DoubleInput(0)
string_22 = StringInput("y")
code_block_56 = CodeBlock(center=pointAtParameter_32, w=n04_b_4, w1=n04_b2_2, h1=code_block_55, h2=number_50, cirection=string_22) { createUPlane(center, w, w1, h1, h2, cirection); }
byPatch_32 = Surface.ByPatch(code_block_56)
number_51 = DoubleInput(0.5)
number_52 = DoubleInput(0)
pointAtParameter_33 = Surface.PointAtParameter(surface=byPatch_29, u=number_51, v=number_52)
n04_h2_2 = DoubleInput(18)  # "04-h2"
string_23 = StringInput("x")
code_block_57 = CodeBlock(center=pointAtParameter_33, w=n04_b_4, w1=n04_b2_2, h1=code_block_55, h2=n04_h2_2, cirection=string_23) { createUPlane(center, w, w1, h1, h2, cirection); }
byPatch_33 = Surface.ByPatch(code_block_57)
number_53 = DoubleInput(0)
number_54 = DoubleInput(0.5)
pointAtParameter_34 = Surface.PointAtParameter(surface=byPatch_30, u=number_53, v=number_54)
code_block_58 = CodeBlock(center=pointAtParameter_34, w=n04_b_4, w1=n04_b2_2, h1=code_block_55, h2=number_50, cirection=string_22) { createUPlane(center, w, w1, h1, h2, cirection); }
byPatch_34 = Surface.ByPatch(code_block_58)
number_55 = DoubleInput(0.5)
number_56 = DoubleInput(1)
pointAtParameter_35 = Surface.PointAtParameter(surface=byPatch_31, u=number_55, v=number_56)
code_block_59 = CodeBlock(center=pointAtParameter_35, w=n04_b_4, w1=n04_b2_2, h1=code_block_55, h2=n04_h2_2, cirection=string_23) { createUPlane(center, w, w1, h1, h2, cirection); }
byPatch_35 = Surface.ByPatch(code_block_59)

# group: 创建二跳散枓/交互枓底面
number_57 = DoubleInput(0)
number_58 = DoubleInput(1)
pointAtParameter_36 = Surface.PointAtParameter(surface=byPatch_17, u=number_57, v=number_58)
n04_b1_3 = DoubleInput(46)  # "04-b1"
x_draft_3 = CodeBlock(b=n04_b1_3) { b / 2; }
code_block_60 = CodeBlock(x=x_draft_3) { -x; }
y_draft_3 = CodeBlock(b=n01_b2) { b / 2; }
translate_3 = Geometry.Translate(geometry=pointAtParameter_36, xTranslation=code_block_60, yTranslation=y_draft_3)
code_block_61 = CodeBlock(b1=n04_b1_3) { b1 / 2; }
code_block_62 = CodeBlock(p=translate_3, r=code_block_61) { createQuadCenter(p, r); }
byPatch_36 = Surface.ByPatch(code_block_62)

# group: 创建二跳散枓/交互枓的梯形面
number_59 = DoubleInput(0)
number_60 = DoubleInput(0)
number_61 = DoubleInput(0.5)
pointAtParameter_37 = Surface.PointAtParameter(surface=byPatch_36, u=number_60, v=number_61)
code_block_63 = CodeBlock(d1=n04_b1_3) { d1; }
n04_b_5 = DoubleInput(68)  # "04-b"
n04_h1_5 = DoubleInput(17)  # "04-h1"
code_block_64 = CodeBlock(b=n04_b_5, b1=n04_b1_3) { (b - b1) / 2; }
string_24 = StringInput("x-")
code_block_65 = CodeBlock(center=pointAtParameter_37, d1=code_block_63, d2=n04_b_5, h=n04_h1_5, dy=code_block_64, direction=string_24) { createTrape(center, d1, d2, h ,dy, direction); }
byPatch_37 = Surface.ByPatch(code_block_65)
number_62 = DoubleInput(1)
number_63 = DoubleInput(0.5)
pointAtParameter_38 = Surface.PointAtParameter(surface=byPatch_36, u=number_62, v=number_63)
string_25 = StringInput("x+")
code_block_66 = CodeBlock(center=pointAtParameter_38, d1=code_block_63, d2=n04_b_5, h=n04_h1_5, dy=code_block_64, direction=string_25) { createTrape(center, d1, d2, h ,dy, direction); }
byPatch_38 = Surface.ByPatch(code_block_66)
number_64 = DoubleInput(0.5)
number_65 = DoubleInput(1)
pointAtParameter_39 = Surface.PointAtParameter(surface=byPatch_36, u=number_64, v=number_65)
string_26 = StringInput("y+")
code_block_67 = CodeBlock(center=pointAtParameter_39, d1=code_block_63, d2=n04_b_5, h=n04_h1_5, dy=code_block_64, direction=string_26) { createTrape(center, d1, d2, h ,dy, direction); }
byPatch_39 = Surface.ByPatch(code_block_67)
number_66 = DoubleInput(0.5)
number_67 = DoubleInput(0)
pointAtParameter_40 = Surface.PointAtParameter(surface=byPatch_36, u=number_66, v=number_67)
string_27 = StringInput("y-")
code_block_68 = CodeBlock(center=pointAtParameter_40, d1=code_block_63, d2=n04_b_5, h=n04_h1_5, d=code_block_64, direction=string_27) { createTrape(center, d1, d2, h, d, direction); }
byPatch_40 = Surface.ByPatch(code_block_68)

# group: 创建二跳散枓U型面
number_68 = DoubleInput(0)
number_69 = DoubleInput(0)
number_70 = DoubleInput(0.5)
pointAtParameter_41 = Surface.PointAtParameter(surface=byPatch_37, u=number_69, v=number_70)
n04_b_6 = DoubleInput(70)  # "04-b"
n04_b2_3 = DoubleInput(40)  # "04-b2"
n04_h_3 = DoubleInput(45)  # "04-h"
n04_h1_6 = DoubleInput(17)  # "04-h1"
code_block_69 = CodeBlock(h=n04_h_3, h1=n04_h1_6) { h - h1; }
n04_h2_3 = DoubleInput(18)  # "04-h2"
string_28 = StringInput("y")
code_block_70 = CodeBlock(center=pointAtParameter_41, w=n04_b_6, w1=n04_b2_3, h1=code_block_69, h2=n04_h2_3, cirection=string_28) { createUPlane(center, w, w1, h1, h2, cirection); }
byPatch_41 = Surface.ByPatch(code_block_70)
number_71 = DoubleInput(0)
number_72 = DoubleInput(0.5)
pointAtParameter_42 = Surface.PointAtParameter(surface=byPatch_38, u=number_71, v=number_72)
code_block_71 = CodeBlock(center=pointAtParameter_42, w=n04_b_6, w1=n04_b2_3, h1=code_block_69, h2=n04_h2_3, cirection=string_28) { createUPlane(center, w, w1, h1, h2, cirection); }
byPatch_42 = Surface.ByPatch(code_block_71)
number_73 = DoubleInput(0.5)
number_74 = DoubleInput(1)
pointAtParameter_43 = Surface.PointAtParameter(surface=byPatch_39, u=number_73, v=number_74)
string_29 = StringInput("x")
code_block_72 = CodeBlock(center=pointAtParameter_43, w=n04_b_6, w1=n04_b2_3, h1=code_block_69, h2=n04_h2_3, cirection=string_29) { createUPlane(center, w, w1, h1, h2, cirection); }
byPatch_43 = Surface.ByPatch(code_block_72)
number_75 = DoubleInput(0.5)
number_76 = DoubleInput(0)
pointAtParameter_44 = Surface.PointAtParameter(surface=byPatch_40, u=number_75, v=number_76)
code_block_73 = CodeBlock(center=pointAtParameter_44, w=n04_b_6, w1=n04_b2_3, h1=code_block_69, h2=n04_h2_3, cirection=string_29) { createUPlane(center, w, w1, h1, h2, cirection); }
byPatch_44 = Surface.ByPatch(code_block_73)

# group: 创建二跳卷杀部分
code_block_74 = CodeBlock(h2=n04_h2, h1=code_block_41) { h2 / h1; }
code_block_75 = CodeBlock(b=n04_b, b2=n04_b2) { ((b - b2) / 2) + b2; }
code_block_76 = CodeBlock(w1=code_block_75, w=n04_b) { w1 / w; }
pointAtParameter_45 = Surface.PointAtParameter(surface=byPatch_26, u=code_block_74, v=code_block_76)
n06_b1 = DoubleInput(60)  # "06-b1"
n06_b = DoubleInput(468)  # "06-b"
code_block_77 = CodeBlock(b=n06_b, b1=n06_b1, b_01=n02_b, d_04=code_block_36) { ((b - 2 * b1) - b_01 - 2 * d_04) / 2; }
number_77 = DoubleInput(4)
n06_h1 = DoubleInput(32)  # "06-h1"
n06_h = DoubleInput(64)  # "06-h"
string_30 = StringInput("y-")
code_block_78 = CodeBlock(p=pointAtParameter_45, b1=n06_b1, b2=code_block_77, m=number_77, h1=n06_h1, h=n06_h, direc=string_30) { createJuanshaCurve(p, b1, b2, m, h1, h, direc); }
byPatch_45 = Surface.ByPatch(code_block_78)
code_block_79 = CodeBlock(w1=code_block_75, w=n04_b) { 1 - w1 / w; }
pointAtParameter_46 = Surface.PointAtParameter(surface=byPatch_26, u=code_block_74, v=code_block_79)
code_block_80 = CodeBlock(p=pointAtParameter_46, b1=n06_b1, b2=code_block_77, m=number_77, h1=n06_h1, h=n06_h, direc=string_30) { createJuanshaCurve(p, b1, b2, m, h1, h, direc); }
byPatch_46 = Surface.ByPatch(code_block_80)
join_5 = List.Join(code_block_78, code_block_80)
byLoft_5 = PolySurface.ByLoft(join_5)

# group: 创建二跳卷杀部分
code_block_81 = CodeBlock(h2=n04_h2, h1=code_block_41) { h2 / h1; }
code_block_82 = CodeBlock(b=n04_b, b2=n04_b2) { ((b - b2) / 2) + b2; }
code_block_83 = CodeBlock(w1=code_block_82, w=n04_b) { w1 / w; }
pointAtParameter_47 = Surface.PointAtParameter(surface=byPatch_35, u=code_block_81, v=code_block_83)
n06_b1_2 = DoubleInput(60)  # "06-b1"
n06_b_2 = DoubleInput(468)  # "06-b"
code_block_84 = CodeBlock(b=n06_b_2, b1=n06_b1_2, b_01=n02_b, d_04=code_block_36) { ((b - 2 * b1) - b_01 - 2 * d_04) / 2; }
number_78 = DoubleInput(4)
n06_h1_2 = DoubleInput(32)  # "06-h1"
n06_h_2 = DoubleInput(64)  # "06-h"
string_31 = StringInput("y+")
code_block_85 = CodeBlock(p=pointAtParameter_47, b1=n06_b1_2, b2=code_block_84, m=number_78, h1=n06_h1_2, h=n06_h_2, direc=string_31) { createJuanshaCurve(p, b1, b2, m, h1, h, direc); }
byPatch_47 = Surface.ByPatch(code_block_85)
code_block_86 = CodeBlock(w1=code_block_82, w=n04_b) { 1 - w1 / w; }
pointAtParameter_48 = Surface.PointAtParameter(surface=byPatch_35, u=code_block_81, v=code_block_86)
code_block_87 = CodeBlock(p=pointAtParameter_48, b1=n06_b1_2, b2=code_block_84, m=number_78, h1=n06_h1_2, h=n06_h_2, direc=string_31) { createJuanshaCurve(p, b1, b2, m, h1, h, direc); }
byPatch_48 = Surface.ByPatch(code_block_87)
join_6 = List.Join(code_block_85, code_block_87)
byLoft_6 = PolySurface.ByLoft(join_6)

# group: 创建二跳卷杀部分
code_block_88 = CodeBlock(h2=n04_h2, h1=code_block_41) { h2 / h1; }
code_block_89 = CodeBlock(b=n04_b, b2=n04_b2) { ((b - b2) / 2) + b2; }
code_block_90 = CodeBlock(w1=code_block_89, w=n04_b) { w1 / w; }
pointAtParameter_49 = Surface.PointAtParameter(surface=byPatch_42, u=code_block_88, v=code_block_90)
n08_b1 = DoubleInput(60)  # "08-b1"
n08_b2 = DoubleInput(89)  # "08-b2"
code_block_91 = CodeBlock(b2=n08_b2, b1=n08_b1, b_04=n04_b_6, w1_04=code_block_89) { b2 - b1 - (b_04 - w1_04); }
number_79 = DoubleInput(4)
n08_h1 = DoubleInput(32)  # "08-h1"
n08_h = DoubleInput(64)  # "08-h"
string_32 = StringInput("x+")
code_block_92 = CodeBlock(p=pointAtParameter_49, b1=n08_b1, b2=code_block_91, m=number_79, h1=n08_h1, h=n08_h, direc=string_32) { createJuanshaCurve(p, b1, b2, m, h1, h, direc); }
byPatch_49 = Surface.ByPatch(code_block_92)
code_block_93 = CodeBlock(w1=code_block_89, w=n04_b) { 1 - w1 / w; }
pointAtParameter_50 = Surface.PointAtParameter(surface=byPatch_42, u=code_block_88, v=code_block_93)
code_block_94 = CodeBlock(p=pointAtParameter_50, b1=n08_b1, b2=code_block_91, m=number_79, h1=n08_h1, h=n08_h, direc=string_32) { createJuanshaCurve(p, b1, b2, m, h1, h, direc); }
byPatch_50 = Surface.ByPatch(code_block_94)
join_7 = List.Join(code_block_92, code_block_94)
byLoft_7 = PolySurface.ByLoft(join_7)

# group: 创建二跳中间柱形体
surfaces = PolySurface.Surfaces(byLoft_5)
number_80 = DoubleInput(7)
getItemAtIndex = List.GetItemAtIndex(list=surfaces, index=number_80)
perimeterCurves = Surface.PerimeterCurves(getItemAtIndex)
byJoinedCurves = PolyCurve.ByJoinedCurves(perimeterCurves)
surfaces_2 = PolySurface.Surfaces(byLoft_6)
number_81 = DoubleInput(7)
getItemAtIndex_2 = List.GetItemAtIndex(list=surfaces_2, index=number_81)
perimeterCurves_2 = Surface.PerimeterCurves(getItemAtIndex_2)
byJoinedCurves_2 = PolyCurve.ByJoinedCurves(perimeterCurves_2)
join_8 = List.Join(byJoinedCurves, byJoinedCurves_2)
byLoft_8 = PolySurface.ByLoft(join_8)

# group: 创建二跳单卷杀栱长方体部分
code_block_95 = CodeBlock()
# ---------- code_block_95.designscript (68 lines) ----------
//创建单卷杀长方体栱部分，
//cur->边界曲线
//width->长方体长度
//direction->延伸方向
def createCubiod(cur, width, direction)
{
 x1 = 0;
 y1 = 0;
 z1 = 0;
 x2 = 0;
 y2 = 0;
 z2 = 0;

 geometry = [Imperative]
 {
  if(direction == "x+")
  {
   x1 = cur.StartPoint.X + width;
   y1 = cur.StartPoint.Y;
   z1 = cur.StartPoint.Z;

   x2 = cur.EndPoint.X + width;
   y2 = cur.EndPoint.Y;
   z2 = cur.EndPoint.Z;
  }

  if(direction == "x-")
  {
   x1 = cur.StartPoint.X - width;
   y1 = cur.StartPoint.Y;
   z1 = cur.StartPoint.Z;

   x2 = cur.EndPoint.X - width;
   y2 = cur.EndPoint.Y;
   z2 = cur.EndPoint.Z;
  }

  if(direction == "y+")
  {
   x1 = cur.StartPoint.X;
   y1 = cur.StartPoint.Y + width;
   z1 = cur.StartPoint.Z;

   x2 = cur.EndPoint.X;
   y2 = cur.EndPoint.Y + width;
   z2 = cur.EndPoint.Z;
  }

  if(direction == "y-")
  {
   x1 = cur.StartPoint.X;
   y1 = cur.StartPoint.Y - width;
   z1 = cur.StartPoint.Z;

   x2 = cur.EndPoint.X;
   y2 = cur.EndPoint.Y - width;
   z2 = cur.EndPoint.Z;
  }
 }

 p1 = Point.ByCoordinates(x1, y1, z1);
 p2 = Point.ByCoordinates(x2, y2, z2);

 curve = PolyCurve.ByPoints({p1, p2}, false);

 return = curve;

};
# ----------------------------------------
surfaces_3 = PolySurface.Surfaces(byLoft_7)
number_82 = DoubleInput(7)
getItemAtIndex_3 = List.GetItemAtIndex(list=surfaces_3, index=number_82)
perimeterCurves_3 = Surface.PerimeterCurves(getItemAtIndex_3)
byJoinedCurves_3 = PolyCurve.ByJoinedCurves(perimeterCurves_3)
number_83 = DoubleInput(0)
getItemAtIndex_4 = List.GetItemAtIndex(list=perimeterCurves_3, index=number_83)
n08_b = DoubleInput(396)  # "08-b"
code_block_96 = CodeBlock(b=n08_b, b1=n08_b1, d=code_block_91) { b - b1 - d; }
string_33 = StringInput("x-")
code_block_97 = CodeBlock(curve=getItemAtIndex_4, width=code_block_96, direction=string_33) { createCubiod(curve, width, direction); }
number_84 = DoubleInput(1)
getItemAtIndex_5 = List.GetItemAtIndex(list=perimeterCurves_3, index=number_84)
code_block_98 = CodeBlock(curve=getItemAtIndex_5, width=code_block_96, direction=string_33) { createCubiod(curve, width, direction); }
number_85 = DoubleInput(2)
getItemAtIndex_6 = List.GetItemAtIndex(list=perimeterCurves_3, index=number_85)
code_block_99 = CodeBlock(curve=getItemAtIndex_6, width=code_block_96, direction=string_33) { createCubiod(curve, width, direction); }
number_86 = DoubleInput(3)
getItemAtIndex_7 = List.GetItemAtIndex(list=perimeterCurves_3, index=number_86)
code_block_100 = CodeBlock(curve=getItemAtIndex_7, width=code_block_96, direction=string_33) { createCubiod(curve, width, direction); }
join_9 = List.Join(code_block_97, code_block_98, code_block_99, code_block_100)
byJoinedCurves_4 = PolyCurve.ByJoinedCurves(join_9)
join_10 = List.Join(byJoinedCurves_3, byJoinedCurves_4)
byLoft_9 = Solid.ByLoft(join_10)

# group: 创建二跳卷杀部分
code_block_101 = CodeBlock(h2=n04_h2, h1=code_block_41) { h2 / h1; }
code_block_102 = CodeBlock(b=n04_b, b2=n04_b2) { ((b - b2) / 2) + b2; }
code_block_103 = CodeBlock(w1=code_block_102, w=n04_b) { w1 / w; }
pointAtParameter_51 = Surface.PointAtParameter(surface=byPatch_43, u=code_block_101, v=code_block_103)
n06_b1_3 = DoubleInput(60)  # "06-b1"
n06_b_3 = DoubleInput(468)  # "06-b"
code_block_104 = CodeBlock(b=n06_b_3, b1=n06_b1_3, b_01=n02_b, d_04=code_block_36) { ((b - 2 * b1) - b_01 - 2 * d_04) / 2; }
number_87 = DoubleInput(4)
n06_h1_3 = DoubleInput(32)  # "06-h1"
n06_h_3 = DoubleInput(64)  # "06-h"
string_34 = StringInput("y+")
code_block_105 = CodeBlock(p=pointAtParameter_51, b1=n06_b1_3, b2=code_block_104, m=number_87, h1=n06_h1_3, h=n06_h_3, direc=string_34) { createJuanshaCurve(p, b1, b2, m, h1, h, direc); }
byPatch_51 = Surface.ByPatch(code_block_105)
code_block_106 = CodeBlock(w1=code_block_102, w=n04_b) { 1 - w1 / w; }
pointAtParameter_52 = Surface.PointAtParameter(surface=byPatch_43, u=code_block_101, v=code_block_106)
code_block_107 = CodeBlock(p=pointAtParameter_52, b1=n06_b1_3, b2=code_block_104, m=number_87, h1=n06_h1_3, h=n06_h_3, direc=string_34) { createJuanshaCurve(p, b1, b2, m, h1, h, direc); }
byPatch_52 = Surface.ByPatch(code_block_107)
join_11 = List.Join(code_block_105, code_block_107)
byLoft_10 = PolySurface.ByLoft(join_11)

# group: 创建二跳卷杀部分
code_block_108 = CodeBlock(h2=n04_h2, h1=code_block_41) { h2 / h1; }
code_block_109 = CodeBlock(b=n04_b, b2=n04_b2) { ((b - b2) / 2) + b2; }
code_block_110 = CodeBlock(w1=code_block_109, w=n04_b) { w1 / w; }
pointAtParameter_53 = Surface.PointAtParameter(surface=byPatch_44, u=code_block_108, v=code_block_110)
n06_b1_4 = DoubleInput(60)  # "06-b1"
n06_b_4 = DoubleInput(468)  # "06-b"
code_block_111 = CodeBlock(b=n06_b_4, b1=n06_b1_4, b_01=n02_b, d_04=code_block_36) { ((b - 2 * b1) - b_01 - 2 * d_04) / 2; }
number_88 = DoubleInput(4)
n06_h1_4 = DoubleInput(32)  # "06-h1"
n06_h_4 = DoubleInput(64)  # "06-h"
string_35 = StringInput("y-")
code_block_112 = CodeBlock(p=pointAtParameter_53, b1=n06_b1_4, b2=code_block_111, m=number_88, h1=n06_h1_4, h=n06_h_4, direc=string_35) { createJuanshaCurve(p, b1, b2, m, h1, h, direc); }
byPatch_53 = Surface.ByPatch(code_block_112)
code_block_113 = CodeBlock(w1=code_block_109, w=n04_b) { 1 - w1 / w; }
pointAtParameter_54 = Surface.PointAtParameter(surface=byPatch_44, u=code_block_108, v=code_block_113)
code_block_114 = CodeBlock(p=pointAtParameter_54, b1=n06_b1_4, b2=code_block_111, m=number_88, h1=n06_h1_4, h=n06_h_4, direc=string_35) { createJuanshaCurve(p, b1, b2, m, h1, h, direc); }
byPatch_54 = Surface.ByPatch(code_block_114)
join_12 = List.Join(code_block_112, code_block_114)
byLoft_11 = PolySurface.ByLoft(join_12)

# group: 创建三跳散枓/交互枓底面
surfaces_4 = PolySurface.Surfaces(byLoft_5)
number_89 = DoubleInput(6)
getItemAtIndex_8 = List.GetItemAtIndex(list=surfaces_4, index=number_89)
number_90 = DoubleInput(0)
number_91 = DoubleInput(1)
pointAtParameter_55 = Surface.PointAtParameter(surface=getItemAtIndex_8, u=number_90, v=number_91)
x_draft_4 = CodeBlock(b=n01_b2) { b / 2; }
n04_b1_4 = DoubleInput(46)  # "04-b1"
y_draft_4 = CodeBlock(b=n04_b1_4) { b / 2; }
translate_4 = Geometry.Translate(geometry=pointAtParameter_55, xTranslation=x_draft_4, yTranslation=y_draft_4)
code_block_115 = CodeBlock(b1=n04_b1_4) { b1 / 2; }
code_block_116 = CodeBlock(p=translate_4, r=code_block_115) { createQuadCenter(p, r); }
byPatch_55 = Surface.ByPatch(code_block_116)

# group: 创建三跳散枓/交互枓的梯形
number_92 = DoubleInput(0)
number_93 = DoubleInput(0.5)
number_94 = DoubleInput(0)
pointAtParameter_56 = Surface.PointAtParameter(surface=byPatch_55, u=number_93, v=number_94)
code_block_117 = CodeBlock(d1=n04_b1_4) { d1; }
n04_b_7 = DoubleInput(70)  # "04-b"
n04_h1_7 = DoubleInput(17)  # "04-h1"
code_block_118 = CodeBlock(b=n04_b_7, b1=n04_b1_4) { (b - b1) / 2; }
string_36 = StringInput("y-")
code_block_119 = CodeBlock(center=pointAtParameter_56, d1=code_block_117, d2=n04_b_7, h=n04_h1_7, d=code_block_118, direction=string_36) { createTrape(center, d1, d2, h, d, direction); }
byPatch_56 = Surface.ByPatch(code_block_119)
number_95 = DoubleInput(0.5)
number_96 = DoubleInput(1)
pointAtParameter_57 = Surface.PointAtParameter(surface=byPatch_55, u=number_95, v=number_96)
string_37 = StringInput("y+")
code_block_120 = CodeBlock(center=pointAtParameter_57, d1=code_block_117, d2=n04_b_7, h=n04_h1_7, dy=code_block_118, direction=string_37) { createTrape(center, d1, d2, h ,dy, direction); }
byPatch_57 = Surface.ByPatch(code_block_120)
number_97 = DoubleInput(1)
number_98 = DoubleInput(0.5)
pointAtParameter_58 = Surface.PointAtParameter(surface=byPatch_55, u=number_97, v=number_98)
string_38 = StringInput("x+")
code_block_121 = CodeBlock(center=pointAtParameter_58, d1=code_block_117, d2=n04_b_7, h=n04_h1_7, dy=code_block_118, direction=string_38) { createTrape(center, d1, d2, h ,dy, direction); }
byPatch_58 = Surface.ByPatch(code_block_121)
number_99 = DoubleInput(0)
number_100 = DoubleInput(0.5)
pointAtParameter_59 = Surface.PointAtParameter(surface=byPatch_55, u=number_99, v=number_100)
string_39 = StringInput("x-")
code_block_122 = CodeBlock(center=pointAtParameter_59, d1=code_block_117, d2=n04_b_7, h=n04_h1_7, dy=code_block_118, direction=string_39) { createTrape(center, d1, d2, h ,dy, direction); }
byPatch_59 = Surface.ByPatch(code_block_122)

# group: 创建三跳散枓U型
number_101 = DoubleInput(0.5)
number_102 = DoubleInput(0)
pointAtParameter_60 = Surface.PointAtParameter(surface=byPatch_56, u=number_101, v=number_102)
n04_b_8 = DoubleInput(70)  # "04-b"
n04_b2_4 = DoubleInput(40)  # "04-b2"
n04_h_4 = DoubleInput(45)  # "04-h"
n04_h1_8 = DoubleInput(17)  # "04-h1"
code_block_123 = CodeBlock(h=n04_h_4, h1=n04_h1_8) { h - h1; }
n04_h2_4 = DoubleInput(18)  # "04-h2"
string_40 = StringInput("x")
code_block_124 = CodeBlock(center=pointAtParameter_60, w=n04_b_8, w1=n04_b2_4, h1=code_block_123, h2=n04_h2_4, cirection=string_40) { createUPlane(center, w, w1, h1, h2, cirection); }
byPatch_60 = Surface.ByPatch(code_block_124)
number_103 = DoubleInput(0.5)
number_104 = DoubleInput(1)
pointAtParameter_61 = Surface.PointAtParameter(surface=byPatch_57, u=number_103, v=number_104)
code_block_125 = CodeBlock(center=pointAtParameter_61, w=n04_b_8, w1=n04_b2_4, h1=code_block_123, h2=n04_h2_4, cirection=string_40) { createUPlane(center, w, w1, h1, h2, cirection); }
byPatch_61 = Surface.ByPatch(code_block_125)
number_105 = DoubleInput(0)
number_106 = DoubleInput(0.5)
pointAtParameter_62 = Surface.PointAtParameter(surface=byPatch_58, u=number_105, v=number_106)
number_107 = DoubleInput(0)
string_41 = StringInput("y")
code_block_126 = CodeBlock(center=pointAtParameter_62, w=n04_b_8, w1=n04_b2_4, h1=code_block_123, h2=number_107, cirection=string_41) { createUPlane(center, w, w1, h1, h2, cirection); }
byPatch_62 = Surface.ByPatch(code_block_126)
number_108 = DoubleInput(0)
number_109 = DoubleInput(0.5)
pointAtParameter_63 = Surface.PointAtParameter(surface=byPatch_59, u=number_108, v=number_109)
code_block_127 = CodeBlock(center=pointAtParameter_63, w=n04_b_8, w1=n04_b2_4, h1=code_block_123, h2=number_107, cirection=string_41) { createUPlane(center, w, w1, h1, h2, cirection); }
byPatch_63 = Surface.ByPatch(code_block_127)

# group: 创建三跳散枓/交互枓底面
surfaces_5 = PolySurface.Surfaces(byLoft_11)
number_110 = DoubleInput(6)
getItemAtIndex_9 = List.GetItemAtIndex(list=surfaces_5, index=number_110)
number_111 = DoubleInput(0)
number_112 = DoubleInput(1)
pointAtParameter_64 = Surface.PointAtParameter(surface=getItemAtIndex_9, u=number_111, v=number_112)
x_draft_5 = CodeBlock(b=n01_b2) { b / 2; }
n04_b1_5 = DoubleInput(46)  # "04-b1"
y_draft_5 = CodeBlock(b=n04_b1_5) { b / 2; }
translate_5 = Geometry.Translate(geometry=pointAtParameter_64, xTranslation=x_draft_5, yTranslation=y_draft_5)
code_block_128 = CodeBlock(b1=n04_b1_5) { b1 / 2; }
code_block_129 = CodeBlock(p=translate_5, r=code_block_128) { createQuadCenter(p, r); }
byPatch_64 = Surface.ByPatch(code_block_129)

# group: 创建三跳散枓/交互枓的梯形
number_113 = DoubleInput(0)
number_114 = DoubleInput(0.5)
number_115 = DoubleInput(1)
pointAtParameter_65 = Surface.PointAtParameter(surface=byPatch_64, u=number_114, v=number_115)
code_block_130 = CodeBlock(d1=n04_b1_5) { d1; }
n04_b_9 = DoubleInput(70)  # "04-b"
n04_h1_9 = DoubleInput(17)  # "04-h1"
code_block_131 = CodeBlock(b=n04_b_9, b1=n04_b1_5) { (b - b1) / 2; }
string_42 = StringInput("y+")
code_block_132 = CodeBlock(center=pointAtParameter_65, d1=code_block_130, d2=n04_b_9, h=n04_h1_9, dy=code_block_131, direction=string_42) { createTrape(center, d1, d2, h ,dy, direction); }
byPatch_65 = Surface.ByPatch(code_block_132)
number_116 = DoubleInput(1)
number_117 = DoubleInput(0.5)
pointAtParameter_66 = Surface.PointAtParameter(surface=byPatch_64, u=number_116, v=number_117)
string_43 = StringInput("x+")
code_block_133 = CodeBlock(center=pointAtParameter_66, d1=code_block_130, d2=n04_b_9, h=n04_h1_9, dy=code_block_131, direction=string_43) { createTrape(center, d1, d2, h ,dy, direction); }
byPatch_66 = Surface.ByPatch(code_block_133)
number_118 = DoubleInput(0)
number_119 = DoubleInput(0.5)
pointAtParameter_67 = Surface.PointAtParameter(surface=byPatch_64, u=number_118, v=number_119)
string_44 = StringInput("x-")
code_block_134 = CodeBlock(center=pointAtParameter_67, d1=code_block_130, d2=n04_b_9, h=n04_h1_9, dy=code_block_131, direction=string_44) { createTrape(center, d1, d2, h ,dy, direction); }
byPatch_67 = Surface.ByPatch(code_block_134)
number_120 = DoubleInput(0.5)
number_121 = DoubleInput(0)
pointAtParameter_68 = Surface.PointAtParameter(surface=byPatch_64, u=number_120, v=number_121)
string_45 = StringInput("y-")
code_block_135 = CodeBlock(center=pointAtParameter_68, d1=code_block_130, d2=n04_b_9, h=n04_h1_9, d=code_block_131, direction=string_45) { createTrape(center, d1, d2, h, d, direction); }
byPatch_68 = Surface.ByPatch(code_block_135)

# group: 创建三跳散枓U型面
number_122 = DoubleInput(0.5)
number_123 = DoubleInput(1)
pointAtParameter_69 = Surface.PointAtParameter(surface=byPatch_65, u=number_122, v=number_123)
n04_b_10 = DoubleInput(70)  # "04-b"
n04_b2_5 = DoubleInput(40)  # "04-b2"
n04_h_5 = DoubleInput(45)  # "04-h"
n04_h1_10 = DoubleInput(17)  # "04-h1"
code_block_136 = CodeBlock(h=n04_h_5, h1=n04_h1_10) { h - h1; }
n04_h2_5 = DoubleInput(18)  # "04-h2"
string_46 = StringInput("x")
code_block_137 = CodeBlock(center=pointAtParameter_69, w=n04_b_10, w1=n04_b2_5, h1=code_block_136, h2=n04_h2_5, cirection=string_46) { createUPlane(center, w, w1, h1, h2, cirection); }
byPatch_69 = Surface.ByPatch(code_block_137)
number_124 = DoubleInput(0)
number_125 = DoubleInput(0.5)
pointAtParameter_70 = Surface.PointAtParameter(surface=byPatch_66, u=number_124, v=number_125)
number_126 = DoubleInput(0)
string_47 = StringInput("y")
code_block_138 = CodeBlock(center=pointAtParameter_70, w=n04_b_10, w1=n04_b2_5, h1=code_block_136, h2=number_126, cirection=string_47) { createUPlane(center, w, w1, h1, h2, cirection); }
byPatch_70 = Surface.ByPatch(code_block_138)
number_127 = DoubleInput(0)
number_128 = DoubleInput(0.5)
pointAtParameter_71 = Surface.PointAtParameter(surface=byPatch_67, u=number_127, v=number_128)
code_block_139 = CodeBlock(center=pointAtParameter_71, w=n04_b_10, w1=n04_b2_5, h1=code_block_136, h2=number_126, cirection=string_47) { createUPlane(center, w, w1, h1, h2, cirection); }
byPatch_71 = Surface.ByPatch(code_block_139)
number_129 = DoubleInput(0.5)
number_130 = DoubleInput(0)
pointAtParameter_72 = Surface.PointAtParameter(surface=byPatch_68, u=number_129, v=number_130)
code_block_140 = CodeBlock(center=pointAtParameter_72, w=n04_b_10, w1=n04_b2_5, h1=code_block_136, h2=n04_h2_5, cirection=string_46) { createUPlane(center, w, w1, h1, h2, cirection); }
byPatch_72 = Surface.ByPatch(code_block_140)

# group: 创建三跳散枓/交互枓底面
surfaces_6 = PolySurface.Surfaces(byLoft_10)
number_131 = DoubleInput(6)
getItemAtIndex_10 = List.GetItemAtIndex(list=surfaces_6, index=number_131)
number_132 = DoubleInput(0)
number_133 = DoubleInput(1)
pointAtParameter_73 = Surface.PointAtParameter(surface=getItemAtIndex_10, u=number_132, v=number_133)
x_draft_6 = CodeBlock(b=n01_b2) { b / 2; }
n04_b1_6 = DoubleInput(46)  # "04-b1"
y_draft_6 = CodeBlock(b=n04_b1_6) { b / 2; }
code_block_141 = CodeBlock(y=y_draft_6) { -y; }
translate_6 = Geometry.Translate(geometry=pointAtParameter_73, xTranslation=x_draft_6, yTranslation=code_block_141)
code_block_142 = CodeBlock(b1=n04_b1_6) { b1 / 2; }
code_block_143 = CodeBlock(p=translate_6, r=code_block_142) { createQuadCenter(p, r); }
byPatch_73 = Surface.ByPatch(code_block_143)

# group: 创建三跳散枓/交互枓的梯形面
number_134 = DoubleInput(0)
number_135 = DoubleInput(1)
number_136 = DoubleInput(0.5)
pointAtParameter_74 = Surface.PointAtParameter(surface=byPatch_73, u=number_135, v=number_136)
code_block_144 = CodeBlock(d1=n04_b1_6) { d1; }
n04_b_11 = DoubleInput(68)  # "04-b"
n04_h1_11 = DoubleInput(17)  # "04-h1"
code_block_145 = CodeBlock(b=n04_b_11, b1=n04_b1_6) { (b - b1) / 2; }
string_48 = StringInput("x+")
code_block_146 = CodeBlock(center=pointAtParameter_74, d1=code_block_144, d2=n04_b_11, h=n04_h1_11, dy=code_block_145, direction=string_48) { createTrape(center, d1, d2, h ,dy, direction); }
byPatch_74 = Surface.ByPatch(code_block_146)
number_137 = DoubleInput(0.5)
number_138 = DoubleInput(0)
pointAtParameter_75 = Surface.PointAtParameter(surface=byPatch_73, u=number_137, v=number_138)
string_49 = StringInput("y-")
code_block_147 = CodeBlock(center=pointAtParameter_75, d1=code_block_144, d2=n04_b_11, h=n04_h1_11, d=code_block_145, direction=string_49) { createTrape(center, d1, d2, h, d, direction); }
byPatch_75 = Surface.ByPatch(code_block_147)
number_139 = DoubleInput(0)
number_140 = DoubleInput(0.5)
pointAtParameter_76 = Surface.PointAtParameter(surface=byPatch_73, u=number_139, v=number_140)
string_50 = StringInput("x-")
code_block_148 = CodeBlock(center=pointAtParameter_76, d1=code_block_144, d2=n04_b_11, h=n04_h1_11, dy=code_block_145, direction=string_50) { createTrape(center, d1, d2, h ,dy, direction); }
byPatch_76 = Surface.ByPatch(code_block_148)
number_141 = DoubleInput(0.5)
number_142 = DoubleInput(1)
pointAtParameter_77 = Surface.PointAtParameter(surface=byPatch_73, u=number_141, v=number_142)
string_51 = StringInput("y+")
code_block_149 = CodeBlock(center=pointAtParameter_77, d1=code_block_144, d2=n04_b_11, h=n04_h1_11, dy=code_block_145, direction=string_51) { createTrape(center, d1, d2, h ,dy, direction); }
byPatch_77 = Surface.ByPatch(code_block_149)

# group: 创建三跳散枓U型面
number_143 = DoubleInput(0)
number_144 = DoubleInput(0.5)
pointAtParameter_78 = Surface.PointAtParameter(surface=byPatch_74, u=number_143, v=number_144)
n04_b_12 = DoubleInput(70)  # "04-b"
n04_b2_6 = DoubleInput(40)  # "04-b2"
n04_h_6 = DoubleInput(45)  # "04-h"
n04_h1_12 = DoubleInput(17)  # "04-h1"
code_block_150 = CodeBlock(h=n04_h_6, h1=n04_h1_12) { h - h1; }
number_145 = DoubleInput(0)
string_52 = StringInput("y")
code_block_151 = CodeBlock(center=pointAtParameter_78, w=n04_b_12, w1=n04_b2_6, h1=code_block_150, h2=number_145, cirection=string_52) { createUPlane(center, w, w1, h1, h2, cirection); }
byPatch_78 = Surface.ByPatch(code_block_151)
number_146 = DoubleInput(0.5)
number_147 = DoubleInput(0)
pointAtParameter_79 = Surface.PointAtParameter(surface=byPatch_75, u=number_146, v=number_147)
n04_h2_6 = DoubleInput(18)  # "04-h2"
string_53 = StringInput("x")
code_block_152 = CodeBlock(center=pointAtParameter_79, w=n04_b_12, w1=n04_b2_6, h1=code_block_150, h2=n04_h2_6, cirection=string_53) { createUPlane(center, w, w1, h1, h2, cirection); }
byPatch_79 = Surface.ByPatch(code_block_152)
number_148 = DoubleInput(0)
number_149 = DoubleInput(0.5)
pointAtParameter_80 = Surface.PointAtParameter(surface=byPatch_76, u=number_148, v=number_149)
code_block_153 = CodeBlock(center=pointAtParameter_80, w=n04_b_12, w1=n04_b2_6, h1=code_block_150, h2=number_145, cirection=string_52) { createUPlane(center, w, w1, h1, h2, cirection); }
byPatch_80 = Surface.ByPatch(code_block_153)
number_150 = DoubleInput(0.5)
number_151 = DoubleInput(1)
pointAtParameter_81 = Surface.PointAtParameter(surface=byPatch_77, u=number_150, v=number_151)
code_block_154 = CodeBlock(center=pointAtParameter_81, w=n04_b_12, w1=n04_b2_6, h1=code_block_150, h2=n04_h2_6, cirection=string_53) { createUPlane(center, w, w1, h1, h2, cirection); }
byPatch_81 = Surface.ByPatch(code_block_154)

# group: 创建三跳散枓/交互枓底面
surfaces_7 = PolySurface.Surfaces(byLoft_6)
number_152 = DoubleInput(6)
getItemAtIndex_11 = List.GetItemAtIndex(list=surfaces_7, index=number_152)
number_153 = DoubleInput(0)
number_154 = DoubleInput(1)
pointAtParameter_82 = Surface.PointAtParameter(surface=getItemAtIndex_11, u=number_153, v=number_154)
x_draft_7 = CodeBlock(b=n01_b2) { b / 2; }
n04_b1_7 = DoubleInput(46)  # "04-b1"
y_draft_7 = CodeBlock(b=n04_b1_7) { b / 2; }
code_block_155 = CodeBlock(y=y_draft_7) { -y; }
translate_7 = Geometry.Translate(geometry=pointAtParameter_82, xTranslation=x_draft_7, yTranslation=code_block_155)
code_block_156 = CodeBlock(b1=n04_b1_7) { b1 / 2; }
code_block_157 = CodeBlock(p=translate_7, r=code_block_156) { createQuadCenter(p, r); }
byPatch_82 = Surface.ByPatch(code_block_157)

# group: 创建三跳散枓/交互枓的梯形面
number_155 = DoubleInput(0)
number_156 = DoubleInput(1)
number_157 = DoubleInput(0.5)
pointAtParameter_83 = Surface.PointAtParameter(surface=byPatch_82, u=number_156, v=number_157)
code_block_158 = CodeBlock(d1=n04_b1_7) { d1; }
n04_b_13 = DoubleInput(68)  # "04-b"
n04_h1_13 = DoubleInput(17)  # "04-h1"
code_block_159 = CodeBlock(b=n04_b_13, b1=n04_b1_7) { (b - b1) / 2; }
string_54 = StringInput("x+")
code_block_160 = CodeBlock(center=pointAtParameter_83, d1=code_block_158, d2=n04_b_13, h=n04_h1_13, dy=code_block_159, direction=string_54) { createTrape(center, d1, d2, h ,dy, direction); }
byPatch_83 = Surface.ByPatch(code_block_160)
number_158 = DoubleInput(0.5)
number_159 = DoubleInput(0)
pointAtParameter_84 = Surface.PointAtParameter(surface=byPatch_82, u=number_158, v=number_159)
string_55 = StringInput("y-")
code_block_161 = CodeBlock(center=pointAtParameter_84, d1=code_block_158, d2=n04_b_13, h=n04_h1_13, d=code_block_159, direction=string_55) { createTrape(center, d1, d2, h, d, direction); }
byPatch_84 = Surface.ByPatch(code_block_161)
number_160 = DoubleInput(0)
number_161 = DoubleInput(0.5)
pointAtParameter_85 = Surface.PointAtParameter(surface=byPatch_82, u=number_160, v=number_161)
string_56 = StringInput("x-")
code_block_162 = CodeBlock(center=pointAtParameter_85, d1=code_block_158, d2=n04_b_13, h=n04_h1_13, dy=code_block_159, direction=string_56) { createTrape(center, d1, d2, h ,dy, direction); }
byPatch_85 = Surface.ByPatch(code_block_162)
number_162 = DoubleInput(0.5)
number_163 = DoubleInput(1)
pointAtParameter_86 = Surface.PointAtParameter(surface=byPatch_82, u=number_162, v=number_163)
string_57 = StringInput("y+")
code_block_163 = CodeBlock(center=pointAtParameter_86, d1=code_block_158, d2=n04_b_13, h=n04_h1_13, dy=code_block_159, direction=string_57) { createTrape(center, d1, d2, h ,dy, direction); }
byPatch_86 = Surface.ByPatch(code_block_163)

# group: 创建三跳散枓U型面
number_164 = DoubleInput(0)
number_165 = DoubleInput(0.5)
pointAtParameter_87 = Surface.PointAtParameter(surface=byPatch_83, u=number_164, v=number_165)
n04_b_14 = DoubleInput(70)  # "04-b"
n04_b2_7 = DoubleInput(40)  # "04-b2"
n04_h_7 = DoubleInput(45)  # "04-h"
n04_h1_14 = DoubleInput(17)  # "04-h1"
code_block_164 = CodeBlock(h=n04_h_7, h1=n04_h1_14) { h - h1; }
number_166 = DoubleInput(0)
string_58 = StringInput("y")
code_block_165 = CodeBlock(center=pointAtParameter_87, w=n04_b_14, w1=n04_b2_7, h1=code_block_164, h2=number_166, cirection=string_58) { createUPlane(center, w, w1, h1, h2, cirection); }
byPatch_87 = Surface.ByPatch(code_block_165)
number_167 = DoubleInput(0.5)
number_168 = DoubleInput(0)
pointAtParameter_88 = Surface.PointAtParameter(surface=byPatch_84, u=number_167, v=number_168)
n04_h2_7 = DoubleInput(18)  # "04-h2"
string_59 = StringInput("x")
code_block_166 = CodeBlock(center=pointAtParameter_88, w=n04_b_14, w1=n04_b2_7, h1=code_block_164, h2=n04_h2_7, cirection=string_59) { createUPlane(center, w, w1, h1, h2, cirection); }
byPatch_88 = Surface.ByPatch(code_block_166)
number_169 = DoubleInput(0)
number_170 = DoubleInput(0.5)
pointAtParameter_89 = Surface.PointAtParameter(surface=byPatch_85, u=number_169, v=number_170)
code_block_167 = CodeBlock(center=pointAtParameter_89, w=n04_b_14, w1=n04_b2_7, h1=code_block_164, h2=number_166, cirection=string_58) { createUPlane(center, w, w1, h1, h2, cirection); }
byPatch_89 = Surface.ByPatch(code_block_167)
number_171 = DoubleInput(0.5)
number_172 = DoubleInput(1)
pointAtParameter_90 = Surface.PointAtParameter(surface=byPatch_86, u=number_171, v=number_172)
code_block_168 = CodeBlock(center=pointAtParameter_90, w=n04_b_14, w1=n04_b2_7, h1=code_block_164, h2=n04_h2_7, cirection=string_59) { createUPlane(center, w, w1, h1, h2, cirection); }
byPatch_90 = Surface.ByPatch(code_block_168)

# group: 创建三跳散枓/交互枓底面
surfaces_8 = PolySurface.Surfaces(byLoft_7)
number_173 = DoubleInput(6)
getItemAtIndex_12 = List.GetItemAtIndex(list=surfaces_8, index=number_173)
number_174 = DoubleInput(0)
number_175 = DoubleInput(1)
pointAtParameter_91 = Surface.PointAtParameter(surface=getItemAtIndex_12, u=number_174, v=number_175)
n04_b1_8 = DoubleInput(46)  # "04-b1"
x_draft_8 = CodeBlock(b=n04_b1_8) { b / 2; }
code_block_169 = CodeBlock(x=x_draft_8) { -x; }
y_draft_8 = CodeBlock(b=n01_b2) { b / 2; }
translate_8 = Geometry.Translate(geometry=pointAtParameter_91, xTranslation=code_block_169, yTranslation=y_draft_8)
code_block_170 = CodeBlock(b1=n04_b1_8) { b1 / 2; }
code_block_171 = CodeBlock(p=translate_8, r=code_block_170) { createQuadCenter(p, r); }
byPatch_91 = Surface.ByPatch(code_block_171)

# group: 创建三跳散枓/交互枓的梯形面
number_176 = DoubleInput(0)
number_177 = DoubleInput(0)
number_178 = DoubleInput(0.5)
pointAtParameter_92 = Surface.PointAtParameter(surface=byPatch_91, u=number_177, v=number_178)
code_block_172 = CodeBlock(d1=n04_b1_8) { d1; }
n04_b_15 = DoubleInput(68)  # "04-b"
n04_h1_15 = DoubleInput(17)  # "04-h1"
code_block_173 = CodeBlock(b=n04_b_15, b1=n04_b1_8) { (b - b1) / 2; }
string_60 = StringInput("x-")
code_block_174 = CodeBlock(center=pointAtParameter_92, d1=code_block_172, d2=n04_b_15, h=n04_h1_15, dy=code_block_173, direction=string_60) { createTrape(center, d1, d2, h ,dy, direction); }
byPatch_92 = Surface.ByPatch(code_block_174)
number_179 = DoubleInput(0.5)
number_180 = DoubleInput(0)
pointAtParameter_93 = Surface.PointAtParameter(surface=byPatch_91, u=number_179, v=number_180)
string_61 = StringInput("y-")
code_block_175 = CodeBlock(center=pointAtParameter_93, d1=code_block_172, d2=n04_b_15, h=n04_h1_15, d=code_block_173, direction=string_61) { createTrape(center, d1, d2, h, d, direction); }
byPatch_93 = Surface.ByPatch(code_block_175)
number_181 = DoubleInput(0.5)
number_182 = DoubleInput(1)
pointAtParameter_94 = Surface.PointAtParameter(surface=byPatch_91, u=number_181, v=number_182)
string_62 = StringInput("y+")
code_block_176 = CodeBlock(center=pointAtParameter_94, d1=code_block_172, d2=n04_b_15, h=n04_h1_15, dy=code_block_173, direction=string_62) { createTrape(center, d1, d2, h ,dy, direction); }
byPatch_94 = Surface.ByPatch(code_block_176)
number_183 = DoubleInput(1)
number_184 = DoubleInput(0.5)
pointAtParameter_95 = Surface.PointAtParameter(surface=byPatch_91, u=number_183, v=number_184)
string_63 = StringInput("x+")
code_block_177 = CodeBlock(center=pointAtParameter_95, d1=code_block_172, d2=n04_b_15, h=n04_h1_15, dy=code_block_173, direction=string_63) { createTrape(center, d1, d2, h ,dy, direction); }
byPatch_95 = Surface.ByPatch(code_block_177)

# group: 创建三跳散枓U型面
number_185 = DoubleInput(0)
number_186 = DoubleInput(0)
number_187 = DoubleInput(0.5)
pointAtParameter_96 = Surface.PointAtParameter(surface=byPatch_92, u=number_186, v=number_187)
n04_b_16 = DoubleInput(70)  # "04-b"
n04_b2_8 = DoubleInput(40)  # "04-b2"
n04_h_8 = DoubleInput(45)  # "04-h"
n04_h1_16 = DoubleInput(17)  # "04-h1"
code_block_178 = CodeBlock(h=n04_h_8, h1=n04_h1_16) { h - h1; }
n04_h2_8 = DoubleInput(18)  # "04-h2"
string_64 = StringInput("y")
code_block_179 = CodeBlock(center=pointAtParameter_96, w=n04_b_16, w1=n04_b2_8, h1=code_block_178, h2=n04_h2_8, cirection=string_64) { createUPlane(center, w, w1, h1, h2, cirection); }
byPatch_96 = Surface.ByPatch(code_block_179)
number_188 = DoubleInput(0.5)
number_189 = DoubleInput(0)
pointAtParameter_97 = Surface.PointAtParameter(surface=byPatch_93, u=number_188, v=number_189)
string_65 = StringInput("x")
code_block_180 = CodeBlock(center=pointAtParameter_97, w=n04_b_16, w1=n04_b2_8, h1=code_block_178, h2=n04_h2_8, cirection=string_65) { createUPlane(center, w, w1, h1, h2, cirection); }
byPatch_97 = Surface.ByPatch(code_block_180)
number_190 = DoubleInput(0.5)
number_191 = DoubleInput(1)
pointAtParameter_98 = Surface.PointAtParameter(surface=byPatch_94, u=number_190, v=number_191)
code_block_181 = CodeBlock(center=pointAtParameter_98, w=n04_b_16, w1=n04_b2_8, h1=code_block_178, h2=n04_h2_8, cirection=string_65) { createUPlane(center, w, w1, h1, h2, cirection); }
byPatch_98 = Surface.ByPatch(code_block_181)
number_192 = DoubleInput(0)
number_193 = DoubleInput(0.5)
pointAtParameter_99 = Surface.PointAtParameter(surface=byPatch_95, u=number_192, v=number_193)
code_block_182 = CodeBlock(center=pointAtParameter_99, w=n04_b_16, w1=n04_b2_8, h1=code_block_178, h2=n04_h2_8, cirection=string_64) { createUPlane(center, w, w1, h1, h2, cirection); }
byPatch_99 = Surface.ByPatch(code_block_182)

n07_b = DoubleInput(220)  # "07-b"

# group: 创建三跳卷杀部分
code_block_183 = CodeBlock(h2=n04_h2, h1=code_block_41) { h2 / h1; }
code_block_184 = CodeBlock(b=n04_b, b2=n04_b2) { ((b - b2) / 2) + b2; }
code_block_185 = CodeBlock(w1=code_block_184, w=n04_b) { w1 / w; }
pointAtParameter_100 = Surface.PointAtParameter(surface=byPatch_72, u=code_block_183, v=code_block_185)
n10_b1 = DoubleInput(60)  # "10-b1"
n10_b = DoubleInput(413)  # "10-b"
code_block_186 = CodeBlock(b=n10_b, b1=n10_b1, b_07=n07_b, d_04=code_block_36) { ((b - 2 * b1) - b_07 - 2 * d_04) / 2; }
number_194 = DoubleInput(4)
n10_h1 = DoubleInput(32)  # "10-h1"
n10_h = DoubleInput(64)  # "10-h"
string_66 = StringInput("y-")
code_block_187 = CodeBlock(p=pointAtParameter_100, b1=n10_b1, b2=code_block_186, m=number_194, h1=n10_h1, h=n10_h, direc=string_66) { createJuanshaCurve(p, b1, b2, m, h1, h, direc); }
byPatch_100 = Surface.ByPatch(code_block_187)
code_block_188 = CodeBlock(w1=code_block_184, w=n04_b) { 1 - w1 / w; }
pointAtParameter_101 = Surface.PointAtParameter(surface=byPatch_72, u=code_block_183, v=code_block_188)
code_block_189 = CodeBlock(p=pointAtParameter_101, b1=n10_b1, b2=code_block_186, m=number_194, h1=n10_h1, h=n10_h, direc=string_66) { createJuanshaCurve(p, b1, b2, m, h1, h, direc); }
byPatch_101 = Surface.ByPatch(code_block_189)
join_13 = List.Join(code_block_187, code_block_189)
byLoft_12 = PolySurface.ByLoft(join_13)

number_195 = DoubleInput(0)
number_196 = DoubleInput(0)

# group: 创建三跳卷杀部分
code_block_190 = CodeBlock(h2=n04_h2, h1=code_block_41) { h2 / h1; }
code_block_191 = CodeBlock(b=n04_b, b2=n04_b2) { ((b - b2) / 2) + b2; }
code_block_192 = CodeBlock(w1=code_block_191, w=n04_b) { w1 / w; }
pointAtParameter_102 = Surface.PointAtParameter(surface=byPatch_81, u=code_block_190, v=code_block_192)
n10_b1_2 = DoubleInput(60)  # "10-b1"
n10_b_2 = DoubleInput(413)  # "10-b"
code_block_193 = CodeBlock(b=n10_b_2, b1=n10_b1_2, b_07=n07_b, d_04=code_block_36) { ((b - 2 * b1) - b_07 - 2 * d_04) / 2; }
number_197 = DoubleInput(4)
n10_h1_2 = DoubleInput(32)  # "10-h1"
n10_h_2 = DoubleInput(64)  # "10-h"
string_67 = StringInput("y+")
code_block_194 = CodeBlock(p=pointAtParameter_102, b1=n10_b1_2, b2=code_block_193, m=number_197, h1=n10_h1_2, h=n10_h_2, direc=string_67) { createJuanshaCurve(p, b1, b2, m, h1, h, direc); }
byPatch_102 = Surface.ByPatch(code_block_194)
code_block_195 = CodeBlock(w1=code_block_191, w=n04_b) { 1 - w1 / w; }
pointAtParameter_103 = Surface.PointAtParameter(surface=byPatch_81, u=code_block_190, v=code_block_195)
code_block_196 = CodeBlock(p=pointAtParameter_103, b1=n10_b1_2, b2=code_block_193, m=number_197, h1=n10_h1_2, h=n10_h_2, direc=string_67) { createJuanshaCurve(p, b1, b2, m, h1, h, direc); }
byPatch_103 = Surface.ByPatch(code_block_196)
join_14 = List.Join(code_block_194, code_block_196)
byLoft_13 = PolySurface.ByLoft(join_14)

n08_t = DoubleInput(40)  # "08-t"

# group: 创建三跳卷杀部分
code_block_197 = CodeBlock(h2=n04_h2, h1=code_block_41) { h2 / h1; }
code_block_198 = CodeBlock(b=n04_b, b2=n04_b2) { ((b - b2) / 2) + b2; }
code_block_199 = CodeBlock(w1=code_block_198, w=n04_b) { w1 / w; }
pointAtParameter_104 = Surface.PointAtParameter(surface=byPatch_97, u=code_block_197, v=code_block_199)
n11_b1 = DoubleInput(60)  # "11-b1"
n11_b = DoubleInput(256)  # "11-b"
code_block_200 = CodeBlock(b=n11_b, b1=n11_b1, t_08=n08_t, d_04=code_block_36) { ((b - 2 * b1) - t_08 - 2 * d_04) / 2; }
number_198 = DoubleInput(4)
n11_h1 = DoubleInput(32)  # "11-h1"
n11_h = DoubleInput(64)  # "11-h"
string_68 = StringInput("y-")
code_block_201 = CodeBlock(p=pointAtParameter_104, b1=n11_b1, b2=code_block_200, m=number_198, h1=n11_h1, h=n11_h, direc=string_68) { createJuanshaCurve(p, b1, b2, m, h1, h, direc); }
byPatch_104 = Surface.ByPatch(code_block_201)
code_block_202 = CodeBlock(w1=code_block_198, w=n04_b) { 1 - w1 / w; }
pointAtParameter_105 = Surface.PointAtParameter(surface=byPatch_97, u=code_block_197, v=code_block_202)
code_block_203 = CodeBlock(p=pointAtParameter_105, b1=n11_b1, b2=code_block_200, m=number_198, h1=n11_h1, h=n11_h, direc=string_68) { createJuanshaCurve(p, b1, b2, m, h1, h, direc); }
byPatch_105 = Surface.ByPatch(code_block_203)
join_15 = List.Join(code_block_201, code_block_203)
byLoft_14 = PolySurface.ByLoft(join_15)

# group: 创建三跳卷杀部分
code_block_204 = CodeBlock(h2=n04_h2, h1=code_block_41) { h2 / h1; }
code_block_205 = CodeBlock(b=n04_b, b2=n04_b2) { ((b - b2) / 2) + b2; }
code_block_206 = CodeBlock(w1=code_block_205, w=n04_b) { w1 / w; }
pointAtParameter_106 = Surface.PointAtParameter(surface=byPatch_98, u=code_block_204, v=code_block_206)
n11_b1_2 = DoubleInput(60)  # "11-b1"
n11_b_2 = DoubleInput(256)  # "11-b"
code_block_207 = CodeBlock(b=n11_b_2, b1=n11_b1_2, t_08=n08_t, d_04=code_block_36) { ((b - 2 * b1) - t_08 - 2 * d_04) / 2; }
number_199 = DoubleInput(4)
n11_h1_2 = DoubleInput(32)  # "11-h1"
n11_h_2 = DoubleInput(64)  # "11-h"
string_69 = StringInput("y+")
code_block_208 = CodeBlock(p=pointAtParameter_106, b1=n11_b1_2, b2=code_block_207, m=number_199, h1=n11_h1_2, h=n11_h_2, direc=string_69) { createJuanshaCurve(p, b1, b2, m, h1, h, direc); }
byPatch_106 = Surface.ByPatch(code_block_208)
code_block_209 = CodeBlock(w1=code_block_205, w=n04_b) { 1 - w1 / w; }
pointAtParameter_107 = Surface.PointAtParameter(surface=byPatch_98, u=code_block_204, v=code_block_209)
code_block_210 = CodeBlock(p=pointAtParameter_107, b1=n11_b1_2, b2=code_block_207, m=number_199, h1=n11_h1_2, h=n11_h_2, direc=string_69) { createJuanshaCurve(p, b1, b2, m, h1, h, direc); }
byPatch_107 = Surface.ByPatch(code_block_210)
join_16 = List.Join(code_block_208, code_block_210)
byLoft_15 = PolySurface.ByLoft(join_16)

# group: 创建三跳卷杀部分
code_block_211 = CodeBlock(h2=n04_h2, h1=code_block_41) { h2 / h1; }
code_block_212 = CodeBlock(b=n04_b, b2=n04_b2) { ((b - b2) / 2) + b2; }
code_block_213 = CodeBlock(w1=code_block_212, w=n04_b) { w1 / w; }
pointAtParameter_108 = Surface.PointAtParameter(surface=byPatch_99, u=code_block_211, v=code_block_213)
n12_b1 = DoubleInput(60)  # "12-b1"
n12_b2 = DoubleInput(92)  # "12-b2"
code_block_214 = CodeBlock(b2=n12_b2, b1=n12_b1, b_04=n04_b_6, w1_04=code_block_212) { b2 - b1 - (b_04 - w1_04); }
number_200 = DoubleInput(4)
n12_h1 = DoubleInput(32)  # "12-h1"
n12_h = DoubleInput(64)  # "12-h"
string_70 = StringInput("x+")
code_block_215 = CodeBlock(p=pointAtParameter_108, b1=n12_b1, b2=code_block_214, m=number_200, h1=n12_h1, h=n12_h, direc=string_70) { createJuanshaCurve(p, b1, b2, m, h1, h, direc); }
byPatch_108 = Surface.ByPatch(code_block_215)
code_block_216 = CodeBlock(w1=code_block_212, w=n04_b) { 1 - w1 / w; }
pointAtParameter_109 = Surface.PointAtParameter(surface=byPatch_99, u=code_block_211, v=code_block_216)
code_block_217 = CodeBlock(p=pointAtParameter_109, b1=n12_b1, b2=code_block_214, m=number_200, h1=n12_h1, h=n12_h, direc=string_70) { createJuanshaCurve(p, b1, b2, m, h1, h, direc); }
byPatch_109 = Surface.ByPatch(code_block_217)
join_17 = List.Join(code_block_215, code_block_217)
byLoft_16 = PolySurface.ByLoft(join_17)

# group: 创建三跳中间柱形体
surfaces_9 = PolySurface.Surfaces(byLoft_14)
number_201 = DoubleInput(7)
getItemAtIndex_13 = List.GetItemAtIndex(list=surfaces_9, index=number_201)
perimeterCurves_4 = Surface.PerimeterCurves(getItemAtIndex_13)
byJoinedCurves_5 = PolyCurve.ByJoinedCurves(perimeterCurves_4)
surfaces_10 = PolySurface.Surfaces(byLoft_15)
number_202 = DoubleInput(7)
getItemAtIndex_14 = List.GetItemAtIndex(list=surfaces_10, index=number_202)
perimeterCurves_5 = Surface.PerimeterCurves(getItemAtIndex_14)
byJoinedCurves_6 = PolyCurve.ByJoinedCurves(perimeterCurves_5)
join_18 = List.Join(byJoinedCurves_5, byJoinedCurves_6)
byLoft_17 = PolySurface.ByLoft(join_18)

# group: 创建三跳中间柱形体
surfaces_11 = PolySurface.Surfaces(byLoft_12)
number_203 = DoubleInput(7)
getItemAtIndex_15 = List.GetItemAtIndex(list=surfaces_11, index=number_203)
perimeterCurves_6 = Surface.PerimeterCurves(getItemAtIndex_15)
byJoinedCurves_7 = PolyCurve.ByJoinedCurves(perimeterCurves_6)
surfaces_12 = PolySurface.Surfaces(byLoft_13)
number_204 = DoubleInput(7)
getItemAtIndex_16 = List.GetItemAtIndex(list=surfaces_12, index=number_204)
perimeterCurves_7 = Surface.PerimeterCurves(getItemAtIndex_16)
byJoinedCurves_8 = PolyCurve.ByJoinedCurves(perimeterCurves_7)
join_19 = List.Join(byJoinedCurves_7, byJoinedCurves_8)
byLoft_18 = PolySurface.ByLoft(join_19)

# group: 创建三跳单卷杀栱长方体部分
surfaces_13 = PolySurface.Surfaces(byLoft_16)
number_205 = DoubleInput(7)
getItemAtIndex_17 = List.GetItemAtIndex(list=surfaces_13, index=number_205)
perimeterCurves_8 = Surface.PerimeterCurves(getItemAtIndex_17)
byJoinedCurves_9 = PolyCurve.ByJoinedCurves(perimeterCurves_8)
number_206 = DoubleInput(0)
getItemAtIndex_18 = List.GetItemAtIndex(list=perimeterCurves_8, index=number_206)
n12_b = DoubleInput(632)  # "12-b"
code_block_218 = CodeBlock(b=n12_b, b1=n12_b1, d=code_block_214) { b - b1 - d; }
string_71 = StringInput("x-")
code_block_219 = CodeBlock(curve=getItemAtIndex_18, width=code_block_218, direction=string_71) { createCubiod(curve, width, direction); }
number_207 = DoubleInput(1)
getItemAtIndex_19 = List.GetItemAtIndex(list=perimeterCurves_8, index=number_207)
code_block_220 = CodeBlock(curve=getItemAtIndex_19, width=code_block_218, direction=string_71) { createCubiod(curve, width, direction); }
number_208 = DoubleInput(2)
getItemAtIndex_20 = List.GetItemAtIndex(list=perimeterCurves_8, index=number_208)
code_block_221 = CodeBlock(curve=getItemAtIndex_20, width=code_block_218, direction=string_71) { createCubiod(curve, width, direction); }
number_209 = DoubleInput(3)
getItemAtIndex_21 = List.GetItemAtIndex(list=perimeterCurves_8, index=number_209)
code_block_222 = CodeBlock(curve=getItemAtIndex_21, width=code_block_218, direction=string_71) { createCubiod(curve, width, direction); }
join_20 = List.Join(code_block_219, code_block_220, code_block_221, code_block_222)
byJoinedCurves_10 = PolyCurve.ByJoinedCurves(join_20)
join_21 = List.Join(byJoinedCurves_9, byJoinedCurves_10)
byLoft_19 = Solid.ByLoft(join_21)

# group: 创建三跳柱头枋
code_block_223 = CodeBlock()
# ---------- code_block_223.designscript (14 lines) ----------
//获取创建枋类构件的中心点
//p_center->与坊正交的栱的长方体部分的质心
//p_down->栌枓的内角点
//dh->与坊正交的栱的高的一半
def getNDGFangCenterPoint(p_center, p_down, dh)
{
 x1 = 0;
 y1 = 0;
 z1 = p_down.Z + (p_center.Z + dh - p_down.Z) / 2;

 p1 = Point.ByCoordinates(x1, y1, z1);

 return = p1;
};
# ----------------------------------------
centroid = Solid.Centroid(byLoft_19)
code_block_224 = CodeBlock(h2=n04_h2, h1=code_block_41) { h2 / h1; }
code_block_225 = CodeBlock(b=n04_b, b2=n04_b2) { ((b - b2) / 2) + b2; }
code_block_226 = CodeBlock(w1=code_block_225, w=n04_b) { w1 / w; }
pointAtParameter_110 = Surface.PointAtParameter(surface=byPatch_90, u=code_block_224, v=code_block_226)
n12_h_2 = DoubleInput(60)  # "12-h"
code_block_227 = CodeBlock(h=n12_h_2) { h / 2; }
code_block_228 = CodeBlock(p_center=centroid, p_down=pointAtParameter_110, dh=code_block_227) { getNDGFangCenterPoint(p_center, p_down, dh); }
n09_t = DoubleInput(40)  # "09-t"
n09_b = DoubleInput(568)  # "09-b"
n09_h = DoubleInput(60)  # "09-h"
byLengths = Cuboid.ByLengths(origin=code_block_228, width=n09_t, length=n09_b, height=n09_h)

# group: 创建四跳散枓/交互枓底面
number_210 = DoubleInput(0.5)
number_211 = DoubleInput(0.5)
pointAtParameter_111 = Surface.PointAtParameter(surface=byPatch_55, u=number_210, v=number_211)
code_block_229 = CodeBlock(h_04=n04_h, h2_04=n04_h2, h_09=n09_h) { (h_04 - h2_04) + h_09; }
translate_9 = Geometry.Translate(geometry=pointAtParameter_111, zTranslation=code_block_229)
n04_b1_9 = DoubleInput(46)  # "04-b1"
code_block_230 = CodeBlock(b1=n04_b1_9) { b1 / 2; }
code_block_231 = CodeBlock(p=translate_9, r=code_block_230) { createQuadCenter(p, r); }
byPatch_110 = Surface.ByPatch(code_block_231)

# group: 创建三跳散枓/交互枓的梯形
number_212 = DoubleInput(0)
number_213 = DoubleInput(0.5)
number_214 = DoubleInput(0)
pointAtParameter_112 = Surface.PointAtParameter(surface=byPatch_110, u=number_213, v=number_214)
code_block_232 = CodeBlock(d1=n04_b1_4) { d1; }
n04_b_17 = DoubleInput(70)  # "04-b"
n04_h1_17 = DoubleInput(17)  # "04-h1"
code_block_233 = CodeBlock(b=n04_b_17, b1=n04_b1_4) { (b - b1) / 2; }
string_72 = StringInput("y-")
code_block_234 = CodeBlock(center=pointAtParameter_112, d1=code_block_232, d2=n04_b_17, h=n04_h1_17, d=code_block_233, direction=string_72) { createTrape(center, d1, d2, h, d, direction); }
byPatch_111 = Surface.ByPatch(code_block_234)
number_215 = DoubleInput(0.5)
number_216 = DoubleInput(1)
pointAtParameter_113 = Surface.PointAtParameter(surface=byPatch_110, u=number_215, v=number_216)
string_73 = StringInput("y+")
code_block_235 = CodeBlock(center=pointAtParameter_113, d1=code_block_232, d2=n04_b_17, h=n04_h1_17, dy=code_block_233, direction=string_73) { createTrape(center, d1, d2, h ,dy, direction); }
byPatch_112 = Surface.ByPatch(code_block_235)
number_217 = DoubleInput(1)
number_218 = DoubleInput(0.5)
pointAtParameter_114 = Surface.PointAtParameter(surface=byPatch_110, u=number_217, v=number_218)
string_74 = StringInput("x+")
code_block_236 = CodeBlock(center=pointAtParameter_114, d1=code_block_232, d2=n04_b_17, h=n04_h1_17, dy=code_block_233, direction=string_74) { createTrape(center, d1, d2, h ,dy, direction); }
byPatch_113 = Surface.ByPatch(code_block_236)
number_219 = DoubleInput(0)
number_220 = DoubleInput(0.5)
pointAtParameter_115 = Surface.PointAtParameter(surface=byPatch_110, u=number_219, v=number_220)
string_75 = StringInput("x-")
code_block_237 = CodeBlock(center=pointAtParameter_115, d1=code_block_232, d2=n04_b_17, h=n04_h1_17, dy=code_block_233, direction=string_75) { createTrape(center, d1, d2, h ,dy, direction); }
byPatch_114 = Surface.ByPatch(code_block_237)

# group: 创建三跳散枓U型
number_221 = DoubleInput(0.5)
number_222 = DoubleInput(0)
pointAtParameter_116 = Surface.PointAtParameter(surface=byPatch_111, u=number_221, v=number_222)
n04_b_18 = DoubleInput(70)  # "04-b"
n04_b2_9 = DoubleInput(40)  # "04-b2"
n04_h_9 = DoubleInput(45)  # "04-h"
n04_h1_18 = DoubleInput(17)  # "04-h1"
code_block_238 = CodeBlock(h=n04_h_9, h1=n04_h1_18) { h - h1; }
n04_h2_9 = DoubleInput(18)  # "04-h2"
string_76 = StringInput("x")
code_block_239 = CodeBlock(center=pointAtParameter_116, w=n04_b_18, w1=n04_b2_9, h1=code_block_238, h2=n04_h2_9, cirection=string_76) { createUPlane(center, w, w1, h1, h2, cirection); }
byPatch_115 = Surface.ByPatch(code_block_239)
number_223 = DoubleInput(0.5)
number_224 = DoubleInput(1)
pointAtParameter_117 = Surface.PointAtParameter(surface=byPatch_112, u=number_223, v=number_224)
code_block_240 = CodeBlock(center=pointAtParameter_117, w=n04_b_18, w1=n04_b2_9, h1=code_block_238, h2=n04_h2_9, cirection=string_76) { createUPlane(center, w, w1, h1, h2, cirection); }
byPatch_116 = Surface.ByPatch(code_block_240)
number_225 = DoubleInput(0)
number_226 = DoubleInput(0.5)
pointAtParameter_118 = Surface.PointAtParameter(surface=byPatch_113, u=number_225, v=number_226)
number_227 = DoubleInput(0)
string_77 = StringInput("y")
code_block_241 = CodeBlock(center=pointAtParameter_118, w=n04_b_18, w1=n04_b2_9, h1=code_block_238, h2=number_227, cirection=string_77) { createUPlane(center, w, w1, h1, h2, cirection); }
byPatch_117 = Surface.ByPatch(code_block_241)
number_228 = DoubleInput(0)
number_229 = DoubleInput(0.5)
pointAtParameter_119 = Surface.PointAtParameter(surface=byPatch_114, u=number_228, v=number_229)
code_block_242 = CodeBlock(center=pointAtParameter_119, w=n04_b_18, w1=n04_b2_9, h1=code_block_238, h2=number_227, cirection=string_77) { createUPlane(center, w, w1, h1, h2, cirection); }
byPatch_118 = Surface.ByPatch(code_block_242)

# group: 创建四跳散枓/交互枓底面
surfaces_14 = PolySurface.Surfaces(byLoft_14)
number_230 = DoubleInput(6)
getItemAtIndex_22 = List.GetItemAtIndex(list=surfaces_14, index=number_230)
number_231 = DoubleInput(0)
number_232 = DoubleInput(1)
pointAtParameter_120 = Surface.PointAtParameter(surface=getItemAtIndex_22, u=number_231, v=number_232)
x_draft_9 = CodeBlock(b=n01_b2) { b / 2; }
n04_b1_10 = DoubleInput(46)  # "04-b1"
y_draft_9 = CodeBlock(b=n04_b1_10) { b / 2; }
translate_10 = Geometry.Translate(geometry=pointAtParameter_120, xTranslation=x_draft_9, yTranslation=y_draft_9)
code_block_243 = CodeBlock(b1=n04_b1_10) { b1 / 2; }
code_block_244 = CodeBlock(p=translate_10, r=code_block_243) { createQuadCenter(p, r); }
byPatch_119 = Surface.ByPatch(code_block_244)

# group: 创建三跳散枓/交互枓的梯形
number_233 = DoubleInput(1)
number_234 = DoubleInput(0.5)
pointAtParameter_121 = Surface.PointAtParameter(surface=byPatch_119, u=number_233, v=number_234)
code_block_245 = CodeBlock(d1=n04_b1_4) { d1; }
n04_b_19 = DoubleInput(70)  # "04-b"
n04_h1_19 = DoubleInput(17)  # "04-h1"
code_block_246 = CodeBlock(b=n04_b_19, b1=n04_b1_4) { (b - b1) / 2; }
string_78 = StringInput("x+")
code_block_247 = CodeBlock(center=pointAtParameter_121, d1=code_block_245, d2=n04_b_19, h=n04_h1_19, dy=code_block_246, direction=string_78) { createTrape(center, d1, d2, h ,dy, direction); }
byPatch_120 = Surface.ByPatch(code_block_247)
number_235 = DoubleInput(0)
number_236 = DoubleInput(0.5)
pointAtParameter_122 = Surface.PointAtParameter(surface=byPatch_119, u=number_235, v=number_236)
string_79 = StringInput("x-")
code_block_248 = CodeBlock(center=pointAtParameter_122, d1=code_block_245, d2=n04_b_19, h=n04_h1_19, dy=code_block_246, direction=string_79) { createTrape(center, d1, d2, h ,dy, direction); }
byPatch_121 = Surface.ByPatch(code_block_248)
number_237 = DoubleInput(0)
number_238 = DoubleInput(0.5)
number_239 = DoubleInput(0)
pointAtParameter_123 = Surface.PointAtParameter(surface=byPatch_119, u=number_238, v=number_239)
string_80 = StringInput("y-")
code_block_249 = CodeBlock(center=pointAtParameter_123, d1=code_block_245, d2=n04_b_19, h=n04_h1_19, d=code_block_246, direction=string_80) { createTrape(center, d1, d2, h, d, direction); }
byPatch_122 = Surface.ByPatch(code_block_249)
number_240 = DoubleInput(0.5)
number_241 = DoubleInput(1)
pointAtParameter_124 = Surface.PointAtParameter(surface=byPatch_119, u=number_240, v=number_241)
string_81 = StringInput("y+")
code_block_250 = CodeBlock(center=pointAtParameter_124, d1=code_block_245, d2=n04_b_19, h=n04_h1_19, dy=code_block_246, direction=string_81) { createTrape(center, d1, d2, h ,dy, direction); }
byPatch_123 = Surface.ByPatch(code_block_250)

# group: 创建三跳散枓U型
number_242 = DoubleInput(0)
number_243 = DoubleInput(0.5)
pointAtParameter_125 = Surface.PointAtParameter(surface=byPatch_120, u=number_242, v=number_243)
n04_b_20 = DoubleInput(70)  # "04-b"
n04_b2_10 = DoubleInput(40)  # "04-b2"
n04_h_10 = DoubleInput(45)  # "04-h"
n04_h1_20 = DoubleInput(17)  # "04-h1"
code_block_251 = CodeBlock(h=n04_h_10, h1=n04_h1_20) { h - h1; }
number_244 = DoubleInput(0)
string_82 = StringInput("y")
code_block_252 = CodeBlock(center=pointAtParameter_125, w=n04_b_20, w1=n04_b2_10, h1=code_block_251, h2=number_244, cirection=string_82) { createUPlane(center, w, w1, h1, h2, cirection); }
byPatch_124 = Surface.ByPatch(code_block_252)
number_245 = DoubleInput(0)
number_246 = DoubleInput(0.5)
pointAtParameter_126 = Surface.PointAtParameter(surface=byPatch_121, u=number_245, v=number_246)
code_block_253 = CodeBlock(center=pointAtParameter_126, w=n04_b_20, w1=n04_b2_10, h1=code_block_251, h2=number_244, cirection=string_82) { createUPlane(center, w, w1, h1, h2, cirection); }
byPatch_125 = Surface.ByPatch(code_block_253)
number_247 = DoubleInput(0.5)
number_248 = DoubleInput(0)
pointAtParameter_127 = Surface.PointAtParameter(surface=byPatch_122, u=number_247, v=number_248)
n04_h2_10 = DoubleInput(18)  # "04-h2"
string_83 = StringInput("x")
code_block_254 = CodeBlock(center=pointAtParameter_127, w=n04_b_20, w1=n04_b2_10, h1=code_block_251, h2=n04_h2_10, cirection=string_83) { createUPlane(center, w, w1, h1, h2, cirection); }
byPatch_126 = Surface.ByPatch(code_block_254)
number_249 = DoubleInput(0.5)
number_250 = DoubleInput(1)
pointAtParameter_128 = Surface.PointAtParameter(surface=byPatch_123, u=number_249, v=number_250)
code_block_255 = CodeBlock(center=pointAtParameter_128, w=n04_b_20, w1=n04_b2_10, h1=code_block_251, h2=n04_h2_10, cirection=string_83) { createUPlane(center, w, w1, h1, h2, cirection); }
byPatch_127 = Surface.ByPatch(code_block_255)

# group: 创建四跳散枓/交互枓底面
surfaces_15 = PolySurface.Surfaces(byLoft_12)
number_251 = DoubleInput(6)
getItemAtIndex_23 = List.GetItemAtIndex(list=surfaces_15, index=number_251)
number_252 = DoubleInput(0)
number_253 = DoubleInput(1)
pointAtParameter_129 = Surface.PointAtParameter(surface=getItemAtIndex_23, u=number_252, v=number_253)
x_draft_10 = CodeBlock(b=n01_b2) { b / 2; }
n04_b1_11 = DoubleInput(46)  # "04-b1"
y_draft_10 = CodeBlock(b=n04_b1_11) { b / 2; }
translate_11 = Geometry.Translate(geometry=pointAtParameter_129, xTranslation=x_draft_10, yTranslation=y_draft_10)
code_block_256 = CodeBlock(b1=n04_b1_11) { b1 / 2; }
code_block_257 = CodeBlock(p=translate_11, r=code_block_256) { createQuadCenter(p, r); }
byPatch_128 = Surface.ByPatch(code_block_257)

# group: 创建三跳散枓/交互枓的梯形
number_254 = DoubleInput(1)
number_255 = DoubleInput(0.5)
pointAtParameter_130 = Surface.PointAtParameter(surface=byPatch_128, u=number_254, v=number_255)
code_block_258 = CodeBlock(d1=n04_b1_4) { d1; }
n04_b_21 = DoubleInput(70)  # "04-b"
n04_h1_21 = DoubleInput(17)  # "04-h1"
code_block_259 = CodeBlock(b=n04_b_21, b1=n04_b1_4) { (b - b1) / 2; }
string_84 = StringInput("x+")
code_block_260 = CodeBlock(center=pointAtParameter_130, d1=code_block_258, d2=n04_b_21, h=n04_h1_21, dy=code_block_259, direction=string_84) { createTrape(center, d1, d2, h ,dy, direction); }
byPatch_129 = Surface.ByPatch(code_block_260)
number_256 = DoubleInput(0)
number_257 = DoubleInput(0.5)
pointAtParameter_131 = Surface.PointAtParameter(surface=byPatch_128, u=number_256, v=number_257)
string_85 = StringInput("x-")
code_block_261 = CodeBlock(center=pointAtParameter_131, d1=code_block_258, d2=n04_b_21, h=n04_h1_21, dy=code_block_259, direction=string_85) { createTrape(center, d1, d2, h ,dy, direction); }
byPatch_130 = Surface.ByPatch(code_block_261)
number_258 = DoubleInput(0)
number_259 = DoubleInput(0.5)
number_260 = DoubleInput(0)
pointAtParameter_132 = Surface.PointAtParameter(surface=byPatch_128, u=number_259, v=number_260)
string_86 = StringInput("y-")
code_block_262 = CodeBlock(center=pointAtParameter_132, d1=code_block_258, d2=n04_b_21, h=n04_h1_21, d=code_block_259, direction=string_86) { createTrape(center, d1, d2, h, d, direction); }
byPatch_131 = Surface.ByPatch(code_block_262)
number_261 = DoubleInput(0.5)
number_262 = DoubleInput(1)
pointAtParameter_133 = Surface.PointAtParameter(surface=byPatch_128, u=number_261, v=number_262)
string_87 = StringInput("y+")
code_block_263 = CodeBlock(center=pointAtParameter_133, d1=code_block_258, d2=n04_b_21, h=n04_h1_21, dy=code_block_259, direction=string_87) { createTrape(center, d1, d2, h ,dy, direction); }
byPatch_132 = Surface.ByPatch(code_block_263)

# group: 创建三跳散枓U型
number_263 = DoubleInput(0)
number_264 = DoubleInput(0.5)
pointAtParameter_134 = Surface.PointAtParameter(surface=byPatch_129, u=number_263, v=number_264)
n04_b_22 = DoubleInput(70)  # "04-b"
n04_b2_11 = DoubleInput(40)  # "04-b2"
n04_h_11 = DoubleInput(45)  # "04-h"
n04_h1_22 = DoubleInput(17)  # "04-h1"
code_block_264 = CodeBlock(h=n04_h_11, h1=n04_h1_22) { h - h1; }
number_265 = DoubleInput(0)
string_88 = StringInput("y")
code_block_265 = CodeBlock(center=pointAtParameter_134, w=n04_b_22, w1=n04_b2_11, h1=code_block_264, h2=number_265, cirection=string_88) { createUPlane(center, w, w1, h1, h2, cirection); }
byPatch_133 = Surface.ByPatch(code_block_265)
number_266 = DoubleInput(0)
number_267 = DoubleInput(0.5)
pointAtParameter_135 = Surface.PointAtParameter(surface=byPatch_130, u=number_266, v=number_267)
code_block_266 = CodeBlock(center=pointAtParameter_135, w=n04_b_22, w1=n04_b2_11, h1=code_block_264, h2=number_265, cirection=string_88) { createUPlane(center, w, w1, h1, h2, cirection); }
byPatch_134 = Surface.ByPatch(code_block_266)
number_268 = DoubleInput(0.5)
number_269 = DoubleInput(0)
pointAtParameter_136 = Surface.PointAtParameter(surface=byPatch_131, u=number_268, v=number_269)
n04_h2_11 = DoubleInput(18)  # "04-h2"
string_89 = StringInput("x")
code_block_267 = CodeBlock(center=pointAtParameter_136, w=n04_b_22, w1=n04_b2_11, h1=code_block_264, h2=n04_h2_11, cirection=string_89) { createUPlane(center, w, w1, h1, h2, cirection); }
byPatch_135 = Surface.ByPatch(code_block_267)
number_270 = DoubleInput(0.5)
number_271 = DoubleInput(1)
pointAtParameter_137 = Surface.PointAtParameter(surface=byPatch_132, u=number_270, v=number_271)
code_block_268 = CodeBlock(center=pointAtParameter_137, w=n04_b_22, w1=n04_b2_11, h1=code_block_264, h2=n04_h2_11, cirection=string_89) { createUPlane(center, w, w1, h1, h2, cirection); }
byPatch_136 = Surface.ByPatch(code_block_268)

# group: 创建四跳散枓/交互枓底面
number_272 = DoubleInput(0.5)
number_273 = DoubleInput(0.5)
pointAtParameter_138 = Surface.PointAtParameter(surface=byPatch_82, u=number_272, v=number_273)
code_block_269 = CodeBlock(h_04=n04_h, h2_04=n04_h2, h_09=n09_h) { (h_04 - h2_04) + h_09; }
translate_12 = Geometry.Translate(geometry=pointAtParameter_138, zTranslation=code_block_269)
n04_b1_12 = DoubleInput(46)  # "04-b1"
code_block_270 = CodeBlock(b1=n04_b1_12) { b1 / 2; }
code_block_271 = CodeBlock(p=translate_12, r=code_block_270) { createQuadCenter(p, r); }
byPatch_137 = Surface.ByPatch(code_block_271)

# group: 创建三跳散枓/交互枓的梯形面
number_274 = DoubleInput(1)
number_275 = DoubleInput(0.5)
pointAtParameter_139 = Surface.PointAtParameter(surface=byPatch_137, u=number_274, v=number_275)
code_block_272 = CodeBlock(d1=n04_b1_7) { d1; }
n04_b_23 = DoubleInput(68)  # "04-b"
n04_h1_23 = DoubleInput(17)  # "04-h1"
code_block_273 = CodeBlock(b=n04_b_23, b1=n04_b1_7) { (b - b1) / 2; }
string_90 = StringInput("x+")
code_block_274 = CodeBlock(center=pointAtParameter_139, d1=code_block_272, d2=n04_b_23, h=n04_h1_23, dy=code_block_273, direction=string_90) { createTrape(center, d1, d2, h ,dy, direction); }
byPatch_138 = Surface.ByPatch(code_block_274)
number_276 = DoubleInput(0)
number_277 = DoubleInput(0.5)
pointAtParameter_140 = Surface.PointAtParameter(surface=byPatch_137, u=number_276, v=number_277)
string_91 = StringInput("x-")
code_block_275 = CodeBlock(center=pointAtParameter_140, d1=code_block_272, d2=n04_b_23, h=n04_h1_23, dy=code_block_273, direction=string_91) { createTrape(center, d1, d2, h ,dy, direction); }
byPatch_139 = Surface.ByPatch(code_block_275)
number_278 = DoubleInput(0.5)
number_279 = DoubleInput(0)
pointAtParameter_141 = Surface.PointAtParameter(surface=byPatch_137, u=number_278, v=number_279)
string_92 = StringInput("y-")
code_block_276 = CodeBlock(center=pointAtParameter_141, d1=code_block_272, d2=n04_b_23, h=n04_h1_23, d=code_block_273, direction=string_92) { createTrape(center, d1, d2, h, d, direction); }
byPatch_140 = Surface.ByPatch(code_block_276)
number_280 = DoubleInput(0.5)
number_281 = DoubleInput(1)
pointAtParameter_142 = Surface.PointAtParameter(surface=byPatch_137, u=number_280, v=number_281)
string_93 = StringInput("y+")
code_block_277 = CodeBlock(center=pointAtParameter_142, d1=code_block_272, d2=n04_b_23, h=n04_h1_23, dy=code_block_273, direction=string_93) { createTrape(center, d1, d2, h ,dy, direction); }
byPatch_141 = Surface.ByPatch(code_block_277)
number_282 = DoubleInput(0)

# group: 创建三跳散枓U型面
number_283 = DoubleInput(0)
number_284 = DoubleInput(0.5)
pointAtParameter_143 = Surface.PointAtParameter(surface=byPatch_138, u=number_283, v=number_284)
n04_b_24 = DoubleInput(70)  # "04-b"
n04_b2_12 = DoubleInput(40)  # "04-b2"
n04_h_12 = DoubleInput(45)  # "04-h"
n04_h1_24 = DoubleInput(17)  # "04-h1"
code_block_278 = CodeBlock(h=n04_h_12, h1=n04_h1_24) { h - h1; }
number_285 = DoubleInput(0)
string_94 = StringInput("y")
code_block_279 = CodeBlock(center=pointAtParameter_143, w=n04_b_24, w1=n04_b2_12, h1=code_block_278, h2=number_285, cirection=string_94) { createUPlane(center, w, w1, h1, h2, cirection); }
byPatch_142 = Surface.ByPatch(code_block_279)
number_286 = DoubleInput(0)
number_287 = DoubleInput(0.5)
pointAtParameter_144 = Surface.PointAtParameter(surface=byPatch_139, u=number_286, v=number_287)
code_block_280 = CodeBlock(center=pointAtParameter_144, w=n04_b_24, w1=n04_b2_12, h1=code_block_278, h2=number_285, cirection=string_94) { createUPlane(center, w, w1, h1, h2, cirection); }
byPatch_143 = Surface.ByPatch(code_block_280)
number_288 = DoubleInput(0.5)
number_289 = DoubleInput(0)
pointAtParameter_145 = Surface.PointAtParameter(surface=byPatch_140, u=number_288, v=number_289)
n04_h2_12 = DoubleInput(18)  # "04-h2"
string_95 = StringInput("x")
code_block_281 = CodeBlock(center=pointAtParameter_145, w=n04_b_24, w1=n04_b2_12, h1=code_block_278, h2=n04_h2_12, cirection=string_95) { createUPlane(center, w, w1, h1, h2, cirection); }
byPatch_144 = Surface.ByPatch(code_block_281)
number_290 = DoubleInput(0.5)
number_291 = DoubleInput(1)
pointAtParameter_146 = Surface.PointAtParameter(surface=byPatch_141, u=number_290, v=number_291)
code_block_282 = CodeBlock(center=pointAtParameter_146, w=n04_b_24, w1=n04_b2_12, h1=code_block_278, h2=n04_h2_12, cirection=string_95) { createUPlane(center, w, w1, h1, h2, cirection); }
byPatch_145 = Surface.ByPatch(code_block_282)

# group: 创建四跳散枓/交互枓底面
surfaces_16 = PolySurface.Surfaces(byLoft_13)
number_292 = DoubleInput(6)
getItemAtIndex_24 = List.GetItemAtIndex(list=surfaces_16, index=number_292)
number_293 = DoubleInput(0)
number_294 = DoubleInput(1)
pointAtParameter_147 = Surface.PointAtParameter(surface=getItemAtIndex_24, u=number_293, v=number_294)
x_draft_11 = CodeBlock(b=n01_b2) { b / 2; }
n04_b1_13 = DoubleInput(46)  # "04-b1"
y_draft_11 = CodeBlock(b=n04_b1_13) { b / 2; }
code_block_283 = CodeBlock(y=y_draft_11) { -y; }
translate_13 = Geometry.Translate(geometry=pointAtParameter_147, xTranslation=x_draft_11, yTranslation=code_block_283)
code_block_284 = CodeBlock(b1=n04_b1_13) { b1 / 2; }
code_block_285 = CodeBlock(p=translate_13, r=code_block_284) { createQuadCenter(p, r); }
byPatch_146 = Surface.ByPatch(code_block_285)

# group: 创建三跳散枓/交互枓的梯形面
number_295 = DoubleInput(1)
number_296 = DoubleInput(0.5)
pointAtParameter_148 = Surface.PointAtParameter(surface=byPatch_146, u=number_295, v=number_296)
code_block_286 = CodeBlock(d1=n04_b1_7) { d1; }
n04_b_25 = DoubleInput(68)  # "04-b"
n04_h1_25 = DoubleInput(17)  # "04-h1"
code_block_287 = CodeBlock(b=n04_b_25, b1=n04_b1_7) { (b - b1) / 2; }
string_96 = StringInput("x+")
code_block_288 = CodeBlock(center=pointAtParameter_148, d1=code_block_286, d2=n04_b_25, h=n04_h1_25, dy=code_block_287, direction=string_96) { createTrape(center, d1, d2, h ,dy, direction); }
byPatch_147 = Surface.ByPatch(code_block_288)
number_297 = DoubleInput(0)
number_298 = DoubleInput(0.5)
pointAtParameter_149 = Surface.PointAtParameter(surface=byPatch_146, u=number_297, v=number_298)
string_97 = StringInput("x-")
code_block_289 = CodeBlock(center=pointAtParameter_149, d1=code_block_286, d2=n04_b_25, h=n04_h1_25, dy=code_block_287, direction=string_97) { createTrape(center, d1, d2, h ,dy, direction); }
byPatch_148 = Surface.ByPatch(code_block_289)
number_299 = DoubleInput(0.5)
number_300 = DoubleInput(0)
pointAtParameter_150 = Surface.PointAtParameter(surface=byPatch_146, u=number_299, v=number_300)
string_98 = StringInput("y-")
code_block_290 = CodeBlock(center=pointAtParameter_150, d1=code_block_286, d2=n04_b_25, h=n04_h1_25, d=code_block_287, direction=string_98) { createTrape(center, d1, d2, h, d, direction); }
byPatch_149 = Surface.ByPatch(code_block_290)
number_301 = DoubleInput(0.5)
number_302 = DoubleInput(1)
pointAtParameter_151 = Surface.PointAtParameter(surface=byPatch_146, u=number_301, v=number_302)
string_99 = StringInput("y+")
code_block_291 = CodeBlock(center=pointAtParameter_151, d1=code_block_286, d2=n04_b_25, h=n04_h1_25, dy=code_block_287, direction=string_99) { createTrape(center, d1, d2, h ,dy, direction); }
byPatch_150 = Surface.ByPatch(code_block_291)
number_303 = DoubleInput(0)

# group: 创建三跳散枓U型面
number_304 = DoubleInput(0)
number_305 = DoubleInput(0.5)
pointAtParameter_152 = Surface.PointAtParameter(surface=byPatch_147, u=number_304, v=number_305)
n04_b_26 = DoubleInput(70)  # "04-b"
n04_b2_13 = DoubleInput(40)  # "04-b2"
n04_h_13 = DoubleInput(45)  # "04-h"
n04_h1_26 = DoubleInput(17)  # "04-h1"
code_block_292 = CodeBlock(h=n04_h_13, h1=n04_h1_26) { h - h1; }
number_306 = DoubleInput(0)
string_100 = StringInput("y")
code_block_293 = CodeBlock(center=pointAtParameter_152, w=n04_b_26, w1=n04_b2_13, h1=code_block_292, h2=number_306, cirection=string_100) { createUPlane(center, w, w1, h1, h2, cirection); }
byPatch_151 = Surface.ByPatch(code_block_293)
number_307 = DoubleInput(0)
number_308 = DoubleInput(0.5)
pointAtParameter_153 = Surface.PointAtParameter(surface=byPatch_148, u=number_307, v=number_308)
code_block_294 = CodeBlock(center=pointAtParameter_153, w=n04_b_26, w1=n04_b2_13, h1=code_block_292, h2=number_306, cirection=string_100) { createUPlane(center, w, w1, h1, h2, cirection); }
byPatch_152 = Surface.ByPatch(code_block_294)
number_309 = DoubleInput(0.5)
number_310 = DoubleInput(0)
pointAtParameter_154 = Surface.PointAtParameter(surface=byPatch_149, u=number_309, v=number_310)
n04_h2_13 = DoubleInput(18)  # "04-h2"
string_101 = StringInput("x")
code_block_295 = CodeBlock(center=pointAtParameter_154, w=n04_b_26, w1=n04_b2_13, h1=code_block_292, h2=n04_h2_13, cirection=string_101) { createUPlane(center, w, w1, h1, h2, cirection); }
byPatch_153 = Surface.ByPatch(code_block_295)
number_311 = DoubleInput(0.5)
number_312 = DoubleInput(1)
pointAtParameter_155 = Surface.PointAtParameter(surface=byPatch_150, u=number_311, v=number_312)
code_block_296 = CodeBlock(center=pointAtParameter_155, w=n04_b_26, w1=n04_b2_13, h1=code_block_292, h2=n04_h2_13, cirection=string_101) { createUPlane(center, w, w1, h1, h2, cirection); }
byPatch_154 = Surface.ByPatch(code_block_296)

# group: 创建四跳散枓/交互枓底面
surfaces_17 = PolySurface.Surfaces(byLoft_15)
number_313 = DoubleInput(6)
getItemAtIndex_25 = List.GetItemAtIndex(list=surfaces_17, index=number_313)
number_314 = DoubleInput(0)
number_315 = DoubleInput(1)
pointAtParameter_156 = Surface.PointAtParameter(surface=getItemAtIndex_25, u=number_314, v=number_315)
x_draft_12 = CodeBlock(b=n01_b2) { b / 2; }
n04_b1_14 = DoubleInput(46)  # "04-b1"
y_draft_12 = CodeBlock(b=n04_b1_14) { b / 2; }
code_block_297 = CodeBlock(y=y_draft_12) { -y; }
translate_14 = Geometry.Translate(geometry=pointAtParameter_156, xTranslation=x_draft_12, yTranslation=code_block_297)
code_block_298 = CodeBlock(b1=n04_b1_14) { b1 / 2; }
code_block_299 = CodeBlock(p=translate_14, r=code_block_298) { createQuadCenter(p, r); }
byPatch_155 = Surface.ByPatch(code_block_299)

# group: 创建三跳散枓/交互枓的梯形面
number_316 = DoubleInput(1)
number_317 = DoubleInput(0.5)
pointAtParameter_157 = Surface.PointAtParameter(surface=byPatch_155, u=number_316, v=number_317)
code_block_300 = CodeBlock(d1=n04_b1_7) { d1; }
n04_b_27 = DoubleInput(68)  # "04-b"
n04_h1_27 = DoubleInput(17)  # "04-h1"
code_block_301 = CodeBlock(b=n04_b_27, b1=n04_b1_7) { (b - b1) / 2; }
string_102 = StringInput("x+")
code_block_302 = CodeBlock(center=pointAtParameter_157, d1=code_block_300, d2=n04_b_27, h=n04_h1_27, dy=code_block_301, direction=string_102) { createTrape(center, d1, d2, h ,dy, direction); }
byPatch_156 = Surface.ByPatch(code_block_302)
number_318 = DoubleInput(0)
number_319 = DoubleInput(0.5)
pointAtParameter_158 = Surface.PointAtParameter(surface=byPatch_155, u=number_318, v=number_319)
string_103 = StringInput("x-")
code_block_303 = CodeBlock(center=pointAtParameter_158, d1=code_block_300, d2=n04_b_27, h=n04_h1_27, dy=code_block_301, direction=string_103) { createTrape(center, d1, d2, h ,dy, direction); }
byPatch_157 = Surface.ByPatch(code_block_303)
number_320 = DoubleInput(0.5)
number_321 = DoubleInput(0)
pointAtParameter_159 = Surface.PointAtParameter(surface=byPatch_155, u=number_320, v=number_321)
string_104 = StringInput("y-")
code_block_304 = CodeBlock(center=pointAtParameter_159, d1=code_block_300, d2=n04_b_27, h=n04_h1_27, d=code_block_301, direction=string_104) { createTrape(center, d1, d2, h, d, direction); }
byPatch_158 = Surface.ByPatch(code_block_304)
number_322 = DoubleInput(0.5)
number_323 = DoubleInput(1)
pointAtParameter_160 = Surface.PointAtParameter(surface=byPatch_155, u=number_322, v=number_323)
string_105 = StringInput("y+")
code_block_305 = CodeBlock(center=pointAtParameter_160, d1=code_block_300, d2=n04_b_27, h=n04_h1_27, dy=code_block_301, direction=string_105) { createTrape(center, d1, d2, h ,dy, direction); }
byPatch_159 = Surface.ByPatch(code_block_305)
number_324 = DoubleInput(0)

# group: 创建三跳散枓U型面
number_325 = DoubleInput(0)
number_326 = DoubleInput(0.5)
pointAtParameter_161 = Surface.PointAtParameter(surface=byPatch_156, u=number_325, v=number_326)
n04_b_28 = DoubleInput(70)  # "04-b"
n04_b2_14 = DoubleInput(40)  # "04-b2"
n04_h_14 = DoubleInput(45)  # "04-h"
n04_h1_28 = DoubleInput(17)  # "04-h1"
code_block_306 = CodeBlock(h=n04_h_14, h1=n04_h1_28) { h - h1; }
number_327 = DoubleInput(0)
string_106 = StringInput("y")
code_block_307 = CodeBlock(center=pointAtParameter_161, w=n04_b_28, w1=n04_b2_14, h1=code_block_306, h2=number_327, cirection=string_106) { createUPlane(center, w, w1, h1, h2, cirection); }
byPatch_160 = Surface.ByPatch(code_block_307)
number_328 = DoubleInput(0)
number_329 = DoubleInput(0.5)
pointAtParameter_162 = Surface.PointAtParameter(surface=byPatch_157, u=number_328, v=number_329)
code_block_308 = CodeBlock(center=pointAtParameter_162, w=n04_b_28, w1=n04_b2_14, h1=code_block_306, h2=number_327, cirection=string_106) { createUPlane(center, w, w1, h1, h2, cirection); }
byPatch_161 = Surface.ByPatch(code_block_308)
number_330 = DoubleInput(0.5)
number_331 = DoubleInput(0)
pointAtParameter_163 = Surface.PointAtParameter(surface=byPatch_158, u=number_330, v=number_331)
n04_h2_14 = DoubleInput(18)  # "04-h2"
string_107 = StringInput("x")
code_block_309 = CodeBlock(center=pointAtParameter_163, w=n04_b_28, w1=n04_b2_14, h1=code_block_306, h2=n04_h2_14, cirection=string_107) { createUPlane(center, w, w1, h1, h2, cirection); }
byPatch_162 = Surface.ByPatch(code_block_309)
number_332 = DoubleInput(0.5)
number_333 = DoubleInput(1)
pointAtParameter_164 = Surface.PointAtParameter(surface=byPatch_159, u=number_332, v=number_333)
code_block_310 = CodeBlock(center=pointAtParameter_164, w=n04_b_28, w1=n04_b2_14, h1=code_block_306, h2=n04_h2_14, cirection=string_107) { createUPlane(center, w, w1, h1, h2, cirection); }
byPatch_163 = Surface.ByPatch(code_block_310)

# group: 创建四跳散枓/交互枓底面
surfaces_18 = PolySurface.Surfaces(byLoft_16)
number_334 = DoubleInput(6)
getItemAtIndex_26 = List.GetItemAtIndex(list=surfaces_18, index=number_334)
number_335 = DoubleInput(0)
number_336 = DoubleInput(1)
pointAtParameter_165 = Surface.PointAtParameter(surface=getItemAtIndex_26, u=number_335, v=number_336)
n04_b1_15 = DoubleInput(46)  # "04-b1"
x_draft_13 = CodeBlock(b=n04_b1_15) { b / 2; }
code_block_311 = CodeBlock(x=x_draft_13) { -x; }
y_draft_13 = CodeBlock(b=n01_b2) { b / 2; }
translate_15 = Geometry.Translate(geometry=pointAtParameter_165, xTranslation=code_block_311, yTranslation=y_draft_13)
code_block_312 = CodeBlock(b1=n04_b1_15) { b1 / 2; }
code_block_313 = CodeBlock(p=translate_15, r=code_block_312) { createQuadCenter(p, r); }
byPatch_164 = Surface.ByPatch(code_block_313)

# group: 创建三跳散枓/交互枓的梯形面
number_337 = DoubleInput(0)
number_338 = DoubleInput(0)
number_339 = DoubleInput(0.5)
pointAtParameter_166 = Surface.PointAtParameter(surface=byPatch_164, u=number_338, v=number_339)
code_block_314 = CodeBlock(d1=n04_b1_8) { d1; }
n04_b_29 = DoubleInput(68)  # "04-b"
n04_h1_29 = DoubleInput(17)  # "04-h1"
code_block_315 = CodeBlock(b=n04_b_29, b1=n04_b1_8) { (b - b1) / 2; }
string_108 = StringInput("x-")
code_block_316 = CodeBlock(center=pointAtParameter_166, d1=code_block_314, d2=n04_b_29, h=n04_h1_29, dy=code_block_315, direction=string_108) { createTrape(center, d1, d2, h ,dy, direction); }
byPatch_165 = Surface.ByPatch(code_block_316)
number_340 = DoubleInput(0.5)
number_341 = DoubleInput(1)
pointAtParameter_167 = Surface.PointAtParameter(surface=byPatch_164, u=number_340, v=number_341)
string_109 = StringInput("y+")
code_block_317 = CodeBlock(center=pointAtParameter_167, d1=code_block_314, d2=n04_b_29, h=n04_h1_29, dy=code_block_315, direction=string_109) { createTrape(center, d1, d2, h ,dy, direction); }
byPatch_166 = Surface.ByPatch(code_block_317)
number_342 = DoubleInput(0.5)
number_343 = DoubleInput(0)
pointAtParameter_168 = Surface.PointAtParameter(surface=byPatch_164, u=number_342, v=number_343)
string_110 = StringInput("y-")
code_block_318 = CodeBlock(center=pointAtParameter_168, d1=code_block_314, d2=n04_b_29, h=n04_h1_29, d=code_block_315, direction=string_110) { createTrape(center, d1, d2, h, d, direction); }
byPatch_167 = Surface.ByPatch(code_block_318)
number_344 = DoubleInput(1)
number_345 = DoubleInput(0.5)
pointAtParameter_169 = Surface.PointAtParameter(surface=byPatch_164, u=number_344, v=number_345)
string_111 = StringInput("x+")
code_block_319 = CodeBlock(center=pointAtParameter_169, d1=code_block_314, d2=n04_b_29, h=n04_h1_29, dy=code_block_315, direction=string_111) { createTrape(center, d1, d2, h ,dy, direction); }
byPatch_168 = Surface.ByPatch(code_block_319)

# group: 创建三跳散枓U型面
number_346 = DoubleInput(0)
number_347 = DoubleInput(0)
number_348 = DoubleInput(0.5)
pointAtParameter_170 = Surface.PointAtParameter(surface=byPatch_165, u=number_347, v=number_348)
n04_b_30 = DoubleInput(70)  # "04-b"
n04_b2_15 = DoubleInput(40)  # "04-b2"
n04_h_15 = DoubleInput(45)  # "04-h"
n04_h1_30 = DoubleInput(17)  # "04-h1"
code_block_320 = CodeBlock(h=n04_h_15, h1=n04_h1_30) { h - h1; }
n04_h2_15 = DoubleInput(18)  # "04-h2"
string_112 = StringInput("y")
code_block_321 = CodeBlock(center=pointAtParameter_170, w=n04_b_30, w1=n04_b2_15, h1=code_block_320, h2=n04_h2_15, cirection=string_112) { createUPlane(center, w, w1, h1, h2, cirection); }
byPatch_169 = Surface.ByPatch(code_block_321)
number_349 = DoubleInput(0.5)
number_350 = DoubleInput(1)
pointAtParameter_171 = Surface.PointAtParameter(surface=byPatch_166, u=number_349, v=number_350)
string_113 = StringInput("x")
code_block_322 = CodeBlock(center=pointAtParameter_171, w=n04_b_30, w1=n04_b2_15, h1=code_block_320, h2=n04_h2_15, cirection=string_113) { createUPlane(center, w, w1, h1, h2, cirection); }
byPatch_170 = Surface.ByPatch(code_block_322)
number_351 = DoubleInput(0.5)
number_352 = DoubleInput(0)
pointAtParameter_172 = Surface.PointAtParameter(surface=byPatch_167, u=number_351, v=number_352)
code_block_323 = CodeBlock(center=pointAtParameter_172, w=n04_b_30, w1=n04_b2_15, h1=code_block_320, h2=n04_h2_15, cirection=string_113) { createUPlane(center, w, w1, h1, h2, cirection); }
byPatch_171 = Surface.ByPatch(code_block_323)
number_353 = DoubleInput(0)
number_354 = DoubleInput(0.5)
pointAtParameter_173 = Surface.PointAtParameter(surface=byPatch_168, u=number_353, v=number_354)
code_block_324 = CodeBlock(center=pointAtParameter_173, w=n04_b_30, w1=n04_b2_15, h1=code_block_320, h2=n04_h2_15, cirection=string_112) { createUPlane(center, w, w1, h1, h2, cirection); }
byPatch_172 = Surface.ByPatch(code_block_324)

# group: 创建四跳生头木
code_block_325 = CodeBlock()
# ---------- code_block_325.designscript (16 lines) ----------
//获取创建枋类构件的中心点
//p_center->与坊正交的栱的长方体部分的质心
//p_down->栌枓的内角点
//dh->与坊正交的栱的高的一半
def getHGFang(p, db, w, l, h)
{
 x1 = p.X + db - l / 2;
 y1 = p.Y - w / 2;
 z1 = p.Z + h / 2;

 p1 = Point.ByCoordinates(x1, y1, z1);

 cube = Cuboid.ByLengths(p1, l, w, h);

 return = cube;
};
# ----------------------------------------
code_block_326 = CodeBlock(h2=n04_h2, h1=code_block_41) { h2 / h1; }
code_block_327 = CodeBlock(b=n04_b, b2=n04_b2) { ((b - b2) / 2) + b2; }
code_block_328 = CodeBlock(w1=code_block_327, w=n04_b) { w1 / w; }
pointAtParameter_174 = Surface.PointAtParameter(surface=byPatch_172, u=code_block_326, v=code_block_328)
n15_b1 = DoubleInput(90)  # "15-b1"
code_block_329 = CodeBlock(b1_15=n15_b1, b_05=n04_b_2, b4_05=code_block_328) { b1_15 - (b_05 - b4_05); }
n15_t = DoubleInput(40)  # "15-t"
n15_b = DoubleInput(722)  # "15-b"
n15_h = DoubleInput(60)  # "15-h"
code_block_330 = CodeBlock(p=pointAtParameter_174, db=code_block_329, w=n15_t, l=n15_b, h=n15_h) { getHGFang(p, db, w, l, h); }

# group: 创建四跳柱头枋
code_block_331 = CodeBlock()
# ---------- code_block_331.designscript (10 lines) ----------
def getMidPoint(p1, p2, h1, dh, h)
{
 x1 = (p1.X + p2.X) / 2;
 y1 = (p1.Y + p2.Y) / 2;
 z1 = p1.Z + h1 + dh + h / 2;

 p_mid = Point.ByCoordinates(x1, y1, z1);

 return = p_mid;
};
# ----------------------------------------
number_355 = DoubleInput(0.5)
number_356 = DoubleInput(0.5)
pointAtParameter_175 = Surface.PointAtParameter(surface=byPatch_155, u=number_355, v=number_356)
number_357 = DoubleInput(0.5)
number_358 = DoubleInput(0.5)
pointAtParameter_176 = Surface.PointAtParameter(surface=byPatch_119, u=number_357, v=number_358)
code_block_332 = CodeBlock(h=n04_h, h1=n04_h1_2, h2=n04_h2) { h - h1 - h2; }
n13_h = DoubleInput(60)  # "13-h"
code_block_333 = CodeBlock(p1=pointAtParameter_175, p2=pointAtParameter_176, h1=n04_h1_2, dh=code_block_332, h=n13_h) { getMidPoint(p1, p2, h1, dh, h); }
n14_w = DoubleInput(40)  # "14-w"
n14_l = DoubleInput(466)  # "14-l"
byLengths_2 = Cuboid.ByLengths(origin=code_block_333, width=n14_w, length=n14_l, height=n13_h)

# group: 创建四跳柱头枋
code_block_334 = CodeBlock()  # same code as code_block_331
number_359 = DoubleInput(0.5)
number_360 = DoubleInput(0.5)
pointAtParameter_177 = Surface.PointAtParameter(surface=byPatch_146, u=number_359, v=number_360)
number_361 = DoubleInput(0.5)
number_362 = DoubleInput(0.5)
pointAtParameter_178 = Surface.PointAtParameter(surface=byPatch_128, u=number_361, v=number_362)
code_block_335 = CodeBlock(h=n04_h, h1=n04_h1_2, h2=n04_h2) { h - h1 - h2; }
n13_h_2 = DoubleInput(60)  # "13-h"
code_block_336 = CodeBlock(p1=pointAtParameter_177, p2=pointAtParameter_178, h1=n04_h1_2, dh=code_block_335, h=n13_h_2) { getMidPoint(p1, p2, h1, dh, h); }
n14_w_2 = DoubleInput(40)  # "14-w"
n14_l_2 = DoubleInput(466)  # "14-l"
byLengths_3 = Cuboid.ByLengths(origin=code_block_336, width=n14_w_2, length=n14_l_2, height=n13_h_2)

# group: 创建四跳柱头枋
code_block_337 = CodeBlock()  # same code as code_block_331
number_363 = DoubleInput(0.5)
number_364 = DoubleInput(0.5)
pointAtParameter_179 = Surface.PointAtParameter(surface=byPatch_137, u=number_363, v=number_364)
number_365 = DoubleInput(0.5)
number_366 = DoubleInput(0.5)
pointAtParameter_180 = Surface.PointAtParameter(surface=byPatch_110, u=number_365, v=number_366)
code_block_338 = CodeBlock(h=n04_h, h1=n04_h1_2, h2=n04_h2) { h - h1 - h2; }
n13_h_3 = DoubleInput(60)  # "13-h"
code_block_339 = CodeBlock(p1=pointAtParameter_179, p2=pointAtParameter_180, h1=n04_h1_2, dh=code_block_338, h=n13_h_3) { getMidPoint(p1, p2, h1, dh, h); }
n13_w = DoubleInput(40)  # "13-w"
n13_l = DoubleInput(568)  # "13-l"
byLengths_4 = Cuboid.ByLengths(origin=code_block_339, width=n13_w, length=n13_l, height=n13_h_3)

# group: 创建叉柱
number_367 = DoubleInput(0)
number_368 = DoubleInput(0)
n16_h = DoubleInput(377)  # "16-h"
byCoordinates_2 = Point.ByCoordinates(x=number_367, y=number_368, z=n16_h)
translate_16 = Geometry.Translate(geometry=byCoordinates, zTranslation=n01_h)
n16_r = DoubleInput(70)  # "16-r"
byPointsRadius = Cylinder.ByPointsRadius(byCoordinates_2, translate_16, n16_r)

pointAtParameter_181 = Surface.PointAtParameter()
pointAtParameter_182 = Surface.PointAtParameter()

# group: 创建四跳铺板枋
number_369 = DoubleInput(0.5)
number_370 = DoubleInput(0.5)
pointAtParameter_183 = Surface.PointAtParameter(surface=byPatch_164, u=number_369, v=number_370)
code_block_340 = CodeBlock(h=n04_h, h2=n04_h2, h_14=n13_h) { h - h2 + h_14 / 2; }
translate_17 = Geometry.Translate(geometry=pointAtParameter_183, zTranslation=code_block_340)
byLengths_5 = Cuboid.ByLengths(origin=translate_17, width=n14_w, length=n14_l, height=n13_h)
