# Dynamo graph final.dyn (Dynamo 0.9.1.4062)

number_slider = DoubleSlider(60, range=50..80 step 2)
number_slider_2 = DoubleSlider(568, range=500..620 step 2)
number_slider_3 = DoubleSlider(90, range=70..120 step 2)
number_slider_4 = DoubleSlider(466, range=400..530 step 2)
number_slider_5 = DoubleSlider(722, range=680..780 step 2)
number_slider_6 = DoubleSlider(377, range=300..420 step 1)
number_slider_7 = DoubleSlider(70, range=50..100 step 2)
number_slider_8 = DoubleSlider(256, range=200..300 step 2)
number_slider_9 = DoubleSlider(568, range=500..620 step 2)
number_slider_10 = DoubleSlider(60, range=50..80 step 2)
number_slider_11 = DoubleSlider(632, range=580..680 step 1)
number_slider_12 = DoubleSlider(90, range=70..100 step 2)
number_slider_13 = DoubleSlider(32, range=20..50 step 2)
number_slider_14 = DoubleSlider(413, range=350..450 step 1)
number_slider_15 = DoubleSlider(220, range=180..300 step 5)
number_slider_16 = DoubleSlider(280, range=250..350 step 5)
number_slider_17 = DoubleSlider(90, range=70..100 step 2)
number_slider_18 = DoubleSlider(60, range=50..80 step 2)
number_slider_19 = DoubleSlider(32, range=20..50 step 2)
number_slider_20 = DoubleSlider(466, range=400..500 step 2)
number_slider_21 = DoubleSlider(0, range=0..10 step 1)
number_slider_22 = DoubleSlider(18, range=5..30 step 1)
number_slider_23 = DoubleSlider(45, range=30..50 step 1)
number_slider_24 = DoubleSlider(40, range=20..60 step 5)
number_slider_25 = DoubleSlider(70, range=50..100 step 5)
number_slider_26 = DoubleSlider(17, range=5..30 step 1)
number_slider_27 = DoubleSlider(45, range=30..50 step 1)
code_block = CodeBlock { Point.ByCoordinates(0, 0, 0); }
number_slider_28 = DoubleSlider(100, range=80..130 step 5)
number_slider_29 = DoubleSlider(120, range=100..150 step 5)
number_slider_30 = DoubleSlider(30, range=20..50 step 2)
number_slider_31 = DoubleSlider(36, range=20..50 step 2)
number_slider_32 = DoubleSlider(40, range=20..50 step 2)
number_slider_33 = DoubleSlider(80, range=60..100 step 2)
number = DoubleInput(4)
number_slider_34 = DoubleSlider(32, range=20..50 step 2)
number_slider_35 = DoubleSlider(60, range=50..80 step 2)
number_slider_36 = DoubleSlider(396, range=360..440 step 2)
createDouGong = Custom[createDouGong](h_13=number_slider, l_13=number_slider_2, b1_15=number_slider_3, l_14=number_slider_4, b_15=number_slider_5, h_16=number_slider_6, r_16=number_slider_7, b_11=number_slider_8, b_09=number_slider_9, h_09=number_slider_10, b_12=number_slider_11, b2_12=number_slider_12, h1_10=number_slider_13, b_10=number_slider_14, b_07=number_slider_15, b_02=number_slider_16, b2_08=number_slider_17, h_06=number_slider_18, h1_06=number_slider_19, b_06=number_slider_20, h2_05=number_slider_21, h2_04=number_slider_22, h_04=number_slider_23, b2_04=number_slider_24, b_04=number_slider_25, h1_04=number_slider_26, b1_04=number_slider_27, CenterPoint=code_block, b1_01=number_slider_28, b_01=number_slider_29, h1_01=number_slider_30, h2_01=number_slider_31, b2_01=number_slider_32, h_01=number_slider_33, m=number, h1_02=number_slider_34, h_02=number_slider_35, b_08=number_slider_36)  # 创建整体斗栱
join = List.Join(createDouGong.1_BottomQuad, createDouGong.1_T1, createDouGong.1_T4, createDouGong.1_T3, createDouGong.1_T2, createDouGong.1_U1, createDouGong.1_U2, createDouGong.1_U3, createDouGong.1_U4, createDouGong.1_JS1_C1, createDouGong.1_JS1_S, createDouGong.1_JS1_C2, createDouGong.1_JS2_C2, createDouGong.1_JS2_S, createDouGong.1_JS2_C1, createDouGong.1_JS3_C2, createDouGong.1_JS3_S, createDouGong.1_JS3_C1, createDouGong.1_JS4_C2, createDouGong.1_JS4_S, createDouGong.1_JS4_C1, createDouGong.2_SD1_Q, createDouGong.2_SD2_Q, createDouGong.2_JHD_Q, createDouGong.2_SD1_T1, createDouGong.2_SD1_T4, createDouGong.2_SD1_T3, createDouGong.2_SD1_T2, createDouGong.2_SD2_T1, createDouGong.2_SD2_T2, createDouGong.2_SD2_T3, createDouGong.2_SD2_T4, createDouGong.2_JHD_T1, createDouGong.2_JHD_T2, createDouGong.2_JHD_T3, createDouGong.2_JHD_T4, createDouGong.2_JHD_U4, createDouGong.2_JHD_U3, createDouGong.2_JHD_U2, createDouGong.2_SD2_U2, createDouGong.2_SD2_U3, createDouGong.2_SD2_U4, createDouGong.2_SD2_U1, createDouGong.2_JHD_U1, createDouGong.2_SD1_U4, createDouGong.2_SD1_U3, createDouGong.2_SD1_U2, createDouGong.2_SD1_U1, createDouGong.2_JS4_C2, createDouGong.2_JS3_C2, createDouGong.2_JS4_S, createDouGong.2_JS3_S, createDouGong.2_JS2_C2, createDouGong.2_JS2_S, createDouGong.2_JS4_C1, createDouGong.2_JS1_S, createDouGong.2_JS1_C2, createDouGong.2_JS2_C1, createDouGong.2_JS3_C1, createDouGong.2_JS1_C1, createDouGong.2_JS5_C2, createDouGong.2_JS5_S, createDouGong.2_JS5_C1, createDouGong.2_Cuboid_Of_HG, createDouGong.2_MidCuboid, createDouGong.MG_Cuboid, createDouGong.LG_Cuboid, createDouGong.ST_Cuboid, createDouGong.3_JS5_C2, createDouGong.3_JS4_C2, createDouGong.3_JS4_S, createDouGong.3_JS5_S, createDouGong.3_JS3_C2, createDouGong.3_JS3_S, createDouGong.3_JS2_C2, createDouGong.3_JS4_C1, createDouGong.3_JS2_S, createDouGong.3_JS2_C1, createDouGong.3_JS3_C1, createDouGong.3_JS5_C1, createDouGong.3_JS1_C2, createDouGong.3_JS1_S, createDouGong.3_JS1_C1, createDouGong.3_JHD_U4, createDouGong.3_JHD_U3, createDouGong.3_JHD_U2, createDouGong.3_SD2_U3, createDouGong.3_SD2_U4, createDouGong.3_SD2_U2, createDouGong.3_SD2_U1, createDouGong.3_JHD_U1, createDouGong.3_JHD_T4, createDouGong.3_SD2_T4, createDouGong.3_SD1_U4, createDouGong.3_SD1_U3, createDouGong.3_SD2_T3, createDouGong.3_JHD_T3, createDouGong.3_SD1_U2, createDouGong.3_SD1_U1, createDouGong.3_SD1_T4, createDouGong.3_SD1_T3, createDouGong.3_SD1_T2, createDouGong.3_JHD_T2, createDouGong.3_SD2_T2, createDouGong.3_SD1_T1, createDouGong.3_JHD_T1, createDouGong.3_SD2_T1, createDouGong.3_SD4_U3, createDouGong.3_SD4_U4, createDouGong.3_SD4_U2, createDouGong.3_SD4_U1, createDouGong.3_SD4_T4, createDouGong.3_SD3_U4, createDouGong.3_SD3_U3, createDouGong.3_SD3_U2, createDouGong.3_SD3_U1, createDouGong.3_SD3_T4, createDouGong.3_SD4_T3, createDouGong.3_SD3_T3, createDouGong.3_SD3_T2, createDouGong.3_SD4_T2, createDouGong.3_SD3_T1, createDouGong.3_SD4_T1, createDouGong.3_SD2_Q, createDouGong.3_JHD_Q, createDouGong.3_SD4_Q, createDouGong.3_SD1_Q, createDouGong.3_SD3_Q, createDouGong.3_ZTF_Cuboid, createDouGong.4_JHD_U4, createDouGong.4_JHD_U3, createDouGong.4_SD4_U3, createDouGong.4_SD4_U4, createDouGong.4_JHD_U2, createDouGong.4_SD4_U2, createDouGong.4_SD3_U4, createDouGong.4_SD3_U3, createDouGong.4_JHD_U1, createDouGong.4_SD3_U2, createDouGong.4_SD4_U1, createDouGong.4_SD3_U1, createDouGong.4_JHD_T4, createDouGong.4_SD4_T4, createDouGong.4_SD3_T4, createDouGong.4_SD2_U3, createDouGong.4_SD2_U4, createDouGong.4_SD2_U2, createDouGong.4_SD2_U1, createDouGong.4_SD2_T4, createDouGong.4_JHD_T3, createDouGong.4_SD2_T3, createDouGong.4_SD4_T3, createDouGong.4_SD3_T3, createDouGong.6_JHD_T2, createDouGong.4_SD2_T2, createDouGong.4_SD3_T2, createDouGong.4_SD4_T2, createDouGong.4_SD1_U4, createDouGong.4_SD1_U3, createDouGong.4_SD1_U2, createDouGong.4_SD1_U1, createDouGong.6_JHD_T1, createDouGong.4_SD1_T4, createDouGong.4_SD1_T3, createDouGong.4_SD1_T2, createDouGong.4_SD2_T1, createDouGong.4_SD3_T1, createDouGong.4_SD4_T1, createDouGong.4_SD1_T1, createDouGong.4_JHD_Q, createDouGong.4_SD4_Q, createDouGong.4_SD2_Q, createDouGong.4_SD1_Q, createDouGong.4_SD3_Q, createDouGong.4_SD6_U3, createDouGong.4_SD6_U4, createDouGong.4_SD6_U2, createDouGong.4_SD6_U1, createDouGong.4_SD5_U4, createDouGong.4_SD5_U3, createDouGong.4_SD5_U2, createDouGong.4_SD5_U1, createDouGong.4_SD6_T4, createDouGong.4_SD5_T4, createDouGong.4_SD5_T3, createDouGong.4_SD6_T3, createDouGong.4_SD5_T2, createDouGong.4_SD6_T2, createDouGong.4_SD5_T1, createDouGong.4_SD6_T1, createDouGong.4_SD6_Q, createDouGong.4_SD5_Q, createDouGong.4_13_Fang, createDouGong.4_14_Fang2, createDouGong.4_14_Fang3, createDouGong.4_14_Fang1, createDouGong.4_15_Fang, createDouGong.4_16_ChaZhu)
all_elements_in_active_view = ElementsInView()
watch = Watch(all_elements_in_active_view)
views = Views("视图 1")
all_elements_at_level = ElementsAtLevel()
family_types = FamilyTypes("标高标头 - 升级:6 mm")
all_elements_of_family_type = ElementsOfFamilyType(family_types)
element_types = ElementTypes("View3D")
