# Dynamo custom node getMidPoint.dyf (Dynamo 0.9.1.4062)
# category: Geometry.Point
# 获取柱头坊的中心点
# p1, p2->两侧散枓的内角点
# h1->散枓的h1
# dh->散枓的U型底高
# h->枋的高

code_block = CodeBlock()
# ---------- code_block.designscript (15 lines) ----------
//获取柱头坊的中心点
//p1, p2->两侧散枓的内角点
//h1->散枓的h1
//dh->散枓的U型底高
//h->枋的高
def getMidPoint(p1, p2, h1, dh, h)
{
 x1 = (p1.X + p2.X) / 2;
 y1 = (p1.Y + p2.Y) / 2;
 z1 = p1.Z + h1 + dh + h / 2;

 p_mid = Point.ByCoordinates(x1, y1, z1);

 return = p_mid;
};
# ----------------------------------------
p1 = Input(p1:Point)  # One inner corner of Dou
p2 = Input(p2:Point)  # Another one inner corner of Dou
h1 = Input(h1:double)  # h1 of Dou
dh = Input(dh:double)  # Height of U Plane of Dou
h = Input(h:double)  # Height of Fang
code_block_2 = CodeBlock(p1=p1, p2=p2, h1=h1, dh=dh, h=h) { getMidPoint(p1, p2, h1, dh, h); }
Point = Output(code_block_2)
