# Dynamo custom node getNDGFangCenterPoint.dyf (Dynamo 0.9.1.4062)
# category: Geometry.Point
# 获取泥道栱方向创建枋类构件的中心点
# p_center->与坊正交的栱的长方体部分的质心
# p_down->栌枓的内角点
# dh->与坊正交的栱的高的一半

code_block = CodeBlock()
# ---------- code_block.designscript (14 lines) ----------
//获取泥道栱方向创建枋类构件的中心点
//p_center->与坊正交的栱的长方体部分的质心
//p_down->栌枓的内角点
//dh->与坊正交的栱的高的一半
def getNDGFangCenterPoint(p_center, p_down, dh)
{
 x1 = 0;
 y1 = 0;
 z1 = p_down.Z + (p_center.Z + dh - p_down.Z) / 2;

 p1 = Point.ByCoordinates(x1, y1, z1);

 return = p1;
};
# ----------------------------------------
p_center = Input(p_center:Point)  # The centroid of the cuboid of Gong orthogonal to Fang
p_down = Input(p_down:Point)  # Inner corner of Dou
dh = Input(dh:double)  # Half height of Gong orthogonal to Fang
code_block_2 = CodeBlock(p_center=p_center, p_down=p_down, dh=dh) { getNDGFangCenterPoint(p_center, p_down, dh); }
Point = Output(code_block_2)
