# Dynamo graph testAll.dyn (Dynamo 0.9.1.4062)

# group: Inputs
b2_01 = DoubleInput(40)
b1_04 = DoubleInput(45)
origin_point = CodeBlock { Point.ByCoordinates(0, 0, 0); }
b1_01 = DoubleInput(100)
b_01 = DoubleInput(120)
h1_01 = DoubleInput(30)
h2_01 = DoubleInput(36)
h_01 = DoubleInput(80)
m = DoubleInput(4)
b_02 = DoubleInput(277)
h1_02 = DoubleInput(32)
h_02 = DoubleInput(60)
h1_04 = DoubleInput(17)
b_04 = DoubleInput(70)
b2_04 = DoubleInput(40)
h_04 = DoubleInput(45)
h2_04 = DoubleInput(18)
h2_05 = DoubleInput(0)
b_07 = DoubleInput(220)
b_06 = DoubleInput(466)
h1_06 = DoubleInput(32)
h_06 = DoubleInput(60)
b2_08 = DoubleInput(90)
b_02_2 = DoubleInput(280)
b_10 = DoubleInput(413)
h_09 = DoubleInput(60)
h1_10 = DoubleInput(32)
b2_12 = DoubleInput(90)
b_11 = DoubleInput(256)
b_12 = DoubleInput(632)
b_09 = DoubleInput(568)
h_13 = DoubleInput(60)
l_13 = DoubleInput(568)
l_14 = DoubleInput(466)
b1_15 = DoubleInput(90)
b_15 = DoubleInput(722)
h_16 = DoubleInput(377)
r_16 = DoubleInput(70)

code_block = CodeBlock(b1_02=b2_01) { b1_02; }
createFirstTiao = Custom[createFirstTiao](p=origin_point, b1_01=b1_01, b_01=b_01, h1_01=h1_01, h2_01=h2_01, b2_01=b2_01, h_01=h_01, m=m, b_02=b_02, b1_02=code_block, h1_02=h1_02, h_02=h_02)  # 创建第一跳（栌斗+泥道栱+华栱
code_block_2 = CodeBlock(b1_06=b2_04) { b1_06; }
createSecondTiao = Custom[createSecondTiao](b2_01=b2_01, b1_04=b1_04, JSC_D1_1=createFirstTiao.Juansha1_Curve_1, JSC_D2_1=createFirstTiao.Juansha2_Curve_1, JSC_D3_1=createFirstTiao.Juansha3_Curve_1, h1_04=h1_04, b_04=b_04, b2_04=b2_04, h_04=h_04, h2_04=h2_04, h2_05=h2_05, b_07=b_07, b_06=b_06, b1_06=code_block_2, h1_06=h1_06, h_06=h_06, m=m, b2_08=b2_08, b_02=b_02_2)  # 创建第二跳
code_block_3 = CodeBlock(t_08=b2_04) { t_08; }
code_block_4 = CodeBlock(h_10=h_09) { h_10; }
code_block_5 = CodeBlock(b1_10=b2_04) { b1_10; }
code_block_6 = CodeBlock(h_12=h_09) { h_12; }
code_block_7 = CodeBlock(t_09=b2_04) { t_09; }
createThirdTiao = Custom[createThirdTiao](b2_01=b2_01, b1_04=b1_04, JSC_D1_S=createSecondTiao.JS1_S, JSC_D2_S=createSecondTiao.JS2_S, JSC_D3_S=createSecondTiao.JS3_S, h1_04=h1_04, b_04=b_04, b2_04=b2_04, h_04=h_04, h2_04=h2_04, h2_05=h2_05, b_07=b_07, m=m, t_08=code_block_3, JSC_D4_S=createSecondTiao.JS4_S, JSC_D5_S=createSecondTiao.JS5_S, b_10=b_10, h_10=code_block_4, b1_10=code_block_5, h1_10=h1_10, b2_12=b2_12, b_11=b_11, b_12=b_12, h_12=code_block_6, h_09=h_09, t_09=code_block_7, b_09=b_09)  # 创建第三跳
code_block_8 = CodeBlock(w_13=b2_04)
# ---------- code_block_8.designscript (2 lines) ----------
//t_13
w_13;
# ----------------------------------------
code_block_9 = CodeBlock(w_14=b2_04)
# ---------- code_block_9.designscript (2 lines) ----------
//t_14
w_14;
# ----------------------------------------
code_block_10 = CodeBlock(t_15=b2_04) { t_15; }
code_block_11 = CodeBlock(h_15=h_13) { h_15; }
createFourTiao = Custom[createFourTiao](b2_01=b2_01, b1_04=b1_04, JSC_D1_1=createThirdTiao.SD1_Q, JSC_D2_1=createThirdTiao.SD2_Q, JSC_D3_1=createThirdTiao.JS1_S, h1_04=h1_04, b_04=b_04, b2_04=b2_04, h_04=h_04, h2_04=h2_04, h2_05=h2_05, JSC_D4_1=createThirdTiao.JS2_S, JSC_D5_1=createThirdTiao.JS3_S, JSC_D6_1=createThirdTiao.JS4_S, JSC_D7_1=createThirdTiao.JS5_S, h_13=h_13, w_13=code_block_8, l_13=l_13, w_14=code_block_9, l_14=l_14, b1_15=b1_15, t_15=code_block_10, b_15=b_15, h_15=code_block_11, center=origin_point, h_01=h_01, h_16=h_16, r_16=r_16, h_09=h_09)  # 创建第四跳
